# Grasshopper definition 01_Ruled_Wave.gh (Grasshopper 1.0.8)
# plug-ins: KUKA|prc - parametric robot control

# ---- group: 01 | EMBEDDED DESIGN INPUTS
rail_a = RailA(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)
rail_b = RailB(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)
# NOTES: 01_Ruled_Wave
# ALGORITHM 1 — paired-rail synchronization. Two edge profiles are sampled at equal normalized parameters; each synchronized point pair becomes the hot-wire span. The midpoint is the TCP and the pair vector sets tool orientation. Use this for ruled and lofted wave surfaces.
# NOTES: FABRICATION ASSUMPTIONS
# Robot: KUKA KR6-10 R1100-2
# Tool 8 TCP: 0,0,421.35,0,-90,0 mm/deg
# Nominal cut speed: 0.12 m/s
# All geometry and components are embedded; no Python or script components.
synchronized_samples = Slider(32, range=8..100)

# ---- group: 02 | PAIRED-RAIL PATH ALGORITHM
stable_plane_x = StablePlaneX(Vector(1, 0, 0))
divide = DivideCurve(Curve=rail_a, Count=synchronized_samples, Kinks=False)  # -> Points, Tangents, Parameters
divide_2 = DivideCurve(Curve=rail_b, Count=synchronized_samples, Kinks=False)  # -> Points, Tangents, Parameters
ln = Line(StartPoint=divide.Points, EndPoint=divide_2.Points)
wire_midpoint = Slider(0.5, range=0..1)
eval = EvaluateCurve(Curve=ln, Parameter=wire_midpoint)  # -> Point, Tangent, Angle
pl = ConstructPlane(Origin=eval.Point, XAxis=stable_plane_x, YAxis=eval.Tangent)
reverse_x = BooleanToggle(True)
reverse_y = BooleanToggle(True)
swap_axes = BooleanToggle(False)
pflip = FlipPlane(Plane=pl, ReverseX=reverse_x, ReverseY=reverse_y, SwapAxes=swap_axes)
cut_speed_m_s = Slider(0.12, range=0.03..0.3)
lin_move = LINearMovementKUKAPrc(TargetAsPlane=pflip, Speed=cut_speed_m_s, extaxenabled=False, interpolation="C_DIS")

# ---- group: 03 | NATIVE KUKA|prc SIMULATION
hotwire_bow_mesh = HotwireBowMesh([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])
custom_tool = CustomToolKUKAPrc(
    CustomToolGeometry=hotwire_bow_mesh,
    isExternal=False,
    toolid=8,
    toolvala=0,
    toolvalb=-90,
    toolvalc=0,
    toolvalx=0,
    toolvaly=0,
    toolvalz=421.35,
    valuesset=True)
kr6_10_r1100_2 = AgilusKR610R11002Robot(infiniterot=False)
simulation_0_1 = Slider(0.65, range=0..1)
kuka_prc = KUKAPrcCORE(
    SimulationSlider=simulation_0_1,
    KUKAPrcCommands=lin_move,
    Tool=custom_tool,
    Robot=kr6_10_r1100_2,
    PRC_BaseExpose=False,
    PRC_SaveNameExpose=False,
    PRCsettings="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")  # -> RobotGeometry, AnalysisOutput
