# Grasshopper definition 02_Helical_Flute.gh (Grasshopper 1.0.8)
# plug-ins: KUKA|prc - parametric robot control

# ---- group: 01 | EMBEDDED DESIGN INPUT
hotwire_guide_curve = HotwireGuideCurve(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)
# NOTES: 02_Helical_Flute
# ALGORITHM 2 — continuous guide-curve sampling. A spatial helix is arc-length sampled while the hot-wire span is locked to world Y to prevent wrist flips; one native KUKA|prc SPL command creates the smooth sweep. Use for flutes and continuous sculpting.
# NOTES: FABRICATION ASSUMPTIONS
# Robot: KUKA KR6-10 R1100-2
# Tool 8 TCP: 0,0,421.35,0,-90,0 mm/deg
# Nominal cut speed: 0.12 m/s
# All geometry and components are embedded; no Python or script components.
frame_count = Slider(64, range=8..160)

# ---- group: 02 | CONTINUOUS SPLINE + LOCKED WIRE ORIENTATION
wire_frame_x = WireFrameX(Vector(1, 0, 0))
wire_span_y = WireSpanY(Vector(0, 1, 0))
divide = DivideCurve(Curve=hotwire_guide_curve, Count=frame_count, Kinks=False)  # -> Points, Tangents, Parameters
pl = ConstructPlane(Origin=divide.Points, XAxis=wire_frame_x, YAxis=wire_span_y)
reverse_x = BooleanToggle(True)
reverse_y = BooleanToggle(True)
swap_axes = BooleanToggle(False)
pflip = FlipPlane(Plane=pl, ReverseX=reverse_x, ReverseY=reverse_y, SwapAxes=swap_axes)
cut_speed_m_s = Slider(0.12, range=0.03..0.3)
spl_move = SPLineMovementKUKAPrc(PathAsListOfPlanes=pflip, Speed=cut_speed_m_s, extaxenabled=False, interpolation="C_DIS")

# ---- group: 03 | NATIVE KUKA|prc SIMULATION
hotwire_bow_mesh = HotwireBowMesh([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])
custom_tool = CustomToolKUKAPrc(
    CustomToolGeometry=hotwire_bow_mesh,
    isExternal=False,
    toolid=8,
    toolvala=0,
    toolvalb=-90,
    toolvalc=0,
    toolvalx=0,
    toolvaly=0,
    toolvalz=421.35,
    valuesset=True)
kr6_10_r1100_2 = AgilusKR610R11002Robot(infiniterot=False)
simulation_0_1 = Slider(0.65, range=0..1)
kuka_prc = KUKAPrcCORE(
    SimulationSlider=simulation_0_1,
    KUKAPrcCommands=spl_move,
    Tool=custom_tool,
    Robot=kr6_10_r1100_2,
    PRC_BaseExpose=False,
    PRC_SaveNameExpose=False,
    PRCsettings="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")  # -> RobotGeometry, AnalysisOutput
