# Grasshopper definition Hotwire_TwistedBlade_AllAlgorithms.gh (Grasshopper 1.0.8)

referencewiredir = ReferenceWireDir(Vector(0, 0, 1))
referenceplane = ReferencePlane(PlaneYZ(0, 0, 4))
twistdegrees = TwistDegrees(45)
wireacrossu = WireAcrossU(True)
anglecount = AngleCount(18)
preferlong = PreferLong(False)
widthstart = WidthStart(150)
widthend = WidthEnd(95)
extension = Extension(10)
tolerance = Tolerance(0.01)
extension_2 = Extension(10)
tolerance_2 = Tolerance(0.01)
extension_3 = Extension(10)
extension_4 = Extension(10)
tolerance_3 = Tolerance(0.01)
# DEMO TITLE: TWISTED TAPERED FOAM BLADE
# Four embedded C# implementations on one design
# Open STEP_BY_STEP_IMPLEMENTATION.md for the complete explanation.
# HOTWIRE 01 - SURFACE UV NOTE: HOTWIRE 01 - SURFACE UV
# Samples across the skin U direction and advances along V.
# Color key: red/orange
S = S(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)
count = Count(41)
flip = Flip(False)
# HOTWIRE 02 - AUTO BOUNDARY PAIR NOTE: HOTWIRE 02 - AUTO BOUNDARY PAIR
# Finds both opposite-edge pairs and chooses the shorter synchronized span.
# Color key: green
G = G(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)
count_2 = Count(41)
flip_2 = Flip(False)
# HOTWIRE 03 - CENTERLINE WIDTH / TWIST NOTE: HOTWIRE 03 - CENTERLINE WIDTH / TWIST
# Sweeps a variable-width, 45-degree twisted ribbon along the centerline.
# Color key: purple
path = Path(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)
count_3 = Count(41)
flip_3 = Flip(False)
# HOTWIRE 04 - MULTI-ANGLE ENVELOPE NOTE: HOTWIRE 04 - MULTI-ANGLE ENVELOPE
# Sections the closed blade and ranks 18 wire orientations over 180 degrees.
# Color key: cyan/blue
G_2 = G(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)
pathdir = PathDir(Vector(1, 0, 0))
count_4 = Count(41)
flip_4 = Flip(False)
hw_04_multi_angle_envelope = HOTWIRE04MULTIANGLEENVELOPE(
    G=G_2,
    PathDir=pathdir,
    ReferenceWireDir=referencewiredir,
    AngleCount=anglecount,
    Count=count_4,
    Extension=extension_4,
    Flip=flip_4,
    Tolerance=tolerance_3)  # -> out, Planes, WireLines, Ruled, RailA, RailB, MidPath, BestAngle, Scores, Report
# ---------- hw_04_multi_angle_envelope: C# ----------
// #! csharp
// Hot-wire Algorithm 04: multi-angle section-envelope search.
// Sections a Brep or Mesh along a path direction, tests wire directions around
// that axis, and keeps the direction with the most stable valid envelope.

using System;
using System.Collections.Generic;
using System.Linq;
using Grasshopper;
using Grasshopper.Kernel;
using Grasshopper.Kernel.Types;
using Rhino;
using Rhino.Geometry;
using Rhino.Geometry.Intersect;

public class Script_Instance : GH_ScriptInstance
{
  private void RunScript(
		object G,
		object PathDir,
		object ReferenceWireDir,
		object AngleCount,
		object Count,
		object Extension,
		object Flip,
		object Tolerance,
		ref object Planes,
		ref object WireLines,
		ref object Ruled,
		ref object RailA,
		ref object RailB,
		ref object MidPath,
		ref object BestAngle,
		ref object Scores,
		ref object Report)
  {
    Brep brep;
    Mesh mesh;
    if (!UnwrapGeometry(G, out brep, out mesh))
    {
      Report = "ERROR: G must be a Brep, Surface, Extrusion, SubD, or Mesh.";
      return;
    }

    Vector3d path = UnwrapVector(PathDir, Vector3d.XAxis);
    if (!path.Unitize()) path = Vector3d.XAxis;
    Vector3d reference = UnwrapVector(ReferenceWireDir, Vector3d.ZAxis);
    reference -= path * (reference * path);
    if (!reference.Unitize()) reference = Perpendicular(path);

    int angleCount = Math.Max(2, Math.Min(180, AsInt(AngleCount, 18)));
    int count = Math.Max(3, Math.Min(500, AsInt(Count, 41)));
    double extension = Math.Max(0.0, AsDouble(Extension, 0.0));
    bool flip = AsBool(Flip, false);
    double tol = AsDouble(Tolerance, 0.0);
    if (tol <= 0.0) tol = RhinoDoc.ActiveDoc == null ? 0.01 : RhinoDoc.ActiveDoc.ModelAbsoluteTolerance;

    BoundingBox box = brep != null ? brep.GetBoundingBox(true) : mesh.GetBoundingBox(true);
    double minPath;
    double maxPath;
    ProjectionRange(box, path, out minPath, out maxPath);
    if (maxPath - minPath <= tol)
    {
      Report = "ERROR: Geometry has no usable extent along PathDir.";
      return;
    }

    Point3d boxCenter = box.Center;
    var candidates = new List<Candidate>();
    for (int angleIndex = 0; angleIndex < angleCount; angleIndex++)
    {
      double angleDegrees = 180.0 * angleIndex / angleCount;
      Vector3d wireDirection = reference;
      wireDirection.Rotate(RhinoMath.ToRadians(angleDegrees), path);
      wireDirection.Unitize();
      Candidate candidate = EvaluateCandidate(brep, mesh, boxCenter, path, wireDirection, minPath, maxPath, count, extension, flip, tol);
      candidate.AngleDegrees = angleDegrees;
      candidates.Add(candidate);
    }

    Candidate best = candidates
      .Where(c => c.Lines.Count >= 2)
      .OrderByDescending(c => c.Score)
      .FirstOrDefault();
    if (best == null)
    {
      Report = "ERROR: No tested wire direction produced at least two usable sections.";
      Scores = candidates.Select(ScoreText).ToList();
      return;
    }

    List<Point3d> sideA = best.Lines.Select(line => line.From).ToList();
    List<Point3d> sideB = best.Lines.Select(line => line.To).ToList();
    List<Point3d> mids = best.Lines.Select(line => line.PointAt(0.5)).ToList();
    Curve railA = SmoothCurve(sideA);
    Curve railB = SmoothCurve(sideB);
    Curve midPath = SmoothCurve(mids);

    Planes = BuildPlanes(best.Lines, mids);
    WireLines = best.Lines;
    Ruled = StraightLoft(railA, railB);
    RailA = railA;
    RailB = railB;
    MidPath = midPath;
    BestAngle = best.AngleDegrees;
    Scores = candidates.Select(ScoreText).ToList();
    Report = string.Join(System.Environment.NewLine, new[]
    {
      "HOTWIRE 04 - MULTI-ANGLE SECTION ENVELOPE",
      string.Format("Best rotation from ReferenceWireDir: {0:0.###} degrees", best.AngleDegrees),
      string.Format("Valid sections: {0}/{1} ({2:P0}); score {3:0.###}", best.Lines.Count, count, best.Coverage, best.Score),
      string.Format("Wire-length coefficient of variation: {0:0.####}; maximum adjacent direction change: {1:0.###} degrees", best.LengthCv, best.MaxDirectionChange),
      "Plane convention: Origin=wire midpoint, X=wire A->B, Y=travel, Z=X cross Y.",
      "Each station uses the widest individual section contour along the tested wire direction.",
      "This is an envelope heuristic, not proof that a complex/non-convex solid is hot-wire manufacturable.",
      "No IK, collision, kerf, feed, or controller validation is performed."
    });
  }

  private class Candidate
  {
    public double AngleDegrees;
    public double Coverage;
    public double LengthCv;
    public double MaxDirectionChange;
    public double Score;
    public List<Line> Lines = new List<Line>();
  }

  private static Candidate EvaluateCandidate(Brep brep, Mesh mesh, Point3d boxCenter, Vector3d path, Vector3d wireDirection,
    double minPath, double maxPath, int stationCount, double extension, bool flip, double tol)
  {
    var result = new Candidate();
    for (int i = 0; i < stationCount; i++)
    {
      double t = 0.001 + 0.998 * i / (stationCount - 1);
      double coordinate = minPath + (maxPath - minPath) * t;
      double centerCoordinate = boxCenter.X * path.X + boxCenter.Y * path.Y + boxCenter.Z * path.Z;
      Point3d origin = boxCenter + path * (coordinate - centerCoordinate);
      Plane sectionPlane = new Plane(origin, path);

      Line widest;
      if (!WidestSection(brep, mesh, sectionPlane, wireDirection, tol, out widest)) continue;
      Vector3d axis = widest.Direction;
      if (!axis.Unitize() || widest.Length <= tol) continue;
      Point3d a = widest.From - axis * extension;
      Point3d b = widest.To + axis * extension;
      if (flip) { Point3d swap = a; a = b; b = swap; }
      result.Lines.Add(new Line(a, b));
    }

    result.Coverage = (double)result.Lines.Count / stationCount;
    if (result.Lines.Count == 0)
    {
      result.LengthCv = double.PositiveInfinity;
      result.MaxDirectionChange = 180.0;
      result.Score = double.NegativeInfinity;
      return result;
    }

    List<double> lengths = result.Lines.Select(line => line.Length).ToList();
    double mean = lengths.Average();
    double variance = lengths.Select(x => (x - mean) * (x - mean)).Average();
    result.LengthCv = mean <= tol ? double.PositiveInfinity : Math.Sqrt(variance) / mean;
    result.MaxDirectionChange = 0.0;
    for (int i = 1; i < result.Lines.Count; i++)
    {
      Vector3d a = result.Lines[i - 1].Direction;
      Vector3d b = result.Lines[i].Direction;
      a.Unitize();
      b.Unitize();
      double degrees = RhinoMath.ToDegrees(Vector3d.VectorAngle(a, b));
      if (degrees > result.MaxDirectionChange) result.MaxDirectionChange = degrees;
    }
    result.Score = result.Coverage * 1000.0 - result.LengthCv * 100.0 - result.MaxDirectionChange * 0.25;
    return result;
  }

  private static bool WidestSection(Brep brep, Mesh mesh, Plane plane, Vector3d direction, double tol, out Line widest)
  {
    widest = Line.Unset;
    double bestWidth = -1.0;
    if (brep != null)
    {
      Curve[] curves;
      Point3d[] points;
      if (!Intersection.BrepPlane(brep, plane, tol, out curves, out points) || curves == null) return false;
      foreach (Curve curve in curves)
      {
        Point3d[] samples;
        curve.DivideByCount(128, true, out samples);
        if (samples == null || samples.Length < 2) samples = new[] { curve.PointAtStart, curve.PointAtEnd };
        Line candidate;
        double width;
        if (Envelope(samples, direction, out candidate, out width) && width > bestWidth)
        {
          bestWidth = width;
          widest = candidate;
        }
      }
    }
    else
    {
      Polyline[] polylines = Intersection.MeshPlane(mesh, plane);
      if (polylines == null) return false;
      foreach (Polyline polyline in polylines)
      {
        Line candidate;
        double width;
        if (Envelope(polyline, direction, out candidate, out width) && width > bestWidth)
        {
          bestWidth = width;
          widest = candidate;
        }
      }
    }
    return bestWidth > tol && widest.IsValid;
  }

  private static bool Envelope(IEnumerable<Point3d> points, Vector3d direction, out Line line, out double width)
  {
    line = Line.Unset;
    width = 0.0;
    bool any = false;
    double min = double.PositiveInfinity;
    double max = double.NegativeInfinity;
    Point3d minPoint = Point3d.Unset;
    Point3d maxPoint = Point3d.Unset;
    foreach (Point3d point in points)
    {
      if (!point.IsValid) continue;
      double projection = point.X * direction.X + point.Y * direction.Y + point.Z * direction.Z;
      if (projection < min) { min = projection; minPoint = point; }
      if (projection > max) { max = projection; maxPoint = point; }
      any = true;
    }
    if (!any || !minPoint.IsValid || !maxPoint.IsValid) return false;
    width = max - min;
    line = new Line(minPoint, maxPoint);
    return line.IsValid;
  }

  private static string ScoreText(Candidate candidate)
  {
    return string.Format("{0,6:0.###} deg | score {1,9:0.###} | coverage {2:P0} | CV {3:0.####} | max dAngle {4:0.###}",
      candidate.AngleDegrees, candidate.Score, candidate.Coverage, candidate.LengthCv, candidate.MaxDirectionChange);
  }

  private static bool UnwrapGeometry(object value, out Brep brep, out Mesh mesh)
  {
    brep = null;
    mesh = null;
    if (value is Brep) brep = ((Brep)value).DuplicateBrep();
    else if (value is Surface) brep = ((Surface)value).ToBrep();
    else if (value is Extrusion) brep = ((Extrusion)value).ToBrep();
    else if (value is SubD) brep = ((SubD)value).ToBrep();
    else if (value is Mesh) mesh = ((Mesh)value).DuplicateMesh();
    else if (value is GH_ObjectWrapper) return UnwrapGeometry(((GH_ObjectWrapper)value).Value, out brep, out mesh);
    else if (value is GH_Brep) brep = ((GH_Brep)value).Value.DuplicateBrep();
    else if (value is GH_Surface) brep = ((GH_Surface)value).Value.DuplicateBrep();
    else if (value is GH_Mesh) mesh = ((GH_Mesh)value).Value.DuplicateMesh();
    return brep != null || mesh != null;
  }

  private static Vector3d UnwrapVector(object value, Vector3d fallback)
  {
    if (value is Vector3d) return (Vector3d)value;
    if (value is GH_Vector) return ((GH_Vector)value).Value;
    var wrapper = value as GH_ObjectWrapper;
    return wrapper == null ? fallback : UnwrapVector(wrapper.Value, fallback);
  }

  private static bool AsBool(object value, bool fallback)
  {
    try
    {
      if (value is GH_Boolean) return ((GH_Boolean)value).Value;
      if (value is GH_ObjectWrapper) value = ((GH_ObjectWrapper)value).Value;
      return value == null ? fallback : Convert.ToBoolean(value);
    }
    catch { return fallback; }
  }

  private static int AsInt(object value, int fallback)
  {
    try
    {
      if (value is GH_Integer) return ((GH_Integer)value).Value;
      if (value is GH_ObjectWrapper) value = ((GH_ObjectWrapper)value).Value;
      return value == null ? fallback : Convert.ToInt32(value);
    }
    catch { return fallback; }
  }

  private static double AsDouble(object value, double fallback)
  {
    try
    {
      if (value is GH_Number) return ((GH_Number)value).Value;
      if (value is GH_ObjectWrapper) value = ((GH_ObjectWrapper)value).Value;
      return value == null ? fallback : Convert.ToDouble(value);
    }
    catch { return fallback; }
  }

  private static void ProjectionRange(BoundingBox box, Vector3d direction, out double min, out double max)
  {
    min = double.PositiveInfinity;
    max = double.NegativeInfinity;
    foreach (Point3d corner in box.GetCorners())
    {
      double projection = corner.X * direction.X + corner.Y * direction.Y + corner.Z * direction.Z;
      min = Math.Min(min, projection);
      max = Math.Max(max, projection);
    }
  }

  private static Curve SmoothCurve(IList<Point3d> points)
  {
    if (points.Count == 2) return new LineCurve(points[0], points[1]);
    return Curve.CreateInterpolatedCurve(points, Math.Min(3, points.Count - 1), CurveKnotStyle.Chord) ?? new PolylineCurve(points);
  }

  private static List<Plane> BuildPlanes(IList<Line> lines, IList<Point3d> mids)
  {
    var planes = new List<Plane>(lines.Count);
    Vector3d previousZ = Vector3d.Unset;
    for (int i = 0; i < lines.Count; i++)
    {
      Vector3d x = lines[i].Direction;
      x.Unitize();
      Vector3d travel = i == 0 ? mids[1] - mids[0] : (i == mids.Count - 1 ? mids[i] - mids[i - 1] : mids[i + 1] - mids[i - 1]);
      Vector3d y = travel - x * (travel * x);
      if (!y.Unitize()) y = Perpendicular(x);
      Vector3d z = Vector3d.CrossProduct(x, y);
      z.Unitize();
      y = Vector3d.CrossProduct(z, x);
      y.Unitize();
      if (i > 0 && previousZ.IsValid && z * previousZ < 0.0) y = -y;
      Plane plane = new Plane(mids[i], x, y);
      planes.Add(plane);
      previousZ = plane.ZAxis;
    }
    return planes;
  }

  private static Vector3d Perpendicular(Vector3d normal)
  {
    Vector3d axis = Math.Abs(normal * Vector3d.XAxis) < 0.8 ? Vector3d.XAxis : Vector3d.YAxis;
    axis -= normal * (axis * normal);
    axis.Unitize();
    return axis;
  }

  private static object StraightLoft(Curve railA, Curve railB)
  {
    Brep[] lofts = Brep.CreateFromLoft(new[] { railA, railB }, Point3d.Unset, Point3d.Unset, LoftType.Straight, false);
    if (lofts == null || lofts.Length == 0) return null;
    return lofts.Length == 1 ? (object)lofts[0] : lofts.ToList();
  }
}
# ---------- end hw_04_multi_angle_envelope ----------
hw_03_centerline_width_twist = HOTWIRE03CENTERLINEWIDTHTWIST(
    Path=path,
    ReferencePlane=referenceplane,
    WidthStart=widthstart,
    WidthEnd=widthend,
    TwistDegrees=twistdegrees,
    Count=count_3,
    Extension=extension_3,
    Flip=flip_3)  # -> out, Planes, WireLines, Ruled, RailA, RailB, MidPath, Widths, Report
# ---------- hw_03_centerline_width_twist: C# ----------
// #! csharp
// Hot-wire Algorithm 03: centerline, width, and twist sweep.
// Converts one spatial guide curve into a programmable ruled ribbon and
// center-TCP planes without needing an input surface.

using System;
using System.Collections.Generic;
using System.Linq;
using Grasshopper;
using Grasshopper.Kernel;
using Grasshopper.Kernel.Types;
using Rhino.Geometry;

public class Script_Instance : GH_ScriptInstance
{
  private void RunScript(
		object Path,
		object ReferencePlane,
		object WidthStart,
		object WidthEnd,
		object TwistDegrees,
		object Count,
		object Extension,
		object Flip,
		ref object Planes,
		ref object WireLines,
		ref object Ruled,
		ref object RailA,
		ref object RailB,
		ref object MidPath,
		ref object Widths,
		ref object Report)
  {
    Curve path = UnwrapCurve(Path);
    if (path == null || !path.IsValid || path.GetLength() <= 1e-9)
    {
      Report = "ERROR: Path must be a valid non-zero Curve.";
      return;
    }

    Plane reference = UnwrapPlane(ReferencePlane, Plane.WorldXY);
    double widthStart = Math.Max(1e-6, AsDouble(WidthStart, 120.0));
    double widthEnd = Math.Max(1e-6, AsDouble(WidthEnd, widthStart));
    double twistDegrees = AsDouble(TwistDegrees, 0.0);
    int count = Math.Max(2, Math.Min(2000, AsInt(Count, 41)));
    double extension = Math.Max(0.0, AsDouble(Extension, 0.0));
    bool flip = AsBool(Flip, false);

    var sideA = new List<Point3d>(count);
    var sideB = new List<Point3d>(count);
    var widths = new List<double>(count);
    var stations = new List<Point3d>(count);
    Vector3d previousBase = Vector3d.Unset;

    for (int i = 0; i < count; i++)
    {
      double t = (double)i / (count - 1);
      double parameter;
      if (!path.NormalizedLengthParameter(t, out parameter)) parameter = path.Domain.ParameterAt(t);
      Point3d center = path.PointAt(parameter);
      Vector3d tangent = path.TangentAt(parameter);
      if (!tangent.Unitize()) continue;

      Plane frame;
      Vector3d lateral;
      if (path.PerpendicularFrameAt(parameter, out frame))
      {
        lateral = frame.XAxis;
        Vector3d target = reference.XAxis - tangent * (reference.XAxis * tangent);
        if (!target.Unitize()) target = reference.YAxis - tangent * (reference.YAxis * tangent);
        if (i == 0 && target.Unitize() && lateral * target < 0.0) lateral = -lateral;
      }
      else
      {
        lateral = reference.XAxis - tangent * (reference.XAxis * tangent);
        if (!lateral.Unitize()) lateral = Perpendicular(tangent);
      }

      lateral -= tangent * (lateral * tangent);
      if (!lateral.Unitize()) lateral = Perpendicular(tangent);
      if (previousBase.IsValid && lateral * previousBase < 0.0) lateral = -lateral;
      previousBase = lateral;

      lateral.Rotate(Rhino.RhinoMath.ToRadians(twistDegrees * t), tangent);
      lateral.Unitize();
      double width = widthStart + (widthEnd - widthStart) * t;
      Point3d a = center - lateral * (0.5 * width + extension);
      Point3d b = center + lateral * (0.5 * width + extension);
      if (flip) { Point3d swap = a; a = b; b = swap; }

      sideA.Add(a);
      sideB.Add(b);
      stations.Add(center);
      widths.Add(width + 2.0 * extension);
    }

    if (sideA.Count < 2)
    {
      Report = "ERROR: Centerline sampling did not produce at least two valid stations.";
      return;
    }

    List<Line> lines = sideA.Zip(sideB, (a, b) => new Line(a, b)).ToList();
    Curve railA = SmoothCurve(sideA);
    Curve railB = SmoothCurve(sideB);
    Curve midPath = SmoothCurve(stations);
    List<Plane> planes = BuildPlanes(lines, stations);

    Planes = planes;
    WireLines = lines;
    Ruled = StraightLoft(railA, railB);
    RailA = railA;
    RailB = railB;
    MidPath = midPath;
    Widths = widths;
    Report = string.Join(System.Environment.NewLine, new[]
    {
      "HOTWIRE 03 - CENTERLINE WIDTH/TWIST",
      "Wire positions: " + lines.Count,
      string.Format("Programmed width: {0:0.###} to {1:0.###}; total twist: {2:0.###} degrees", widthStart, widthEnd, twistDegrees),
      "Plane convention: Origin=wire midpoint, X=wire A->B, Y=travel, Z=X cross Y.",
      "ReferencePlane seeds the transported lateral direction; Flip reverses wire X.",
      "Ruled is the exact ribbon implied by the generated finite wire segments.",
      "No IK, collision, kerf, feed, or controller validation is performed."
    });
  }

  private static Curve UnwrapCurve(object value)
  {
    if (value is Curve) return ((Curve)value).DuplicateCurve();
    var wrapper = value as GH_ObjectWrapper;
    if (wrapper != null) return UnwrapCurve(wrapper.Value);
    var goo = value as GH_Curve;
    if (goo != null) return UnwrapCurve(goo.Value);
    return null;
  }

  private static Plane UnwrapPlane(object value, Plane fallback)
  {
    if (value is Plane) return (Plane)value;
    if (value is GH_Plane) return ((GH_Plane)value).Value;
    var wrapper = value as GH_ObjectWrapper;
    return wrapper == null ? fallback : UnwrapPlane(wrapper.Value, fallback);
  }

  private static bool AsBool(object value, bool fallback)
  {
    try
    {
      if (value is GH_Boolean) return ((GH_Boolean)value).Value;
      if (value is GH_ObjectWrapper) value = ((GH_ObjectWrapper)value).Value;
      return value == null ? fallback : Convert.ToBoolean(value);
    }
    catch { return fallback; }
  }

  private static int AsInt(object value, int fallback)
  {
    try
    {
      if (value is GH_Integer) return ((GH_Integer)value).Value;
      if (value is GH_ObjectWrapper) value = ((GH_ObjectWrapper)value).Value;
      return value == null ? fallback : Convert.ToInt32(value);
    }
    catch { return fallback; }
  }

  private static double AsDouble(object value, double fallback)
  {
    try
    {
      if (value is GH_Number) return ((GH_Number)value).Value;
      if (value is GH_ObjectWrapper) value = ((GH_ObjectWrapper)value).Value;
      return value == null ? fallback : Convert.ToDouble(value);
    }
    catch { return fallback; }
  }

  private static Curve SmoothCurve(IList<Point3d> points)
  {
    if (points.Count == 2) return new LineCurve(points[0], points[1]);
    return Curve.CreateInterpolatedCurve(points, Math.Min(3, points.Count - 1), CurveKnotStyle.Chord) ?? new PolylineCurve(points);
  }

  private static List<Plane> BuildPlanes(IList<Line> lines, IList<Point3d> mids)
  {
    var planes = new List<Plane>(lines.Count);
    Vector3d previousZ = Vector3d.Unset;
    for (int i = 0; i < lines.Count; i++)
    {
      Vector3d x = lines[i].Direction;
      x.Unitize();
      Vector3d travel = i == 0 ? mids[1] - mids[0] : (i == mids.Count - 1 ? mids[i] - mids[i - 1] : mids[i + 1] - mids[i - 1]);
      Vector3d y = travel - x * (travel * x);
      if (!y.Unitize()) y = Perpendicular(x);
      Vector3d z = Vector3d.CrossProduct(x, y);
      z.Unitize();
      y = Vector3d.CrossProduct(z, x);
      y.Unitize();
      if (i > 0 && previousZ.IsValid && z * previousZ < 0.0) y = -y;
      Plane plane = new Plane(mids[i], x, y);
      planes.Add(plane);
      previousZ = plane.ZAxis;
    }
    return planes;
  }

  private static Vector3d Perpendicular(Vector3d normal)
  {
    Vector3d axis = Math.Abs(normal * Vector3d.XAxis) < 0.8 ? Vector3d.XAxis : Vector3d.YAxis;
    axis -= normal * (axis * normal);
    axis.Unitize();
    return axis;
  }

  private static object StraightLoft(Curve railA, Curve railB)
  {
    Brep[] lofts = Brep.CreateFromLoft(new[] { railA, railB }, Point3d.Unset, Point3d.Unset, LoftType.Straight, false);
    if (lofts == null || lofts.Length == 0) return null;
    return lofts.Length == 1 ? (object)lofts[0] : lofts.ToList();
  }
}
# ---------- end hw_03_centerline_width_twist ----------
hw_01_surface_uv = HOTWIRE01SURFACEUV(S=S, WireAcrossU=wireacrossu, Count=count, Extension=extension, Flip=flip, Tolerance=tolerance)  # -> out, Planes, WireLines, Ruled, RailA, RailB, MidPath, Deviation, Report
# ---------- hw_01_surface_uv: C# ----------
// #! csharp
// Hot-wire Algorithm 01: Surface UV sampling.
// Samples opposite sides of one surface, then outputs finite wire positions,
// center-TCP planes, synchronized rails, a midpoint path, and a ruled loft.

using System;
using System.Collections.Generic;
using System.Linq;
using Grasshopper;
using Grasshopper.Kernel;
using Grasshopper.Kernel.Types;
using Rhino;
using Rhino.Geometry;

public class Script_Instance : GH_ScriptInstance
{
  private void RunScript(
		object S,
		object WireAcrossU,
		object Count,
		object Extension,
		object Flip,
		object Tolerance,
		ref object Planes,
		ref object WireLines,
		ref object Ruled,
		ref object RailA,
		ref object RailB,
		ref object MidPath,
		ref object Deviation,
		ref object Report)
  {
    Surface surface = UnwrapSurface(S);
    if (surface == null)
    {
      Report = "ERROR: S must be a Surface or Brep with at least one face.";
      return;
    }

    bool acrossU = AsBool(WireAcrossU, true);
    int count = Math.Max(2, Math.Min(2000, AsInt(Count, 41)));
    double extension = Math.Max(0.0, AsDouble(Extension, 0.0));
    bool flip = AsBool(Flip, false);
    double tol = AsDouble(Tolerance, 0.0);
    if (tol <= 0.0) tol = RhinoDoc.ActiveDoc == null ? 0.01 : RhinoDoc.ActiveDoc.ModelAbsoluteTolerance;

    Interval uDomain = surface.Domain(0);
    Interval vDomain = surface.Domain(1);
    var sideA = new List<Point3d>(count);
    var sideB = new List<Point3d>(count);

    for (int i = 0; i < count; i++)
    {
      double t = (double)i / (count - 1);
      Point3d a;
      Point3d b;
      if (acrossU)
      {
        double v = vDomain.ParameterAt(t);
        a = surface.PointAt(uDomain.Min, v);
        b = surface.PointAt(uDomain.Max, v);
      }
      else
      {
        double u = uDomain.ParameterAt(t);
        a = surface.PointAt(u, vDomain.Min);
        b = surface.PointAt(u, vDomain.Max);
      }
      AddPair(a, b, extension, flip, tol, sideA, sideB);
    }

    if (sideA.Count < 2)
    {
      Report = "ERROR: Surface sampling did not produce at least two valid wire positions.";
      return;
    }

    List<Line> lines = sideA.Zip(sideB, (a, b) => new Line(a, b)).ToList();
    List<Point3d> mids = lines.Select(line => line.PointAt(0.5)).ToList();
    Curve railA = SmoothCurve(sideA);
    Curve railB = SmoothCurve(sideB);
    Curve midPath = SmoothCurve(mids);
    List<Plane> planes = BuildPlanes(lines, mids);
    object ruled = StraightLoft(railA, railB);

    var deviations = new List<double>();
    foreach (Line line in lines)
    {
      for (int j = 0; j <= 8; j++)
      {
        Point3d point = line.PointAt((double)j / 8.0);
        double u;
        double v;
        if (surface.ClosestPoint(point, out u, out v))
          deviations.Add(point.DistanceTo(surface.PointAt(u, v)));
      }
    }
    double maxDeviation = deviations.Count == 0 ? double.NaN : deviations.Max();
    double meanDeviation = deviations.Count == 0 ? double.NaN : deviations.Average();

    Planes = planes;
    WireLines = lines;
    Ruled = ruled;
    RailA = railA;
    RailB = railB;
    MidPath = midPath;
    Deviation = maxDeviation;
    Report = string.Join(System.Environment.NewLine, new[]
    {
      "HOTWIRE 01 - SURFACE UV",
      "Wire direction: " + (acrossU ? "across U; advancing in V" : "across V; advancing in U"),
      "Wire positions: " + lines.Count,
      string.Format("Maximum ruled approximation deviation: {0:0.###} model units", maxDeviation),
      string.Format("Mean ruled approximation deviation: {0:0.###} model units", meanDeviation),
      "Plane convention: Origin=wire midpoint, X=wire A->B, Y=travel, Z=X cross Y.",
      "Trim boundaries and holes are ignored because the underlying surface UV domain is sampled.",
      "A non-ruled input surface is approximated; inspect Deviation before fabrication.",
      "No IK, collision, kerf, feed, or controller validation is performed."
    });
  }

  private static Surface UnwrapSurface(object value)
  {
    if (value is Surface) return (Surface)((Surface)value).Duplicate();
    if (value is Brep)
    {
      Brep brep = (Brep)value;
      if (brep.Faces.Count == 0) return null;
      BrepFace face = brep.Faces.OrderByDescending(f =>
      {
        AreaMassProperties amp = AreaMassProperties.Compute(f);
        return amp == null ? 0.0 : amp.Area;
      }).First();
      return face.DuplicateSurface();
    }
    var wrapper = value as GH_ObjectWrapper;
    if (wrapper != null) return UnwrapSurface(wrapper.Value);
    var surfaceGoo = value as GH_Surface;
    if (surfaceGoo != null) return UnwrapSurface(surfaceGoo.Value);
    var brepGoo = value as GH_Brep;
    if (brepGoo != null) return UnwrapSurface(brepGoo.Value);
    return null;
  }

  private static bool AsBool(object value, bool fallback)
  {
    try
    {
      if (value is GH_Boolean) return ((GH_Boolean)value).Value;
      if (value is GH_ObjectWrapper) value = ((GH_ObjectWrapper)value).Value;
      return value == null ? fallback : Convert.ToBoolean(value);
    }
    catch { return fallback; }
  }

  private static int AsInt(object value, int fallback)
  {
    try
    {
      if (value is GH_Integer) return ((GH_Integer)value).Value;
      if (value is GH_ObjectWrapper) value = ((GH_ObjectWrapper)value).Value;
      return value == null ? fallback : Convert.ToInt32(value);
    }
    catch { return fallback; }
  }

  private static double AsDouble(object value, double fallback)
  {
    try
    {
      if (value is GH_Number) return ((GH_Number)value).Value;
      if (value is GH_ObjectWrapper) value = ((GH_ObjectWrapper)value).Value;
      return value == null ? fallback : Convert.ToDouble(value);
    }
    catch { return fallback; }
  }

  private static void AddPair(Point3d a, Point3d b, double extension, bool flip, double tol, List<Point3d> sideA, List<Point3d> sideB)
  {
    Vector3d axis = b - a;
    if (a.DistanceTo(b) <= tol || !axis.Unitize()) return;
    a -= axis * extension;
    b += axis * extension;
    if (flip) { Point3d swap = a; a = b; b = swap; }
    sideA.Add(a);
    sideB.Add(b);
  }

  private static Curve SmoothCurve(IList<Point3d> points)
  {
    if (points.Count == 2) return new LineCurve(points[0], points[1]);
    return Curve.CreateInterpolatedCurve(points, Math.Min(3, points.Count - 1), CurveKnotStyle.Chord) ?? new PolylineCurve(points);
  }

  private static List<Plane> BuildPlanes(IList<Line> lines, IList<Point3d> mids)
  {
    var planes = new List<Plane>(lines.Count);
    Vector3d previousZ = Vector3d.Unset;
    for (int i = 0; i < lines.Count; i++)
    {
      Vector3d x = lines[i].Direction;
      x.Unitize();
      Vector3d travel = i == 0 ? mids[1] - mids[0] : (i == mids.Count - 1 ? mids[i] - mids[i - 1] : mids[i + 1] - mids[i - 1]);
      Vector3d y = travel - x * (travel * x);
      if (!y.Unitize()) y = Perpendicular(x);
      Vector3d z = Vector3d.CrossProduct(x, y);
      z.Unitize();
      y = Vector3d.CrossProduct(z, x);
      y.Unitize();
      if (i > 0 && previousZ.IsValid && z * previousZ < 0.0) y = -y;
      Plane plane = new Plane(mids[i], x, y);
      planes.Add(plane);
      previousZ = plane.ZAxis;
    }
    return planes;
  }

  private static Vector3d Perpendicular(Vector3d normal)
  {
    Vector3d axis = Math.Abs(normal * Vector3d.XAxis) < 0.8 ? Vector3d.XAxis : Vector3d.YAxis;
    axis -= normal * (axis * normal);
    axis.Unitize();
    return axis;
  }

  private static object StraightLoft(Curve railA, Curve railB)
  {
    Brep[] lofts = Brep.CreateFromLoft(new[] { railA, railB }, Point3d.Unset, Point3d.Unset, LoftType.Straight, false);
    if (lofts == null || lofts.Length == 0) return null;
    return lofts.Length == 1 ? (object)lofts[0] : lofts.ToList();
  }
}
# ---------- end hw_01_surface_uv ----------
hw_02_auto_boundary_pair = HOTWIRE02AUTOBOUNDARYPAIR(G=G, PreferLong=preferlong, Count=count_2, Extension=extension_2, Flip=flip_2, Tolerance=tolerance_2)  # -> out, Planes, WireLines, Ruled, RailA, RailB, MidPath, PairScores, Report
# ---------- hw_02_auto_boundary_pair: C# ----------
// #! csharp
// Hot-wire Algorithm 02: automatic opposite-boundary pairing.
// Finds the two possible opposite-edge pairs on a four-sided open surface,
// selects the shorter or longer synchronized span, and builds hot-wire poses.

using System;
using System.Collections.Generic;
using System.Linq;
using Grasshopper;
using Grasshopper.Kernel;
using Grasshopper.Kernel.Types;
using Rhino;
using Rhino.Geometry;

public class Script_Instance : GH_ScriptInstance
{
  private void RunScript(
		object G,
		object PreferLong,
		object Count,
		object Extension,
		object Flip,
		object Tolerance,
		ref object Planes,
		ref object WireLines,
		ref object Ruled,
		ref object RailA,
		ref object RailB,
		ref object MidPath,
		ref object PairScores,
		ref object Report)
  {
    Brep brep = UnwrapBrep(G);
    if (brep == null)
    {
      Report = "ERROR: G must be a Surface or open Brep.";
      return;
    }

    bool preferLong = AsBool(PreferLong, false);
    int count = Math.Max(2, Math.Min(2000, AsInt(Count, 41)));
    double extension = Math.Max(0.0, AsDouble(Extension, 0.0));
    bool flip = AsBool(Flip, false);
    double tol = AsDouble(Tolerance, 0.0);
    if (tol <= 0.0) tol = RhinoDoc.ActiveDoc == null ? 0.01 : RhinoDoc.ActiveDoc.ModelAbsoluteTolerance;

    Curve[] raw = brep.DuplicateNakedEdgeCurves(true, false);
    if (raw == null || raw.Length != 4)
    {
      Report = "ERROR: This algorithm requires exactly four unjoined naked boundary edges. Found " + (raw == null ? 0 : raw.Length) + ".";
      return;
    }

    var candidates = new List<PairCandidate>();
    for (int i = 0; i < raw.Length; i++)
    {
      for (int j = i + 1; j < raw.Length; j++)
      {
        if (!ShareEndpoint(raw[i], raw[j], tol))
          candidates.Add(EvaluatePair(raw[i], raw[j], i, j, count));
      }
    }

    if (candidates.Count != 2 || candidates.Any(c => !c.Valid))
    {
      Report = "ERROR: The four naked edges could not be resolved into two valid opposite pairs.";
      return;
    }

    PairCandidate chosen = preferLong
      ? candidates.OrderByDescending(c => c.MeanSpan).First()
      : candidates.OrderBy(c => c.MeanSpan).First();

    var sideA = new List<Point3d>(count);
    var sideB = new List<Point3d>(count);
    for (int i = 0; i < count; i++)
    {
      double t = (double)i / (count - 1);
      Point3d a = chosen.A.PointAtNormalizedLength(t);
      Point3d b = chosen.B.PointAtNormalizedLength(t);
      AddPair(a, b, extension, flip, tol, sideA, sideB);
    }

    if (sideA.Count < 2)
    {
      Report = "ERROR: The selected boundary pair did not produce at least two valid wire positions.";
      return;
    }

    List<Line> lines = sideA.Zip(sideB, (a, b) => new Line(a, b)).ToList();
    List<Point3d> mids = lines.Select(line => line.PointAt(0.5)).ToList();
    Curve railA = SmoothCurve(sideA);
    Curve railB = SmoothCurve(sideB);
    Curve midPath = SmoothCurve(mids);
    List<Plane> planes = BuildPlanes(lines, mids);

    Planes = planes;
    WireLines = lines;
    Ruled = StraightLoft(railA, railB);
    RailA = railA;
    RailB = railB;
    MidPath = midPath;
    PairScores = candidates.Select(c => string.Format("Edges {0}-{1}: mean span {2:0.###}", c.IndexA, c.IndexB, c.MeanSpan)).ToList();
    Report = string.Join(System.Environment.NewLine, new[]
    {
      "HOTWIRE 02 - AUTOMATIC OPPOSITE BOUNDARIES",
      "Selection rule: " + (preferLong ? "longer opposite pair" : "shorter opposite pair"),
      string.Format("Selected naked edges: {0} and {1}; mean span {2:0.###}", chosen.IndexA, chosen.IndexB, chosen.MeanSpan),
      "Wire positions: " + lines.Count,
      "Plane convention: Origin=wire midpoint, X=wire A->B, Y=travel, Z=X cross Y.",
      "Scope: a single four-sided open surface/Brep with exactly four naked edges.",
      "PairScores exposes both possible synchronized boundary pairings.",
      "No IK, collision, kerf, feed, or controller validation is performed."
    });
  }

  private class PairCandidate
  {
    public Curve A;
    public Curve B;
    public int IndexA;
    public int IndexB;
    public double MeanSpan;
    public bool Valid;
  }

  private static PairCandidate EvaluatePair(Curve sourceA, Curve sourceB, int indexA, int indexB, int sampleCount)
  {
    Curve a = sourceA.DuplicateCurve();
    Curve b = sourceB.DuplicateCurve();
    double same = a.PointAtStart.DistanceTo(b.PointAtStart) + a.PointAtEnd.DistanceTo(b.PointAtEnd);
    double reversed = a.PointAtStart.DistanceTo(b.PointAtEnd) + a.PointAtEnd.DistanceTo(b.PointAtStart);
    if (reversed < same) b.Reverse();

    var spans = new List<double>();
    for (int i = 0; i < sampleCount; i++)
    {
      double t = (double)i / (sampleCount - 1);
      Point3d pa = a.PointAtNormalizedLength(t);
      Point3d pb = b.PointAtNormalizedLength(t);
      if (pa.IsValid && pb.IsValid) spans.Add(pa.DistanceTo(pb));
    }
    return new PairCandidate
    {
      A = a,
      B = b,
      IndexA = indexA,
      IndexB = indexB,
      MeanSpan = spans.Count == 0 ? double.PositiveInfinity : spans.Average(),
      Valid = spans.Count == sampleCount
    };
  }

  private static bool ShareEndpoint(Curve a, Curve b, double tol)
  {
    return a.PointAtStart.DistanceTo(b.PointAtStart) <= tol ||
      a.PointAtStart.DistanceTo(b.PointAtEnd) <= tol ||
      a.PointAtEnd.DistanceTo(b.PointAtStart) <= tol ||
      a.PointAtEnd.DistanceTo(b.PointAtEnd) <= tol;
  }

  private static Brep UnwrapBrep(object value)
  {
    if (value is Brep) return ((Brep)value).DuplicateBrep();
    if (value is Surface) return ((Surface)value).ToBrep();
    if (value is BrepFace) return ((BrepFace)value).DuplicateFace(false);
    var wrapper = value as GH_ObjectWrapper;
    if (wrapper != null) return UnwrapBrep(wrapper.Value);
    var surfaceGoo = value as GH_Surface;
    if (surfaceGoo != null) return UnwrapBrep(surfaceGoo.Value);
    var brepGoo = value as GH_Brep;
    if (brepGoo != null) return UnwrapBrep(brepGoo.Value);
    return null;
  }

  private static bool AsBool(object value, bool fallback)
  {
    try
    {
      if (value is GH_Boolean) return ((GH_Boolean)value).Value;
      if (value is GH_ObjectWrapper) value = ((GH_ObjectWrapper)value).Value;
      return value == null ? fallback : Convert.ToBoolean(value);
    }
    catch { return fallback; }
  }

  private static int AsInt(object value, int fallback)
  {
    try
    {
      if (value is GH_Integer) return ((GH_Integer)value).Value;
      if (value is GH_ObjectWrapper) value = ((GH_ObjectWrapper)value).Value;
      return value == null ? fallback : Convert.ToInt32(value);
    }
    catch { return fallback; }
  }

  private static double AsDouble(object value, double fallback)
  {
    try
    {
      if (value is GH_Number) return ((GH_Number)value).Value;
      if (value is GH_ObjectWrapper) value = ((GH_ObjectWrapper)value).Value;
      return value == null ? fallback : Convert.ToDouble(value);
    }
    catch { return fallback; }
  }

  private static void AddPair(Point3d a, Point3d b, double extension, bool flip, double tol, List<Point3d> sideA, List<Point3d> sideB)
  {
    Vector3d axis = b - a;
    if (a.DistanceTo(b) <= tol || !axis.Unitize()) return;
    a -= axis * extension;
    b += axis * extension;
    if (flip) { Point3d swap = a; a = b; b = swap; }
    sideA.Add(a);
    sideB.Add(b);
  }

  private static Curve SmoothCurve(IList<Point3d> points)
  {
    if (points.Count == 2) return new LineCurve(points[0], points[1]);
    return Curve.CreateInterpolatedCurve(points, Math.Min(3, points.Count - 1), CurveKnotStyle.Chord) ?? new PolylineCurve(points);
  }

  private static List<Plane> BuildPlanes(IList<Line> lines, IList<Point3d> mids)
  {
    var planes = new List<Plane>(lines.Count);
    Vector3d previousZ = Vector3d.Unset;
    for (int i = 0; i < lines.Count; i++)
    {
      Vector3d x = lines[i].Direction;
      x.Unitize();
      Vector3d travel = i == 0 ? mids[1] - mids[0] : (i == mids.Count - 1 ? mids[i] - mids[i - 1] : mids[i + 1] - mids[i - 1]);
      Vector3d y = travel - x * (travel * x);
      if (!y.Unitize()) y = Perpendicular(x);
      Vector3d z = Vector3d.CrossProduct(x, y);
      z.Unitize();
      y = Vector3d.CrossProduct(z, x);
      y.Unitize();
      if (i > 0 && previousZ.IsValid && z * previousZ < 0.0) y = -y;
      Plane plane = new Plane(mids[i], x, y);
      planes.Add(plane);
      previousZ = plane.ZAxis;
    }
    return planes;
  }

  private static Vector3d Perpendicular(Vector3d normal)
  {
    Vector3d axis = Math.Abs(normal * Vector3d.XAxis) < 0.8 ? Vector3d.XAxis : Vector3d.YAxis;
    axis -= normal * (axis * normal);
    axis.Unitize();
    return axis;
  }

  private static object StraightLoft(Curve railA, Curve railB)
  {
    Brep[] lofts = Brep.CreateFromLoft(new[] { railA, railB }, Point3d.Unset, Point3d.Unset, LoftType.Straight, false);
    if (lofts == null || lofts.Length == 0) return null;
    return lofts.Length == 1 ? (object)lofts[0] : lofts.ToList();
  }
}
# ---------- end hw_02_auto_boundary_pair ----------
planes_kuka_prc = PlanesKUKAPrc(hw_01_surface_uv.Planes)
planes_kuka_prc_2 = PlanesKUKAPrc(hw_02_auto_boundary_pair.Planes)
planes_kuka_prc_3 = PlanesKUKAPrc(hw_03_centerline_width_twist.Planes)
planes_kuka_prc_4 = PlanesKUKAPrc(hw_04_multi_angle_envelope.Planes)
ruled_preview = RuledPreview(hw_01_surface_uv.Ruled)
ruled_preview_2 = RuledPreview(hw_02_auto_boundary_pair.Ruled)
ruled_preview_3 = RuledPreview(hw_03_centerline_width_twist.Ruled)
ruled_preview_4 = RuledPreview(hw_04_multi_angle_envelope.Ruled)
# KUKA HANDOFF: KUKA|prc HANDOFF
# Use one branch at a time.
# Connect its plane collector to the required native KUKA|prc motion component.
# Set the real robot, calibrated base, calibrated hot-wire TCP, speed, and motion type before simulation.
report = Panel(hw_01_surface_uv.Report)
report_2 = Panel(hw_02_auto_boundary_pair.Report)
report_3 = Panel(hw_03_centerline_width_twist.Report)
report_4 = Panel(hw_04_multi_angle_envelope.Report)
