# Grasshopper definition FL01_mesh_to_planes.gh (Grasshopper 1.0.8)
# plug-ins: KUKA|prc - parametric robot control

geo = Mesh(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)
# note: axisMode  0 long · 1 short · 2 X · 3 Y · 4 Z · 5 custom
# Leave it on 0. Modes 2-4 lock the job to the world and the component warns when you use them.
# 
# loopMode    0 largest loop only · 1 every loop
# normalMode  0 mesh normal · 1 radial from the slice centre
# note: rollMode  0 rigid · 1 free spin
# A hot wire is a rigid bow and cares which way the wrist is rolled. A pen or a router bit is round and does not - free spin lets the solver take the gentler wrist path.
# note: selfTest - THE ORIENTATION PROOF
# 
# Turn it on. The component rotates the whole part eight times by random rotations, re-runs everything, rotates the answers back and measures the difference. You want RESULT: PASS.
# 
# Turn it back off afterwards - it costs eight extra solves.
part_x = Slider(1273, range=-1600..1600)
part_y = Slider(-20, range=-1600..1600)
part_z = Slider(302, range=-600..1400)
pt = ConstructPoint(XCoordinate=part_x, YCoordinate=part_y, ZCoordinate=part_z)
move = Move(Geometry=geo, Motion=pt)  # -> Geometry, Transform
axismode = Slider(0, range=0..5)
sections = Slider(12, range=2..100)
samples = Slider(64, range=6..200)
loopmode = Slider(0, range=0..1)
normalmode = Slider(0, range=0..1)
flipapproach = BooleanToggle(False)
tiltdeg = Slider(0, range=-45..45)
rollmode = Slider(0, range=0..1)
leadlen = Slider(0, range=0..100)
minspacing = Slider(0, range=0..20)
maxturndeg = Slider(30, range=5..90)
selftest = BooleanToggle(False)
c_script = CSharpScript(
    geo=move.Geometry,
    axisMode=axismode,
    sections=sections,
    samples=samples,
    loopMode=loopmode,
    normalMode=normalmode,
    flipApproach=flipapproach,
    tiltDeg=tiltdeg,
    rollMode=rollmode,
    leadLen=leadlen,
    minSpacing=minspacing,
    maxTurnDeg=maxturndeg,
    selfTest=selftest)  # -> out, Planes, Points, MoveTypes, Sections, SlicePlanes, PartFrame, SliceAxis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; "FL-01"; inputs geo: Mesh, axisMode: Int32, customAxis: Vector3d, sections: Int32, samples: Int32, loopMode: Int32, normalMode: Int32, flipApproach: Boolean, tiltDeg: Double, rollMode: Int32, leadLen: Double, minSpacing: Double, maxTurnDeg: Double, seamGuide: list of Point3d, fromFrame: Plane, toFrame: Plane, selfTest: Boolean
# ---------- c_script: C# usings ----------
// ---------------------------------------------------------------------------
// FL-01  Mesh -> KUKA|prc planes pipeline
// PANE: "Usings"  (Rhino 8 C# Script component, top pane)
// Paste this block into the usings pane. Nothing else goes here.
// ---------------------------------------------------------------------------
using System.Linq;
using System.Text;

using Rhino.Geometry.Intersect;



// 8 using directive(s) that the C# component already
// declares itself were removed here to keep the component free of
// CS0105 warnings. They are still in the .cs file this came from,
// which is the copy to paste from if you rebuild this by hand.
# ---------- c_script: C# ----------
// ---------------------------------------------------------------------------
// FL-01  Mesh -> KUKA|prc planes pipeline
// PANE: "Script" / the main body  (Rhino 8 C# Script component, middle pane)
//
// Do NOT wrap this in a class or a RunScript(...) signature. The component
// builds those around it. The names below are the component's own parameters
// and are already in scope - they are not declared here.
//
// COMPONENT INPUTS  (name, type hint, access, optional?)   -- build in this order
//    0  geo          Mesh      item   required   the model to cut
//    1  axisMode     int       item   optional   0 long / 1 short / 2 X / 3 Y / 4 Z / 5 custom
//    2  customAxis   Vector3d  item   optional   only read when axisMode = 5
//    3  sections     int       item   optional   how many slices          (default 12)
//    4  samples      int       item   optional   points around each slice (default 32)
//    5  loopMode     int       item   optional   0 largest loop / 1 every loop
//    6  normalMode   int       item   optional   0 mesh normal / 1 radial from slice centre
//    7  flipApproach bool      item   optional   tick if the tool aims the wrong way
//    8  tiltDeg      double    item   optional   roll about the travel direction
//    9  rollMode     int       item   optional   0 rigid (wire) / 1 free spin (pen, bit)
//   10  leadLen      double    item   optional   lead-in / lead-out distance
//   11  minSpacing   double    item   optional   drop points closer than this
//   12  maxTurnDeg   double    item   optional   warn above this wrist turn (default 30)
//   13  seamGuide    Point3d   LIST   optional   pins where every loop starts (see below)
//
//        LIST access, not item, and deliberately so: an unwired Point3d item
//        arrives as (0,0,0), which is a perfectly valid point, so the component
//        could not tell "not supplied" from "the origin" and would silently pin
//        every loop to world zero. An unwired list arrives empty, which is
//        unambiguous. Only the first point is used.
//   14  fromFrame    Plane     item   optional   pair with toFrame to place the job in the cell
//   15  toFrame      Plane     item   optional
//   16  selfTest     bool      item   optional   run the orientation proof
//
//   ABOUT seamGuide
//   A smooth closed loop has no natural starting point - there is no corner to
//   call the beginning. Left empty, the component picks one from the loop's own
//   outline, which is stable when the section has a clear long direction and a
//   coin toss when the section is nearly symmetric (a circle, an ellipse).
//   Either way the CUT is the same; only the point the tool enters at moves.
//   Wire a Point to seamGuide and every loop starts at the point nearest to it,
//   which makes the whole result exactly reproducible. Do that when you are
//   re-cutting a part to match an earlier run.
//
// COMPONENT OUTPUTS  -- build in this order
//    0  out          (the component's own message stream, always there)
//    1  Planes       tree of Plane   -> this is the deliverable, feed KUKA|prc
//    2  Points       tree of Point3d -> preview only
//    3  MoveTypes    tree of int     -> 0 air move, 1 process move
//    4  Sections     list of Curve   -> the raw slices, preview only
//    5  SlicePlanes  list of Plane   -> where the model was cut, preview only
//    6  PartFrame    Plane           -> the model's own axes, preview this first
//    7  SliceAxis    Vector3d
//    8  Count        int
//    9  MaxTurn      double          -> worst wrist rotation between two targets, deg
//   10  Status       string          -> the one-line verdict
//   11  Log          string          -> the full story
//   12  SelfTest     string          -> the orientation proof, when selfTest is on
// ---------------------------------------------------------------------------

MeshPlanes.Options opt = new MeshPlanes.Options();

opt.AxisMode      = axisMode;
opt.CustomAxis    = customAxis;
opt.Sections      = sections > 0 ? sections : 12;
opt.Samples       = samples  > 0 ? samples  : 32;
opt.LoopMode      = loopMode;
opt.NormalMode    = normalMode;
opt.FlipApproach  = flipApproach;
opt.TiltDeg       = tiltDeg;
opt.RollMode      = rollMode;
opt.LeadLen       = leadLen;
opt.MinSpacing    = minSpacing;
opt.MaxTurnDeg    = maxTurnDeg > 0 ? maxTurnDeg : 30.0;
opt.SeamGuide     = (seamGuide != null && seamGuide.Count > 0)
                    ? seamGuide[0] : Point3d.Unset;
opt.FromFrame     = fromFrame;
opt.ToFrame       = toFrame;
opt.SelfTest      = selfTest;
opt.SelfTestCount = 8;

MeshPlanes.Result res = MeshPlanes.Generate(geo, opt);

Planes      = res.Planes;
Points      = res.Points;
MoveTypes   = res.MoveTypes;
Sections    = res.Sections;
SlicePlanes = res.SlicePlanes;
PartFrame   = res.PartFrame;
SliceAxis   = res.SliceAxis;
Count       = res.Count;
MaxTurn     = res.MaxTurnDeg;
Status      = res.Status;
Log         = res.Log;
SelfTest    = res.SelfTest;

// Put the verdict on the component itself, so a bad solve is visible on the
// canvas without opening a panel.
if (Component != null)
{
  if (!string.IsNullOrEmpty(res.Status) && res.Status.StartsWith("FAIL"))
    Component.AddRuntimeMessage(GH_RuntimeMessageLevel.Error, res.Status);

  foreach (string w in res.Warnings)
    Component.AddRuntimeMessage(GH_RuntimeMessageLevel.Warning, w);

  if (selfTest && !string.IsNullOrEmpty(res.SelfTest) && !MeshPlanes.SelfTestPassed(res.SelfTest))
    Component.AddRuntimeMessage(GH_RuntimeMessageLevel.Warning,
      "Orientation self-test did not pass. Read the SelfTest output.");
}
# ---------- c_script: C# additional code ----------
// ---------------------------------------------------------------------------
// FL-01  Mesh -> KUKA|prc planes pipeline
// PANE: "Members" / "Additional code"  (Rhino 8 C# Script component, bottom pane)
//
// ASU Robotics Lab - Hotwire / Full Loop.  Author: Tirth.
// Written from scratch for the SU26 board item FL-01.
//
// WHAT THIS FILE IS
//   All the maths for the pipeline. It is a plain static class, so it contains
//   no Grasshopper wiring and no side effects. FL01_body.cs is the eight lines
//   that call into it.
//
// THE ONE DESIGN RULE: ORIENTATION INDEPENDENCE
//   Nothing in here reads the world X, Y or Z axis unless the user explicitly
//   asks for it (AxisMode 2/3/4, NormalMode 2). Every automatic decision is
//   made from the mesh's own shape, using its area-weighted principal axes.
//   Consequence: if you rotate the mesh by any rotation R and re-run, you get
//   exactly R applied to the old answer. A model lying flat and the same model
//   standing up produce the same toolpath. SelfTest() proves this numerically
//   instead of asking you to trust it.
//
// UNITS: whatever the Rhino document uses. The lab file is millimetres.
// ---------------------------------------------------------------------------

public static class MeshPlanes
{
  public const double EPS = 1e-12;

  // =========================================================================
  // 0.  INPUT / OUTPUT CONTAINERS
  // =========================================================================

  public class Options
  {
    // --- how the model gets sliced -----------------------------------------
    // 0 = auto, longest principal axis  (sections are true cross-sections)
    // 1 = auto, shortest principal axis (sections are flat "contour" slices)
    // 2 = world X   3 = world Y   4 = world Z   5 = CustomAxis
    // Modes 0 and 1 are orientation independent. Modes 2-5 are not, by design.
    public int AxisMode = 0;
    public Vector3d CustomAxis = Vector3d.Zero;

    public int Sections = 12;         // number of slices, used when Step <= 0
    public double Step = 0.0;         // slice pitch in model units; overrides Sections
    public int Samples = 32;          // target points around each slice

    // 0 = keep only the largest loop per slice (one clean profile)
    // 1 = keep every loop (branchy parts: legs, holes, split sections)
    public int LoopMode = 0;
    public double MinLoopLength = 0.0; // ignore loops shorter than this

    // --- how the tool is aimed ---------------------------------------------
    // 0 = surface normal of the mesh at each point   (follows real shape)
    // 1 = radial, outward from the slice centroid    (robust on ugly meshes)
    // 2 = FixedApproach vector                       (not orientation independent)
    public int NormalMode = 0;
    public Vector3d FixedApproach = Vector3d.Zero;
    public bool FlipApproach = false;  // tick if the tool ends up aiming away
    public double TiltDeg = 0.0;       // roll about the travel direction

    // 0 = rigid   : plane X stays locked to the travel direction (hot wire)
    // 1 = min roll: plane X free-spins to the smallest change from the last
    //               frame. Only legal for a tool that is round about its own
    //               axis (a pen, a router bit). Never for a wire.
    public int RollMode = 0;

    // --- entry / exit / safety ---------------------------------------------
    public double LeadLen = 0.0;       // retract distance before & after a loop
    public bool CloseLoop = true;      // repeat the first point to shut the loop
    public double MaxTurnDeg = 30.0;   // warn above this frame-to-frame rotation
    public double MinSpacing = 0.0;    // drop points closer than this to the last

    // Where closed loops start. Leave unset for the automatic choice, which is
    // a best effort from the loop's own shape. Supply a point - anywhere near
    // the model - to pin it: every loop then starts at the point closest to
    // this one, which makes the result fully deterministic. See the note on
    // HarmonicSeam for why the automatic choice cannot always be canonical.
    public Point3d SeamGuide = Point3d.Unset;

    // --- placing the job in the cell ---------------------------------------
    // Leave both unset to output in the model's own coordinates. Set both to
    // move the whole job: FromFrame on the model, ToFrame in the robot cell.
    public Plane FromFrame = Plane.Unset;
    public Plane ToFrame = Plane.Unset;

    // --- proof ---------------------------------------------------------------
    public bool SelfTest = false;
    public int SelfTestCount = 8;
    public bool AxisIsOrientationFree { get { return AxisMode == 0 || AxisMode == 1; } }
    public bool NormalIsOrientationFree { get { return NormalMode != 2; } }
  }

  public class Result
  {
    public DataTree<Plane> Planes = new DataTree<Plane>();   // the deliverable
    public DataTree<Point3d> Points = new DataTree<Point3d>();
    public DataTree<int> MoveTypes = new DataTree<int>();    // 0 = air, 1 = process
    public List<Curve> Sections = new List<Curve>();         // preview of the slices
    public List<Plane> SlicePlanes = new List<Plane>();
    public Plane PartFrame = Plane.WorldXY;                  // the derived local frame
    public Vector3d SliceAxis = Vector3d.ZAxis;
    public int Count = 0;
    public double MaxTurnDeg = 0.0;
    public double MinSpacing = 0.0;
    public double MaxSpacing = 0.0;
    public string Status = "";
    public string Log = "";
    public string SelfTest = "";
    public List<string> Warnings = new List<string>();
  }

  // A frame plus the bookkeeping that goes with it.
  private class Node
  {
    public Plane Frame;
    public Point3d Point;
    public int MoveType;     // 0 = travelling through air, 1 = cutting / drawing
  }

  // =========================================================================
  // 1.  ENTRY POINT
  // =========================================================================

  public static Result Generate(Mesh inputMesh, Options o)
  {
    Result r = new Result();
    StringBuilder log = new StringBuilder();

    if (o == null) o = new Options();

    if (inputMesh == null || !inputMesh.IsValid || inputMesh.Faces.Count == 0)
    {
      r.Status = "FAIL: no usable mesh on the geo input.";
      r.Log = r.Status;
      return r;
    }

    // Work on a copy. The mesh sitting in the Rhino document is never touched.
    Mesh mesh = Condition(inputMesh, log, r.Warnings);

    Core(mesh, o, r, log);

    if (o.SelfTest)
      r.SelfTest = RunSelfTest(mesh, o, r);

    r.Log = log.ToString() + (string.IsNullOrEmpty(r.SelfTest) ? "" : "\n" + r.SelfTest);
    return r;
  }

  // The pipeline proper, with no self-test recursion. Called again, on a
  // rotated copy of the mesh, by RunSelfTest.
  private static void Core(Mesh mesh, Options o, Result r, StringBuilder log)
  {
    double tol = DocTol();

    // --- 1. the model's own frame ------------------------------------------
    double[] moments;
    Plane part = PrincipalFrame(mesh, out moments, r.Warnings);
    r.PartFrame = part;
    log.AppendLine("PART FRAME  origin " + Fmt(part.Origin));
    log.AppendLine("  long axis  " + Fmt(part.XAxis) + "   spread " + moments[0].ToString("0.###"));
    log.AppendLine("  mid  axis  " + Fmt(part.YAxis) + "   spread " + moments[1].ToString("0.###"));
    log.AppendLine("  short axis " + Fmt(part.ZAxis) + "   spread " + moments[2].ToString("0.###"));

    // --- 2. which way to slice ---------------------------------------------
    Vector3d axis = ChooseAxis(part, o, r.Warnings);
    if (!axis.Unitize())
    {
      r.Status = "FAIL: slice axis is zero length.";
      log.AppendLine(r.Status);
      return;
    }
    r.SliceAxis = axis;
    log.AppendLine("SLICE AXIS  " + Fmt(axis) + "   (" + AxisModeName(o.AxisMode) + ")");

    // An in-plane reference direction that travels with the model, so the
    // starting point of every loop is decided by shape, never by world X.
    Vector3d refDir = part.YAxis;
    if (Math.Abs(refDir * axis) > 0.99) refDir = part.ZAxis;
    refDir = refDir - (refDir * axis) * axis;
    if (!refDir.Unitize()) refDir = AnyPerpendicular(axis);

    // --- 3. where to slice --------------------------------------------------
    double lo, hi;
    ProjectExtents(mesh, part.Origin, axis, out lo, out hi);
    double span = hi - lo;
    if (span < tol * 10.0)
    {
      r.Status = "FAIL: the model is flat along the slice axis. Pick another axis.";
      log.AppendLine(r.Status);
      return;
    }

    int n = o.Sections;
    if (o.Step > tol) n = Math.Max(1, (int) Math.Floor(span / o.Step));
    n = Math.Max(1, Math.Min(n, 2000));
    log.AppendLine("EXTENT along axis " + span.ToString("0.###") + " over " + n + " slice(s)");

    // Midpoint sampling. The two ends of a solid are tangent planes: slicing
    // exactly there gives a point or nothing, so we never sit on them.
    List<Plane> slicePlanes = new List<Plane>();
    for (int i = 0; i < n; i++)
    {
      double t = lo + span * (i + 0.5) / n;
      Point3d origin = part.Origin + axis * t;
      slicePlanes.Add(new Plane(origin, refDir, Vector3d.CrossProduct(axis, refDir)));
    }
    r.SlicePlanes = slicePlanes;

    // --- 4. slice, order, frame ---------------------------------------------
    Point3d seamAnchor = Point3d.Unset;   // carries the loop start from slice to slice
    Plane lastFrame = Plane.Unset;        // carries the wrist roll from frame to frame
    List<double> steps = new List<double>();
    int emptySlices = 0, multiLoop = 0, totalPoints = 0, openLoops = 0;
    double worstTurn = 0.0;
    double diag = mesh.GetBoundingBox(true).Diagonal.Length;

    for (int i = 0; i < slicePlanes.Count; i++)
    {
      Plane sp = slicePlanes[i];
      Polyline[] raw = Intersection.MeshPlane(mesh, sp);
      if (raw == null || raw.Length == 0) { emptySlices++; continue; }

      List<Polyline> loops = JoinAndFilter(raw, o, tol, diag, ref openLoops);
      if (loops.Count == 0) { emptySlices++; continue; }
      if (loops.Count > 1) multiLoop++;

      loops.Sort(delegate(Polyline a, Polyline b) { return b.Length.CompareTo(a.Length); });
      if (o.LoopMode == 0 && loops.Count > 1) loops = new List<Polyline> { loops[0] };

      for (int L = 0; L < loops.Count; L++)
      {
        Polyline pl = loops[L];
        bool closed = pl.IsClosed;
        r.Sections.Add(pl.ToPolylineCurve());

        // The seam guide only steers the FIRST loop; after that each loop
        // chains from the previous one, which is what keeps the tool from
        // sprinting across the model at every slice.
        Point3d anchor = seamAnchor.IsValid ? seamAnchor : o.SeamGuide;
        List<Point3d> pts = SampleLoop(pl, sp, anchor, o.Samples, closed);
        if (pts.Count < 2) continue;
        seamAnchor = pts[0];

        if (o.MinSpacing > tol) pts = Thin(pts, o.MinSpacing, closed);
        if (pts.Count < 2) continue;

        List<Node> nodes = BuildFrames(mesh, pts, sp, o, closed, ref lastFrame);
        if (nodes.Count == 0) continue;

        // Shut the loop by repeating the FIRST FRAME, not the first point. If
        // the point were appended before framing, the tangent at the seam would
        // be computed from a duplicated neighbour and index 0 would get a
        // one-sided difference while every other index got a central one.
        if (closed && o.CloseLoop)
        {
          Node close = new Node();
          close.Frame = nodes[0].Frame;
          close.Point = nodes[0].Point;
          close.MoveType = 1;
          nodes.Add(close);
        }

        if (o.LeadLen > tol) AddLeads(nodes, o.LeadLen);

        GH_Path path = (o.LoopMode == 0) ? new GH_Path(i) : new GH_Path(i, L);
        for (int k = 0; k < nodes.Count; k++)
        {
          r.Planes.Add(nodes[k].Frame, path);
          r.Points.Add(nodes[k].Frame.Origin, path);
          r.MoveTypes.Add(nodes[k].MoveType, path);
          totalPoints++;

          if (k > 0)
          {
            steps.Add(nodes[k].Frame.Origin.DistanceTo(nodes[k - 1].Frame.Origin));
            double turn = TurnDegrees(nodes[k - 1].Frame, nodes[k].Frame);
            if (turn > worstTurn) worstTurn = turn;
          }
        }
      }
    }

    // --- 5. relocate into the cell, if asked ---------------------------------
    if (o.FromFrame.IsValid && o.ToFrame.IsValid)
    {
      Transform x = Transform.PlaneToPlane(o.FromFrame, o.ToFrame);
      Remap(r, x);
      log.AppendLine("REMAPPED from FromFrame to ToFrame.");
    }

    // --- 6. verdict ----------------------------------------------------------
    r.Count = totalPoints;
    r.MaxTurnDeg = worstTurn;
    r.MinSpacing = steps.Count > 0 ? steps.Min() : 0.0;
    r.MaxSpacing = steps.Count > 0 ? steps.Max() : 0.0;

    log.AppendLine("POINTS " + totalPoints + " in " + r.Planes.BranchCount + " branch(es)");
    log.AppendLine("STEP   min " + r.MinSpacing.ToString("0.###") +
                   "  max " + r.MaxSpacing.ToString("0.###"));
    log.AppendLine("TURN   worst frame-to-frame rotation " + worstTurn.ToString("0.##") + " deg");

    if (emptySlices > 0)
      r.Warnings.Add(emptySlices + " slice(s) produced no loop. Fewer sections, or a different axis.");
    if (openLoops > 0)
      r.Warnings.Add(openLoops + " section(s) would not close even after stitching. The mesh has a " +
                     "hole there, so the tool will run from one edge of the gap to the other. " +
                     "Repair the mesh before cutting.");
    if (multiLoop > 0 && o.LoopMode == 0)
      r.Warnings.Add(multiLoop + " slice(s) had more than one loop; only the largest was kept. " +
                     "Set loopMode = 1 to keep them all.");
    if (worstTurn > o.MaxTurnDeg)
      r.Warnings.Add("Frame-to-frame rotation reaches " + worstTurn.ToString("0.#") +
                     " deg (limit " + o.MaxTurnDeg.ToString("0.#") +
                     "). The wrist will snap there. Raise samples or use rollMode = 1.");

    if (totalPoints == 0) r.Status = "FAIL: no planes were produced.";
    else if (r.Warnings.Count > 0) r.Status = "OK WITH WARNINGS: " + totalPoints + " planes, " +
                                              r.Planes.BranchCount + " branches.";
    else r.Status = "OK: " + totalPoints + " planes, " + r.Planes.BranchCount + " branches, " +
                    "worst turn " + worstTurn.ToString("0.#") + " deg.";
    log.AppendLine("STATUS " + r.Status);
  }

  // =========================================================================
  // 2.  MESH CONDITIONING
  //     A mesh dragged out of Blender or a scanner is rarely clean. Everything
  //     downstream assumes: no duplicate vertices, no zero-area faces, normals
  //     agreeing with each other, and on a solid, normals pointing outward.
  // =========================================================================

  private static Mesh Condition(Mesh source, StringBuilder log, List<string> warn)
  {
    Mesh m = source.DuplicateMesh();

    int facesBefore = m.Faces.Count;
    m.Vertices.CombineIdentical(true, true);
    m.Faces.CullDegenerateFaces();
    m.Compact();

    m.FaceNormals.ComputeFaceNormals();
    m.Normals.ComputeNormals();
    m.UnifyNormals();
    m.FaceNormals.ComputeFaceNormals();
    m.Normals.ComputeNormals();

    log.AppendLine("MESH  " + m.Vertices.Count + " vertices, " + m.Faces.Count + " faces" +
                   (m.IsClosed ? ", closed solid" : ", open shell"));
    if (m.Faces.Count != facesBefore)
      log.AppendLine("  cleaned " + (facesBefore - m.Faces.Count) + " degenerate/duplicate face(s)");

    if (m.IsClosed)
    {
      // SolidOrientation: 1 outward, -1 inward, 0 not a solid.
      if (m.SolidOrientation() == -1)
      {
        m.Flip(true, true, true);
        log.AppendLine("  normals pointed inward; flipped outward");
      }
    }
    else
    {
      warn.Add("The mesh is not closed. Surface normals on an open shell can point either way, " +
               "so the tool may aim through the model. Check the approach arrows, and tick " +
               "flipApproach if they are backwards.");
    }

    if (m.DisjointMeshCount > 1)
      warn.Add("The mesh is in " + m.DisjointMeshCount + " disconnected pieces. Set loopMode = 1 " +
               "or the pipeline will only follow the biggest piece in each slice.");

    return m;
  }

  // =========================================================================
  // 3.  THE MODEL'S OWN FRAME  (this is what makes orientation irrelevant)
  //
  //     Take every triangle. Weight it by its area. Build the 3x3 covariance
  //     of the triangle centres about the area centroid. Its eigenvectors are
  //     the directions the model is longest, middling and shortest in. Those
  //     directions are welded to the model: rotate the model and they rotate
  //     with it, which is exactly the property we need.
  // =========================================================================

  private static Plane PrincipalFrame(Mesh m, out double[] moments, List<string> warn)
  {
    List<Point3d> c = new List<Point3d>();
    List<double> a = new List<double>();
    TriangleCentroids(m, c, a);

    moments = new double[] { 0, 0, 0 };

    double total = 0.0;
    Point3d centre = Point3d.Origin;
    for (int i = 0; i < c.Count; i++)
    {
      total += a[i];
      centre += c[i] * a[i];
    }
    if (total < EPS)
    {
      // Every face is degenerate. Fall back to the vertex cloud unweighted.
      c.Clear(); a.Clear();
      for (int i = 0; i < m.Vertices.Count; i++) { c.Add(m.Vertices.Point3dAt(i)); a.Add(1.0); }
      total = c.Count;
      centre = Point3d.Origin;
      for (int i = 0; i < c.Count; i++) centre += c[i];
      if (total < EPS) return Plane.WorldXY;
    }
    centre /= total;

    double[,] cov = new double[3, 3];
    for (int i = 0; i < c.Count; i++)
    {
      double w = a[i];
      double dx = c[i].X - centre.X, dy = c[i].Y - centre.Y, dz = c[i].Z - centre.Z;
      cov[0, 0] += w * dx * dx; cov[0, 1] += w * dx * dy; cov[0, 2] += w * dx * dz;
      cov[1, 1] += w * dy * dy; cov[1, 2] += w * dy * dz;
      cov[2, 2] += w * dz * dz;
    }
    cov[1, 0] = cov[0, 1]; cov[2, 0] = cov[0, 2]; cov[2, 1] = cov[1, 2];
    for (int i = 0; i < 3; i++) for (int j = 0; j < 3; j++) cov[i, j] /= total;

    double[] eval; double[,] evec;
    Jacobi3(cov, out eval, out evec);

    // Sort largest spread first.
    int[] idx = new int[] { 0, 1, 2 };
    Array.Sort(idx, delegate(int p, int q) { return eval[q].CompareTo(eval[p]); });

    Vector3d e1 = Col(evec, idx[0]);
    Vector3d e2 = Col(evec, idx[1]);
    moments = new double[] { eval[idx[0]], eval[idx[1]], eval[idx[2]] };

    // An eigenvector has no inherent sign: +e and -e describe the same axis.
    // Pin the sign to the model's own lopsidedness (third moment along the
    // axis), so the frame is reproducible run to run and rotation to rotation.
    //
    // When the model is SYMMETRIC about the middle of an axis, that third
    // moment is zero and no amount of cleverness can recover a sign - the shape
    // genuinely does not distinguish one end from the other. Say so, because the
    // consequence is visible: the slice ORDER can come out reversed. The seam
    // no longer depends on any axis sign (see RotateToSeam), so this is now the
    // only place a symmetry can still show through.
    double skew1 = Skew(e1, c, a, centre);
    double scale1 = total * Math.Pow(Math.Sqrt(Math.Max(moments[0], EPS)), 3.0);
    if (scale1 > EPS && Math.Abs(skew1) / scale1 < 1e-4)
      warn.Add("This model is symmetric end-for-end along its long axis, so the shape itself " +
               "cannot say which end is 'first'. The slice ORDER is deterministic for a given " +
               "position but reverses if you flip the model end-for-end. Both orders cut the " +
               "same geometry; if the order matters to you, pin it with axisMode = 5.");

    e1 = PinSign(e1, c, a, centre);
    e2 = PinSign(e2, c, a, centre);
    e2 = e2 - (e2 * e1) * e1;
    if (!e2.Unitize()) e2 = AnyPerpendicular(e1);
    Vector3d e3 = Vector3d.CrossProduct(e1, e2);   // right handed by construction

    // If two spreads are nearly equal the model is round about that axis and
    // there is genuinely no unique answer. Say so instead of pretending.
    double scale = Math.Max(moments[0], EPS);
    if ((moments[0] - moments[1]) / scale < 0.02)
      warn.Add("The two longest directions of this model are within 2% of each other, so its " +
               "'long axis' is ambiguous (a cube, a cylinder, a sphere). The slice direction may " +
               "jump between runs. Set axisMode = 5 and supply the axis yourself.");
    else if ((moments[1] - moments[2]) / scale < 0.02)
      warn.Add("The two shortest directions of this model are within 2% of each other. " +
               "axisMode = 1 (shortest axis) is ambiguous here; prefer axisMode = 0 or 5.");

    return new Plane(centre, e1, e2);
  }

  private static double Skew(Vector3d e, List<Point3d> c, List<double> a, Point3d centre)
  {
    double skew = 0.0;
    for (int i = 0; i < c.Count; i++)
    {
      double d = (c[i] - centre) * e;
      skew += a[i] * d * d * d;
    }
    return skew;
  }

  private static Vector3d PinSign(Vector3d e, List<Point3d> c, List<double> a, Point3d centre)
  {
    double skew = Skew(e, c, a, centre);
    if (Math.Abs(skew) > 1e-9) return skew < 0 ? -e : e;

    // Perfectly symmetric about this axis: no shape-based answer exists.
    // Use a deterministic tie-break so at least the result is repeatable.
    double ax = Math.Abs(e.X), ay = Math.Abs(e.Y), az = Math.Abs(e.Z);
    if (ax >= ay && ax >= az) return e.X < 0 ? -e : e;
    if (ay >= az) return e.Y < 0 ? -e : e;
    return e.Z < 0 ? -e : e;
  }

  private static void TriangleCentroids(Mesh m, List<Point3d> centroids, List<double> areas)
  {
    for (int f = 0; f < m.Faces.Count; f++)
    {
      MeshFace face = m.Faces[f];
      Point3d A = m.Vertices.Point3dAt(face.A);
      Point3d B = m.Vertices.Point3dAt(face.B);
      Point3d C = m.Vertices.Point3dAt(face.C);
      AddTri(A, B, C, centroids, areas);
      if (face.IsQuad)
      {
        Point3d D = m.Vertices.Point3dAt(face.D);
        AddTri(A, C, D, centroids, areas);
      }
    }
  }

  private static void AddTri(Point3d A, Point3d B, Point3d C, List<Point3d> cs, List<double> ars)
  {
    double area = 0.5 * Vector3d.CrossProduct(B - A, C - A).Length;
    if (area <= EPS) return;
    cs.Add(new Point3d((A.X + B.X + C.X) / 3.0, (A.Y + B.Y + C.Y) / 3.0, (A.Z + B.Z + C.Z) / 3.0));
    ars.Add(area);
  }

  // Classic cyclic Jacobi eigensolver for a symmetric 3x3. Small, exact enough,
  // and no external library - which matters, because a Grasshopper C# component
  // cannot reference anything that is not already loaded in Rhino.
  private static void Jacobi3(double[,] input, out double[] eval, out double[,] evec)
  {
    double[,] a = (double[,]) input.Clone();
    double[,] v = new double[3, 3] { { 1, 0, 0 }, { 0, 1, 0 }, { 0, 0, 1 } };

    for (int sweep = 0; sweep < 64; sweep++)
    {
      double off = Math.Abs(a[0, 1]) + Math.Abs(a[0, 2]) + Math.Abs(a[1, 2]);
      if (off < 1e-16) break;

      for (int p = 0; p < 2; p++)
      {
        for (int q = p + 1; q < 3; q++)
        {
          if (Math.Abs(a[p, q]) < 1e-20) continue;

          double theta = (a[q, q] - a[p, p]) / (2.0 * a[p, q]);
          double t;
          if (Math.Abs(theta) < EPS) t = 1.0;
          else t = Math.Sign(theta) / (Math.Abs(theta) + Math.Sqrt(theta * theta + 1.0));
          double cs = 1.0 / Math.Sqrt(t * t + 1.0);
          double sn = t * cs;

          for (int k = 0; k < 3; k++)
          {
            double akp = a[k, p], akq = a[k, q];
            a[k, p] = cs * akp - sn * akq;
            a[k, q] = sn * akp + cs * akq;
          }
          for (int k = 0; k < 3; k++)
          {
            double apk = a[p, k], aqk = a[q, k];
            a[p, k] = cs * apk - sn * aqk;
            a[q, k] = sn * apk + cs * aqk;
          }
          for (int k = 0; k < 3; k++)
          {
            double vkp = v[k, p], vkq = v[k, q];
            v[k, p] = cs * vkp - sn * vkq;
            v[k, q] = sn * vkp + cs * vkq;
          }
        }
      }
    }
    eval = new double[] { a[0, 0], a[1, 1], a[2, 2] };
    evec = v;
  }

  private static Vector3d Col(double[,] m, int j)
  {
    Vector3d v = new Vector3d(m[0, j], m[1, j], m[2, j]);
    v.Unitize();
    return v;
  }

  // =========================================================================
  // 4.  SLICE DIRECTION AND EXTENT
  // =========================================================================

  private static Vector3d ChooseAxis(Plane part, Options o, List<string> warn)
  {
    switch (o.AxisMode)
    {
      case 0: return part.XAxis;              // longest
      case 1: return part.ZAxis;              // shortest
      case 2: warn.Add("axisMode = world X. Rotating the model now changes the result.");
              return Vector3d.XAxis;
      case 3: warn.Add("axisMode = world Y. Rotating the model now changes the result.");
              return Vector3d.YAxis;
      case 4: warn.Add("axisMode = world Z. Rotating the model now changes the result.");
              return Vector3d.ZAxis;
      case 5:
        if (o.CustomAxis.IsZero)
        {
          warn.Add("axisMode = 5 but no custom axis was supplied; fell back to the longest axis.");
          return part.XAxis;
        }
        return o.CustomAxis;
      default: return part.XAxis;
    }
  }

  private static string AxisModeName(int m)
  {
    if (m == 0) return "auto: model's longest direction";
    if (m == 1) return "auto: model's shortest direction";
    if (m == 2) return "world X";
    if (m == 3) return "world Y";
    if (m == 4) return "world Z";
    return "custom vector";
  }

  private static void ProjectExtents(Mesh m, Point3d origin, Vector3d axis,
                                     out double lo, out double hi)
  {
    lo = double.MaxValue; hi = double.MinValue;
    for (int i = 0; i < m.Vertices.Count; i++)
    {
      double t = (m.Vertices.Point3dAt(i) - origin) * axis;
      if (t < lo) lo = t;
      if (t > hi) hi = t;
    }
  }

  // =========================================================================
  // 5.  LOOPS, SAMPLING, SEAM AND WINDING
  //     Two loops from two neighbouring slices must start at roughly the same
  //     place and run the same way round. Otherwise the tool sprints across the
  //     model every slice and the wrist unwinds itself.
  // =========================================================================

  // JOIN FIRST, THEN FILTER. This ordering is not cosmetic.
  //
  // Intersection.MeshPlane does not promise one polyline per loop. Where the
  // plane grazes a vertex, or where conditioning removed a sliver face, it
  // hands back a single section as SEVERAL open arcs. Taking the longest arc
  // and dropping the others - which is what this used to do - leaves a section
  // that looks plausible, is 25% short, and puts a straight 60 mm jump across
  // the middle of the part. It is silent, and it would have reached the foam.
  //
  // So: stitch the arcs back together on their shared endpoints first, and only
  // then decide which loops are worth keeping. Anything still open afterwards
  // is a real hole in the mesh, and gets reported rather than hidden.
  private static List<Polyline> JoinAndFilter(Polyline[] raw, Options o, double tol,
                                              double diag, ref int openLoops)
  {
    List<Polyline> keep = new List<Polyline>();
    if (raw == null) return keep;

    List<Curve> pieces = new List<Curve>();
    for (int i = 0; i < raw.Length; i++)
    {
      if (raw[i] == null || raw[i].Count < 2) continue;
      PolylineCurve pc = raw[i].ToPolylineCurve();
      if (pc != null) pieces.Add(pc);
    }
    if (pieces.Count == 0) return keep;

    // Generous enough to close a section split at a shared vertex, tight enough
    // that two genuinely separate loops are never welded into one.
    double joinTol = Math.Max(tol * 10.0, diag * 1e-6);

    Curve[] joined = Curve.JoinCurves(pieces, joinTol, false);
    if (joined == null || joined.Length == 0) joined = pieces.ToArray();

    double minLen = Math.Max(o.MinLoopLength, tol * 10.0);
    for (int i = 0; i < joined.Length; i++)
    {
      Curve c = joined[i];
      if (c == null) continue;

      Polyline p;
      if (!c.TryGetPolyline(out p))
      {
        PolylineCurve pc = c.ToPolyline(0, 0, 0.01, 0, 0, tol, 0, 0, true);
        if (pc == null || !pc.TryGetPolyline(out p)) continue;
      }
      if (p == null || p.Count < 2) continue;
      if (p.Length < minLen) continue;

      // A closed section may come back with its ends merely coincident rather
      // than formally closed. Close it explicitly so the sampler treats it as
      // a loop and not as an arc.
      if (!p.IsClosed && p[0].DistanceTo(p[p.Count - 1]) <= joinTol)
      {
        p[p.Count - 1] = p[0];
      }
      if (!p.IsClosed) openLoops++;

      keep.Add(p);
    }
    return keep;
  }

  // WINDING, SEAM AND SAMPLING, ALL IN ONE PLACE AND ALL DONE BY HAND.
  //
  // These sections are polylines, so arc length along them is a sum of straight
  // segments - exact, cheap, and with no API behaviour to be surprised by. An
  // earlier version went through Curve.GetLength(Interval) and
  // Curve.LengthParameter and the samples did not tile the loop properly; the
  // last sample landed well short of the seam, leaving a gap of several times
  // the nominal spacing. Doing the walk directly removes that whole class of
  // problem and, more importantly, makes every step exactly equivariant: the
  // same arithmetic on rotated coordinates gives the rotated answer.
  //
  // Order: winding first, then the seam, then sample FROM the seam.
  //
  // The seam is intrinsic. On the first slice it is the vertex farthest from
  // the loop's own centroid; on every later slice it is the vertex nearest to
  // where the previous loop started. Those vertices are the points where the
  // slice plane cuts the mesh edges, so they belong to the geometry and travel
  // with it. No world axis and no eigenvector sign is involved.
  //
  // If a section is symmetric - a circle, an ellipse, a rectangle - two vertices
  // tie for farthest and the choice is genuinely arbitrary. Nothing can fix
  // that; the self-test reports it as SEAM NOT CANONICAL.
  private static List<Point3d> SampleLoop(Polyline pl, Plane sp, Point3d anchor,
                                          int samples, bool closed)
  {
    List<Point3d> pts = new List<Point3d>();

    // Drop the repeated closing vertex so every vertex appears exactly once.
    List<Point3d> v = new List<Point3d>();
    int raw = pl.Count;
    int keep = (closed && raw > 1) ? raw - 1 : raw;
    for (int i = 0; i < keep; i++) v.Add(pl[i]);
    if (v.Count < 2) return pts;

    if (closed && SignedArea(v, sp) < 0) v.Reverse();

    int segs = closed ? v.Count : v.Count - 1;
    double[] cum = new double[segs + 1];
    for (int i = 0; i < segs; i++)
      cum[i + 1] = cum[i] + v[i].DistanceTo(v[(i + 1) % v.Count]);
    double len = cum[segs];
    if (len <= EPS) return pts;

    double s0 = 0.0;
    if (closed)
    {
      if (anchor.IsValid)
      {
        int best = 0;
        double bestD = double.MaxValue;
        for (int i = 0; i < v.Count; i++)
        {
          double d = v[i].DistanceToSquared(anchor);
          if (d < bestD) { bestD = d; best = i; }
        }
        s0 = cum[best];
      }
      else
      {
        double h = HarmonicSeam(v, cum, segs, len);
        if (!double.IsNaN(h)) s0 = h;
        else
        {
          // Degenerate: the loop has no first harmonic, so it is symmetric under
          // a half turn. Fall back to the farthest vertex, which is at least
          // deterministic, and let the self-test report the ambiguity.
          Point3d c = Point3d.Origin;
          for (int i = 0; i < v.Count; i++) c += v[i];
          c /= v.Count;

          int best = 0;
          double bestD = -1.0;
          for (int i = 0; i < v.Count; i++)
          {
            double d = v[i].DistanceToSquared(c);
            if (d > bestD) { bestD = d; best = i; }
          }
          s0 = cum[best];
        }
      }
    }

    int n = Math.Max(3, samples);
    int count = closed ? n : n + 1;
    for (int i = 0; i < count; i++)
    {
      double s = s0 + len * i / n;
      while (s >= len) s -= len;
      if (s < 0) s = 0;
      pts.Add(WalkTo(v, cum, segs, s));
    }
    return pts;
  }

  // WHERE A LOOP STARTS, DECIDED BY THE WHOLE LOOP.
  //
  // Walk the loop at constant arc length, measure the radius from its own
  // centroid, and take the phase of the first Fourier harmonic of that radius.
  //
  // Why not simply the farthest point? Because that is decided by ONE vertex.
  // On a section that is close to symmetric - and most sections are close to
  // elliptical - two vertices nearly tie for farthest, and which one wins is
  // then settled by rounding. Rotate the model and the seam jumps to the far
  // side of the loop. The harmonic integrates the whole outline instead, so a
  // small feature anywhere on it decides the seam, smoothly and stably.
  //
  // Equivariance: the samples are taken at arc length from the polyline's own
  // start, which is NOT a property of the shape. But if that start shifts by d,
  // every sample shifts by d, the phase shifts by exactly 2*pi*d/L, and the arc
  // offset returned shifts back by d - so the POINT on the loop is unchanged.
  //
  // Returns NaN when the first harmonic vanishes, which means the loop really
  // is unchanged by a half turn (a circle, an ellipse, a rectangle). Nothing can
  // pick a seam on those; the caller falls back and the self-test says so.
  private static double HarmonicSeam(List<Point3d> v, double[] cum, int segs, double len)
  {
    const int M = 256;

    Point3d c = Point3d.Origin;
    for (int i = 0; i < v.Count; i++) c += v[i];
    c /= v.Count;

    double re = 0.0, im = 0.0, meanR = 0.0;
    for (int i = 0; i < M; i++)
    {
      double s = len * i / M;
      double r = WalkTo(v, cum, segs, s).DistanceTo(c);
      double a = 2.0 * Math.PI * i / M;
      re += r * Math.Cos(a);
      im += r * Math.Sin(a);
      meanR += r;
    }
    meanR /= M;
    if (meanR <= EPS) return double.NaN;

    double mag = Math.Sqrt(re * re + im * im) / M;
    if (mag / meanR < 1e-6) return double.NaN;

    double phase = Math.Atan2(im, re);
    if (phase < 0) phase += 2.0 * Math.PI;
    return len * phase / (2.0 * Math.PI);
  }

  private static Point3d WalkTo(List<Point3d> v, double[] cum, int segs, double s)
  {
    int j = 0;
    while (j < segs - 1 && cum[j + 1] < s) j++;
    double segLen = cum[j + 1] - cum[j];
    double u = segLen > EPS ? (s - cum[j]) / segLen : 0.0;
    if (u < 0) u = 0;
    if (u > 1) u = 1;
    Point3d a = v[j];
    Point3d b = v[(j + 1) % v.Count];
    return a + (b - a) * u;
  }

  // Same way round the slice plane for every loop. The slice plane's normal is
  // the slice axis, which is welded to the model, so "the same way round" means
  // the same thing however the model is standing.
  private static double SignedArea(List<Point3d> pts, Plane sp)
  {
    double area = 0.0;
    for (int i = 0; i < pts.Count; i++)
    {
      Point3d a, b;
      sp.RemapToPlaneSpace(pts[i], out a);
      sp.RemapToPlaneSpace(pts[(i + 1) % pts.Count], out b);
      area += a.X * b.Y - b.X * a.Y;
    }
    return area * 0.5;
  }

  private static List<Point3d> Thin(List<Point3d> pts, double minSpacing, bool closed)
  {
    List<Point3d> keep = new List<Point3d>();
    for (int i = 0; i < pts.Count; i++)
    {
      if (keep.Count == 0 || pts[i].DistanceTo(keep[keep.Count - 1]) >= minSpacing)
        keep.Add(pts[i]);
    }
    if (closed && keep.Count > 2 && keep[0].DistanceTo(keep[keep.Count - 1]) < minSpacing)
      keep.RemoveAt(keep.Count - 1);
    return keep;
  }

  // =========================================================================
  // 6.  FRAME CONSTRUCTION
  //
  //     FRAME CONVENTION - do not change without re-checking the KUKA|prc chain
  //       origin : the point on the model
  //       X      : direction of travel along the loop
  //       Z      : approach - points FROM the tool INTO the material
  //       Y      : Z cross X, so the frame is right handed
  //     KUKA|prc consumes a Plane per target and takes Z as the tool axis, so
  //     this is the convention the LIN component already expects.
  // =========================================================================

  private static List<Node> BuildFrames(Mesh mesh, List<Point3d> pts, Plane sp, Options o,
                                        bool closed, ref Plane lastFrame)
  {
    List<Node> nodes = new List<Node>();
    double tol = DocTol();
    Point3d centroid = Centroid(pts);

    for (int i = 0; i < pts.Count; i++)
    {
      Vector3d travel = Tangent(pts, i, closed);
      if (!travel.Unitize()) continue;

      Vector3d outward = Outward(mesh, pts[i], centroid, sp, o, tol);
      Vector3d approach = o.FlipApproach ? outward : -outward;

      // Strip out any component along travel, so the tool axis is always square
      // to the direction it is moving. This is what stops the tool leaning into
      // the cut on a tight corner.
      approach = approach - (approach * travel) * travel;
      if (!approach.Unitize())
      {
        approach = sp.ZAxis - (sp.ZAxis * travel) * travel;
        if (!approach.Unitize()) continue;
      }

      Vector3d yAxis = Vector3d.CrossProduct(approach, travel);
      if (!yAxis.Unitize()) continue;

      Plane f = new Plane(pts[i], travel, yAxis);

      if (Math.Abs(o.TiltDeg) > 1e-9)
        f.Rotate(RhinoMath.ToRadians(o.TiltDeg), f.XAxis, f.Origin);

      // rollMode 1: the tool is round about its own axis, so spinning it costs
      // the process nothing and can be spent on keeping the wrist still.
      if (o.RollMode == 1 && lastFrame.IsValid)
        f = MinimiseRoll(f, lastFrame);

      lastFrame = f;
      Node nd = new Node();
      nd.Frame = f;
      nd.Point = pts[i];
      nd.MoveType = 1;
      nodes.Add(nd);
    }
    return nodes;
  }

  private static Vector3d Outward(Mesh mesh, Point3d p, Point3d centroid, Plane sp,
                                  Options o, double tol)
  {
    if (o.NormalMode == 2 && !o.FixedApproach.IsZero)
    {
      Vector3d v = o.FixedApproach;
      v.Unitize();
      return v;
    }

    if (o.NormalMode == 0)
    {
      Point3d onMesh; Vector3d nrm;
      if (mesh.ClosestPoint(p, out onMesh, out nrm, tol * 1000.0) >= 0)
      {
        if (nrm.Unitize()) return nrm;
      }
    }

    // Radial fallback: straight out from the middle of this slice.
    Vector3d radial = p - centroid;
    radial = radial - (radial * sp.ZAxis) * sp.ZAxis;
    if (radial.Unitize()) return radial;
    return sp.XAxis;
  }

  private static Plane MinimiseRoll(Plane current, Plane previous)
  {
    Vector3d z = current.ZAxis;
    Vector3d x = previous.XAxis - (previous.XAxis * z) * z;
    if (!x.Unitize()) return current;
    Vector3d y = Vector3d.CrossProduct(z, x);
    if (!y.Unitize()) return current;
    return new Plane(current.Origin, x, y);
  }

  private static Vector3d Tangent(List<Point3d> pts, int i, bool closed)
  {
    int n = pts.Count;
    if (n < 2) return Vector3d.Zero;
    if (closed)
    {
      Point3d prev = pts[(i - 1 + n) % n];
      Point3d next = pts[(i + 1) % n];
      return next - prev;                       // central difference
    }
    if (i == 0) return pts[1] - pts[0];
    if (i == n - 1) return pts[n - 1] - pts[n - 2];
    return pts[i + 1] - pts[i - 1];
  }

  private static Point3d Centroid(List<Point3d> pts)
  {
    Point3d c = Point3d.Origin;
    for (int i = 0; i < pts.Count; i++) c += pts[i];
    if (pts.Count > 0) c /= pts.Count;
    return c;
  }

  // Lead-in and lead-out: the same frame, pulled straight back along its own
  // approach axis. Because it is the tool's own axis and not world Z, this
  // works identically on a model lying down and a model standing up.
  private static void AddLeads(List<Node> nodes, double leadLen)
  {
    if (nodes.Count == 0) return;

    Plane a = nodes[0].Frame;
    Plane entry = a;
    entry.Origin = a.Origin - a.ZAxis * leadLen;
    Node inNode = new Node();
    inNode.Frame = entry; inNode.Point = entry.Origin; inNode.MoveType = 0;

    Plane b = nodes[nodes.Count - 1].Frame;
    Plane exit = b;
    exit.Origin = b.Origin - b.ZAxis * leadLen;
    Node outNode = new Node();
    outNode.Frame = exit; outNode.Point = exit.Origin; outNode.MoveType = 0;

    nodes.Insert(0, inNode);
    nodes.Add(outNode);
  }

  private static double TurnDegrees(Plane a, Plane b)
  {
    Quaternion q = Quaternion.Rotation(a, b);
    double angle; Vector3d axis;
    if (!q.GetRotation(out angle, out axis)) return 0.0;
    angle = Math.Abs(angle);
    if (angle > Math.PI) angle = 2.0 * Math.PI - angle;
    return RhinoMath.ToDegrees(angle);
  }

  private static void Remap(Result r, Transform x)
  {
    for (int b = 0; b < r.Planes.BranchCount; b++)
    {
      List<Plane> planes = r.Planes.Branch(b);
      for (int i = 0; i < planes.Count; i++)
      {
        Plane p = planes[i];
        p.Transform(x);
        planes[i] = p;
      }
    }
    for (int b = 0; b < r.Points.BranchCount; b++)
    {
      List<Point3d> pts = r.Points.Branch(b);
      for (int i = 0; i < pts.Count; i++) { Point3d p = pts[i]; p.Transform(x); pts[i] = p; }
    }
    for (int i = 0; i < r.Sections.Count; i++)
    {
      Curve c = r.Sections[i].DuplicateCurve();
      c.Transform(x);
      r.Sections[i] = c;
    }
    for (int i = 0; i < r.SlicePlanes.Count; i++)
    {
      Plane p = r.SlicePlanes[i]; p.Transform(x); r.SlicePlanes[i] = p;
    }
    Plane pf = r.PartFrame; pf.Transform(x); r.PartFrame = pf;
    Vector3d ax = r.SliceAxis; ax.Transform(x); ax.Unitize(); r.SliceAxis = ax;
  }

  // =========================================================================
  // 7.  THE ORIENTATION PROOF
  //
  //     Claim: the answer for a rotated model is the rotated answer.
  //     Test:  rotate the mesh by a series of awkward rotations, run the whole
  //            pipeline again on each, rotate the result back, and measure how
  //            far it landed from the original. If the claim holds, the only
  //            difference is floating point noise.
  //     This is why the deliverable can say "works in any orientation" without
  //     hand-waving: the number is printed on the component.
  // =========================================================================

  private static string RunSelfTest(Mesh mesh, Options o, Result baseline)
  {
    StringBuilder sb = new StringBuilder();
    sb.AppendLine();
    sb.AppendLine("=== ORIENTATION SELF-TEST ===");

    if (!o.AxisIsOrientationFree || !o.NormalIsOrientationFree)
    {
      sb.AppendLine("SKIPPED. You pinned the slice axis or the approach to a world direction");
      sb.AppendLine("(axisMode 2/3/4/5 or normalMode 2). Those settings are deliberately tied to");
      sb.AppendLine("the world, so a rotated model SHOULD give a different answer. Set axisMode to");
      sb.AppendLine("0 or 1 and normalMode to 0 or 1 to test the automatic path.");
      return sb.ToString();
    }

    List<Plane> flatBase = Flatten(baseline.Planes);
    List<int> moveBase = FlattenInts(baseline.MoveTypes);
    if (flatBase.Count == 0) return "SELF-TEST SKIPPED: the baseline run produced nothing.";

    double diag = mesh.GetBoundingBox(true).Diagonal.Length;
    if (diag < EPS) diag = 1.0;

    int trials = Math.Max(1, Math.Min(o.SelfTestCount, 64));
    double worstPos = 0.0, worstAng = 0.0;
    double worstSetPos = 0.0, worstSetAng = 0.0;
    int worstTrial = -1, countMismatch = 0, axisFlips = 0;

    // Fixed seed: the same trials every solve, so a number that changes means
    // the code changed, not the dice.
    Random rnd = new Random(20260803);

    for (int k = 0; k < trials; k++)
    {
      Vector3d axis = new Vector3d(rnd.NextDouble() * 2 - 1, rnd.NextDouble() * 2 - 1,
                                   rnd.NextDouble() * 2 - 1);
      if (!axis.Unitize()) axis = Vector3d.ZAxis;
      double angle = rnd.NextDouble() * 2.0 * Math.PI;

      Transform R = Transform.Rotation(angle, axis, Point3d.Origin);
      Transform T = Transform.Translation(new Vector3d((rnd.NextDouble() - 0.5) * diag,
                                                       (rnd.NextDouble() - 0.5) * diag,
                                                       (rnd.NextDouble() - 0.5) * diag));
      Transform F = T * R;
      Transform Finv;
      if (!F.TryGetInverse(out Finv)) continue;

      Mesh moved = mesh.DuplicateMesh();
      moved.Transform(F);

      // The seam guide belongs to the model, so it travels with it. Leaving it
      // behind would be testing a different job, not a rotated one.
      Options ok = o;
      if (o.SeamGuide.IsValid)
      {
        ok = ShallowCopy(o);
        Point3d g = o.SeamGuide;
        g.Transform(F);
        ok.SeamGuide = g;
      }

      Result rk = new Result();
      Core(moved, ok, rk, new StringBuilder());
      List<Plane> flatK = Flatten(rk.Planes);

      // Did the slice axis come back pointing the other way? On a model that is
      // symmetric end-for-end this is not an error - the shape has no way to
      // prefer one end - but it reverses the slice order, so it must be
      // reported separately rather than buried in a distance number.
      Vector3d axBack = rk.SliceAxis;
      axBack.Transform(Finv);
      if (axBack.Unitize() && (axBack * baseline.SliceAxis) < 0) axisFlips++;

      if (flatK.Count != flatBase.Count) { countMismatch++; continue; }

      List<Plane> back = new List<Plane>(flatK.Count);
      for (int i = 0; i < flatK.Count; i++)
      {
        Plane p = flatK[i];
        p.Transform(Finv);
        back.Add(p);
      }

      // TWO measures, and the difference between them is the whole point.
      //
      // Index-wise: target i against target i. This is what actually gets sent
      // to the robot, so it is the strict test.
      //
      // Set-wise: every target against its NEAREST partner in the other run.
      // If this is zero while the index-wise measure is not, then the path
      // through space is identical and only the starting point of the loop has
      // moved. That happens when a cross-section is symmetric - an ellipse, a
      // circle, a rectangle - because then two seam points are genuinely
      // indistinguishable and no rule can prefer one. It is worth reporting as
      // exactly that, rather than as an unexplained failure.
      for (int i = 0; i < back.Count; i++)
      {
        double dp = back[i].Origin.DistanceTo(flatBase[i].Origin);
        double da = TurnDegrees(flatBase[i], back[i]);
        if (dp > worstPos) { worstPos = dp; worstTrial = k; }
        if (da > worstAng) { worstAng = da; worstTrial = k; }

        // Lead-in and lead-out points sit off the surface, along the tool axis
        // of whichever point they serve. If the seam moves, they move with it -
        // by design - so they have no partner and would report a mismatch of
        // exactly leadLen. Compare points on the work only.
        if (i < moveBase.Count && moveBase[i] != 1) continue;

        // Distance to the trial's PATH, not to its nearest sample. Comparing
        // sample against sample is itself sensitive to where the loop starts,
        // which is the very thing being separated out here: two runs can trace
        // exactly the same loop and still put their samples at different points
        // along it. Measuring to the path answers "is this the same cut" without
        // caring where the tool entered it.
        Plane onPath;
        double dpath = DistanceToPath(flatBase[i].Origin, back, moveBase, out onPath);
        if (dpath > worstSetPos) worstSetPos = dpath;
        if (onPath.IsValid)
        {
          double sa = TurnDegrees(flatBase[i], onPath);
          if (sa > worstSetAng) worstSetAng = sa;
        }
      }
    }

    // Thresholds: a rigid transform and back costs a few ULPs per coordinate.
    // Anything under a micron on a metre-scale part, or a millidegree, is noise.
    // WHY THESE LIMITS ARE NOT ZERO.
    // Rhino stores mesh vertices as SINGLE precision floats. Rotating a mesh and
    // rotating it back therefore cannot be bit-exact: every vertex moves by about
    // 1e-7 of the model size, and the surface normals derived from those vertices
    // wobble by roughly a thousandth of a degree. That is a property of the mesh
    // format, not of this code, and it is four orders of magnitude below anything
    // a KR6 can resolve. The limits are set just above that floor, so they still
    // catch a genuine mistake.
    double posLimit = Math.Max(1e-6 * diag, 1e-7);
    double angLimit = 1e-2;

    // The PATH comparison is measured against a polygon through the other run's
    // samples. If the two runs start their loops at different points, their
    // samples land at different places along the SAME loop, and a point on one
    // polygon then sits off the other by the chord sagitta - a discretisation
    // artefact, not a difference in the cut. So the path limit is a fraction of
    // one sample step rather than an absolute epsilon. It shrinks as samples
    // rises, which is exactly what a discretisation artefact should do.
    double step = baseline.MaxSpacing > EPS ? baseline.MaxSpacing : Math.Max(diag * 0.01, 1.0);
    double pathLimit = 0.25 * step;
    double pathAngLimit = 5.0;

    sb.AppendLine("trials                 " + trials + " random rotations + translations");
    sb.AppendLine("planes compared        " + flatBase.Count + " per trial");
    sb.AppendLine("slice-axis reversals   " + axisFlips + " of " + trials);
    sb.AppendLine("plane-count mismatches " + countMismatch + " of " + trials);
    sb.AppendLine("worst origin drift     " + worstPos.ToString("0.000000000") + " model units" +
                  "   (allowed " + posLimit.ToString("0.000000000") + ")");
    sb.AppendLine("worst rotation drift   " + worstAng.ToString("0.000000000") + " deg" +
                  "   (allowed " + angLimit.ToString("0.000000000") + ")");
    sb.AppendLine("  ... ignoring where each loop starts:");
    sb.AppendLine("worst path drift       " + worstSetPos.ToString("0.000000") + " model units" +
                  "   (" + (100.0 * worstSetPos / Math.Max(step, EPS)).ToString("0.#") +
                  "% of one " + step.ToString("0.##") + " step, allowed 25%)");
    sb.AppendLine("worst path rotation    " + worstSetAng.ToString("0.000000") + " deg" +
                  "   (allowed " + pathAngLimit.ToString("0.#") + ")");

    bool geometryOk = worstSetPos <= pathLimit && worstSetAng <= pathAngLimit
                      && countMismatch == 0 && axisFlips == 0;
    bool exact = geometryOk && worstPos <= posLimit && worstAng <= angLimit;

    if (exact)
    {
      sb.AppendLine("RESULT: PASS - the toolpath is identical in every orientation, to floating point.");
      return sb.ToString();
    }

    if (geometryOk)
    {
      sb.AppendLine("RESULT: PASS (GEOMETRY) - SEAM NOT CANONICAL");
      sb.AppendLine();
      sb.AppendLine("Every loop is the same loop, in the same place, cut the same way round.");
      sb.AppendLine("What moved is only WHERE ALONG EACH LOOP THE TOOL STARTS.");
      sb.AppendLine();
      sb.AppendLine("A smooth closed loop has no canonical starting point - there is no corner to");
      sb.AppendLine("call the beginning. The automatic choice reads the loop's own outline, which");
      sb.AppendLine("works well when the section has a clear long direction and becomes a coin toss");
      sb.AppendLine("when it is close to symmetric, as an ellipse or a circle is.");
      sb.AppendLine();
      sb.AppendLine("The residual above is the chord error between two polygons drawn through the");
      sb.AppendLine("same loop at different phases. Raise samples and it falls away.");
      sb.AppendLine();
      sb.AppendLine("IF THE START POINT MATTERS - and it does if you are re-cutting a part to match");
      sb.AppendLine("an earlier run - supply seamGuide. Every loop then starts at the point nearest");
      sb.AppendLine("to it and the whole result becomes exactly reproducible.");
      return sb.ToString();
    }

    sb.AppendLine("RESULT: FAIL");
    if (axisFlips > 0)
    {
      sb.AppendLine();
      sb.AppendLine("DIAGNOSIS: the slice axis came back reversed on " + axisFlips + " trial(s).");
      sb.AppendLine("This model is symmetric end-for-end along that axis, so the shape genuinely");
      sb.AppendLine("cannot say which end comes first - both answers cut identical geometry, but");
      sb.AppendLine("the slices are enumerated in the opposite order, and everything downstream");
      sb.AppendLine("then compares as different.");
      sb.AppendLine("This is a real limit, not a rounding problem, and no amount of maths removes");
      sb.AppendLine("it: a symmetric shape has nothing to break the tie with.");
      sb.AppendLine("FIX: set axisMode = 5 and supply the axis, which pins the direction for good.");
    }
    else
    {
      sb.AppendLine();
      sb.AppendLine("DIAGNOSIS: most likely the model is round about an axis, so its principal");
      sb.AppendLine("axes are ambiguous - see the component warnings. Pin the axis with");
      sb.AppendLine("axisMode = 5 and re-test.");
    }
    if (worstTrial >= 0) sb.AppendLine("worst trial index " + worstTrial);
    return sb.ToString();
  }

  // "PASS" and "PASS (GEOMETRY)" are both acceptable outcomes. Only a real
  // FAIL - where the path through space actually differs - is a problem.
  public static bool SelfTestPassed(string report)
  {
    return !string.IsNullOrEmpty(report) && report.Contains("RESULT: PASS");
  }

  public static bool SelfTestExact(string report)
  {
    return !string.IsNullOrEmpty(report) && report.Contains("RESULT: PASS -");
  }

  private static List<Plane> Flatten(DataTree<Plane> tree)
  {
    List<Plane> all = new List<Plane>();
    for (int b = 0; b < tree.BranchCount; b++) all.AddRange(tree.Branch(b));
    return all;
  }

  // Shortest distance from a point to the polyline through the process points,
  // together with the tool frame interpolated to that spot. Interpolating the
  // frame matters: if the two runs sample the loop at different phases, the
  // nearest SAMPLE can be half a step away and its frame will differ by the
  // local turn - which says nothing about whether the paths agree.
  private static double DistanceToPath(Point3d p, List<Plane> path, List<int> moves,
                                       out Plane frame)
  {
    double best = double.MaxValue;
    frame = Plane.Unset;
    int prev = -1;

    for (int i = 0; i < path.Count; i++)
    {
      if (i < moves.Count && moves[i] != 1) { prev = -1; continue; }
      if (prev < 0) { prev = i; continue; }

      Point3d a = path[prev].Origin, b = path[i].Origin;
      Vector3d ab = b - a;
      double len2 = ab.SquareLength;
      double t = len2 < EPS ? 0.0 : ((p - a) * ab) / len2;
      if (t < 0) t = 0;
      if (t > 1) t = 1;

      double d = p.DistanceTo(a + ab * t);
      if (d < best)
      {
        best = d;
        frame = Blend(path[prev], path[i], t);
      }
      prev = i;
    }
    return best == double.MaxValue ? 0.0 : best;
  }

  private static Plane Blend(Plane a, Plane b, double u)
  {
    Plane p = a;
    Quaternion q = Quaternion.Rotation(a, b);
    double angle; Vector3d axis;
    if (q.GetRotation(out angle, out axis) && axis.IsValid && !axis.IsZero)
    {
      if (angle > Math.PI) angle -= 2.0 * Math.PI;
      if (Math.Abs(angle) > 1e-12) p.Rotate(angle * u, axis, a.Origin);
    }
    p.Origin = a.Origin + (b.Origin - a.Origin) * u;
    return p;
  }

  private static double PointToSegment(Point3d p, Point3d a, Point3d b)
  {
    Vector3d ab = b - a;
    double len2 = ab.SquareLength;
    if (len2 < EPS) return p.DistanceTo(a);
    double t = ((p - a) * ab) / len2;
    if (t < 0) t = 0;
    if (t > 1) t = 1;
    return p.DistanceTo(a + ab * t);
  }

  private static List<int> FlattenInts(DataTree<int> tree)
  {
    List<int> all = new List<int>();
    for (int b = 0; b < tree.BranchCount; b++) all.AddRange(tree.Branch(b));
    return all;
  }

  // =========================================================================
  // 8.  ODDS AND ENDS
  // =========================================================================

  private static Options ShallowCopy(Options o)
  {
    Options c = new Options();
    c.AxisMode = o.AxisMode; c.CustomAxis = o.CustomAxis;
    c.Sections = o.Sections; c.Step = o.Step; c.Samples = o.Samples;
    c.LoopMode = o.LoopMode; c.MinLoopLength = o.MinLoopLength;
    c.NormalMode = o.NormalMode; c.FixedApproach = o.FixedApproach;
    c.FlipApproach = o.FlipApproach; c.TiltDeg = o.TiltDeg; c.RollMode = o.RollMode;
    c.LeadLen = o.LeadLen; c.CloseLoop = o.CloseLoop;
    c.MaxTurnDeg = o.MaxTurnDeg; c.MinSpacing = o.MinSpacing;
    c.SeamGuide = o.SeamGuide;
    c.FromFrame = o.FromFrame; c.ToFrame = o.ToFrame;
    c.SelfTest = false; c.SelfTestCount = o.SelfTestCount;
    return c;
  }

  public static double DocTol()
  {
    RhinoDoc doc = RhinoDoc.ActiveDoc;
    if (doc != null && doc.ModelAbsoluteTolerance > 0) return doc.ModelAbsoluteTolerance;
    return 0.001;
  }

  private static Vector3d AnyPerpendicular(Vector3d v)
  {
    Vector3d t = Math.Abs(v.X) < 0.9 ? Vector3d.XAxis : Vector3d.YAxis;
    Vector3d p = Vector3d.CrossProduct(v, t);
    p.Unitize();
    return p;
  }

  private static string Fmt(Point3d p)
  {
    return "(" + p.X.ToString("0.###") + ", " + p.Y.ToString("0.###") + ", " + p.Z.ToString("0.###") + ")";
  }

  private static string Fmt(Vector3d v)
  {
    return "(" + v.X.ToString("0.####") + ", " + v.Y.ToString("0.####") + ", " + v.Z.ToString("0.####") + ")";
  }
}
# ---------- end c_script ----------
pass_select = Slider(0, range=0..30)
branch = TreeBranch(Tree=c_script.Planes, Path=pass_select, MaintainPaths=True)
tool_z = Slider(422, range=0..800)
tool_a = Slider(-90, range=-180..180)
tool_b = Slider(-90, range=-180..180)
tool_c = Slider(0, range=-180..180)
wirespan = Slider(415.8, range=50..800)
wireaxis = Slider(2, range=0..2)
fliptoolz = BooleanToggle(False)
fliptoolspin = BooleanToggle(False)
flipz = BooleanToggle(False)
flipx = BooleanToggle(False)
tiltdeg_2 = Slider(0, range=-180..180)
spindeg = Slider(0, range=-180..180)
framemode = Slider(1, range=0..2)
cardinal = Slider(0, range=0..4)
reachmax = Slider(1101, range=200..2000)
reachmin = Slider(460, range=0..1000)
cutorient = Slider(0, range=0..3)
ztorobot = BooleanToggle(False)
hotwire = CSharpScript(
    toolZ=tool_z,
    toolA=tool_a,
    toolB=tool_b,
    toolC=tool_c,
    wireSpan=wirespan,
    wireAxis=wireaxis,
    flipToolZ=fliptoolz,
    flipToolSpin=fliptoolspin,
    targets=branch,
    flipZ=flipz,
    flipX=flipx,
    tiltDeg=tiltdeg_2,
    spinDeg=spindeg,
    frameMode=framemode,
    cardinal=cardinal,
    reachMax=reachmax,
    reachMin=reachmin,
    cutOrient=cutorient,
    zToRobot=ztorobot)  # -> out, ToolPlane, ToolAbc, Targets, WireLines, WireEndA, WireEndB, FlangePts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; inputs toolX: Double, toolY: Double, toolZ: Double, toolA: Double, toolB: Double, toolC: Double, wireSpan: Double, wireAxis: Int32, flipToolZ: Boolean, flipToolSpin: Boolean, targets: list of Plane, flipZ: Boolean, flipX: Boolean, tiltDeg: Double, spinDeg: Double, frameMode: Int32, cardinal: Int32, robotBase: Plane, reachMax: Double, reachMin: Double, cutOrient: Int32, zToRobot: Boolean
# ---------- hotwire: C# usings ----------
// ---------------------------------------------------------------------------
// HOTWIRE TOOL - TCP frame from KUKA A/B/C, plus plane flipping
// PANE: "Usings"  (Rhino 8 C# Script component, top pane)
// ---------------------------------------------------------------------------
using System.Globalization;
using System.Linq;
using System.Text;




// 8 using directive(s) that the C# component already
// declares itself were removed here to keep the component free of
// CS0105 warnings. They are still in the .cs file this came from,
// which is the copy to paste from if you rebuild this by hand.
# ---------- hotwire: C# ----------
// ---------------------------------------------------------------------------
// HOTWIRE TOOL - TCP frame from KUKA A/B/C, plus plane flipping
// PANE: "Script" / the main body  (Rhino 8 C# Script component, middle pane)
//
// COMPONENT INPUTS  (name, type hint, access, optional?)   -- build in this order
//    0  toolX        double   item   optional   TCP offset from the flange, mm
//    1  toolY        double   item   optional
//    2  toolZ        double   item   optional   default 422 - the dialog's Tool Z
//    3  toolA        double   item   REQUIRED   the dialog's Tool A  (-90)
//    4  toolB        double   item   REQUIRED   the dialog's Tool B  (-90)
//    5  toolC        double   item   REQUIRED   the dialog's Tool C  (0)
//    6  wireSpan     double   item   optional   default 415.8 (modelled span)
//    7  wireAxis     int      item   REQUIRED   0 X / 1 Y / 2 Z.  Wire lies on Z.
//
//   WHY 3, 4, 5 AND 7 ARE NOT OPTIONAL
//   Every other number here treats an unwired input - which Grasshopper reads
//   as 0 - as "use the documented default". That trick cannot work for the
//   angles or the axis index, because 0 is a perfectly good value for all four:
//   A 0 / B 0 / C 0 is the identity orientation and wireAxis 0 is the X axis.
//   So rather than guess, they are required, and Grasshopper shows "no data"
//   until they are wired. That is the right prompt.
//    8  flipToolZ    bool     item   optional   send the tool axis the other way
//    9  flipToolSpin bool     item   optional   half turn about the tool axis
//   10  targets      Plane    LIST   optional   the toolpath planes to re-orient
//   11  flipZ        bool     item   optional   approach from the other side
//   12  flipX        bool     item   optional   reverse travel
//   13  tiltDeg      double   item   optional   rotate about travel (zMode 0 only)
//   14  spinDeg      double   item   optional   free spin about the approach
//   15  frameMode    int      item   REQUIRED   0 keep / 1 CUT / 2 wire-on-cardinal
//   16  cardinal     int      item   REQUIRED   0 AUTO / 1 +X / 2 -X / 3 +Y / 4 -Y
//   17  robotBase    Plane    item   optional   where the robot stands (default world XY)
//   18  reachMax     double   item   optional   flange reach, mm (default 1101)
//   19  reachMin     double   item   optional   inner limit, mm (default 460)
//   20  cutOrient    int      item   REQUIRED   0 vertical / 1 across / 2 along / 3 cardinal
//   21  zToRobot     bool     item   optional   turn frame Z back towards the robot
//
//   cutOrient IS THE ONE TO REACH FOR PER PART
//   It says what the WIRE should do, and different parts want different things:
//
//     0 VERTICAL   wire straight up and down. Best on a part that stands up -
//                  the wire spans the full height and sweeps round the profile,
//                  so each pass cuts the whole flank instead of nibbling it.
//     1 ACROSS     wire across the travel and tangent to the surface. Same
//                  thing whenever the slices are horizontal, but derived from
//                  the surface, so it follows a part lying down or tilted.
//     2 ALONG      wire along the travel. It slides down its own kerf.
//     3 CARDINAL   wire along the approach. It goes in end-on.
//
//   2 and 3 are the wrong answers, kept so you can see what wrong looks like.
//
//   zToRobot AND WHY IT MAY REFUSE
//   With the tool taught A -90 / B -90 / C 0 the wire lies ON tool Z, so Z and
//   the wire are the same axis. Stand the wire vertical and Z is vertical too -
//   it cannot also point at the robot. The component says so rather than
//   quietly ignoring you. If you want Z to be a true approach axis, teach the
//   tool A 0 / B 0 / C 0 and set wireAxis = 1: Z is then the flange axis and
//   the wire sits on Y, and the two stop fighting.
//
//   THE SWITCH, AND WHY IT IS TWO SWITCHES
//   FL-01 hands out planes whose Z is RADIAL - it swings right around the
//   loop, so somewhere in every pass it points back at the robot and asks the
//   arm to reach through the part. That is what was wrong.
//
//   `cardinal` picks one direction instead: AUTO reads where the part sits
//   relative to the robot - in front is +X, behind is -X, either side is
//   +/-Y - so moving the part re-orients the job by itself. 1..4 force it.
//
//   `frameMode` decides what that direction is applied TO, and the two
//   choices are not interchangeable:
//
//     1 CUT   the cardinal drives the ARM (frame X). The wire is laid across
//             the travel and tangent to the surface. Both constraints met.
//     2 WIRE  the cardinal drives the WIRE (frame Z), literally. For this
//             tool that points the wire end-on into the material.
//
//   They can both be satisfied because reach acts on X - the TCP is 422 mm
//   along tool X, so the flange lands 422 mm back along the target's X - and
//   cutting acts on Z, where the wire is. Different axes, no conflict.
//
//   tiltDeg only applies when frameMode = 0, because a rebuilt frame wins.
//
//   THE DEFAULTS ARE THE REAL TOOL
//   toolZ / toolA / toolB / toolC default to the numbers in the KUKA CUSTOM
//   TOOL dialog, and wireSpan to the span measured in Hotwire_2.1.3dm. Leave
//   every input unwired and you get the lab's actual hotwire.
//
//   WHY THE FLIPS ARE INPUTS AND NOT CODE
//   Which way a frame should face is not something you reason out, it is
//   something you look at. Toggling should cost one click, and the Log output
//   tells you whether the click helped - it reports whether the wire ends up
//   across the travel (cutting), along the travel (sliding down its own kerf),
//   or along the approach (stabbing in end-on).
//
// COMPONENT OUTPUTS  -- build in this order
//    0  out            (the component's own message stream)
//    1  ToolPlane      Plane        -> KUKA|prc "Custom Tool: Plane", TOOL PLANE
//    2  ToolAbc        string       -> the X/Y/Z/A/B/C read back, for the pendant
//    3  Targets        list<Plane>  -> the flipped targets, feed the LIN component
//    4  WireLines      list<Line>   -> where the wire actually is, preview this
//    5  WireEndA       list<Plane>  -> TOOL[5]
//    6  WireEndB       list<Plane>  -> TOOL[6]
//    7  FlangePts      list<Point3d>-> where the WRIST has to be. Preview this
//                                      against the robot to see reach at a glance.
//    8  Approach       Vector3d     -> the direction that was chosen
//    9  Status         string
//   10  Log            string
// ---------------------------------------------------------------------------

HotwireTool.Options opt = new HotwireTool.Options();

opt.ToolX = toolX;
opt.ToolY = toolY;

// toolZ and wireSpan can use the usual idiom: an unwired input reads 0, and a
// TCP 0 mm off the flange or a wire 0 mm long are not real asks, so 0 safely
// means "give me the documented value".
opt.ToolZ    = toolZ    > 0 ? toolZ    : 422.0;
opt.WireSpan = wireSpan > 0 ? wireSpan : 415.8;

// The angles and the axis index cannot do that - 0 is a real value for all
// four - so they are required inputs and are taken exactly as given.
opt.ToolA    = toolA;
opt.ToolB    = toolB;
opt.ToolC    = toolC;
opt.WireAxis = wireAxis;

opt.FlipToolZ    = flipToolZ;
opt.FlipToolSpin = flipToolSpin;

opt.FlipZ   = flipZ;
opt.FlipX   = flipX;
opt.TiltDeg = tiltDeg;
opt.SpinDeg = spinDeg;

opt.FrameMode = frameMode;
opt.Cardinal  = cardinal;
opt.RobotBase = robotBase.IsValid ? robotBase : Plane.WorldXY;
opt.ReachMax  = reachMax > 0 ? reachMax : 1101.0;
opt.ReachMin  = reachMin > 0 ? reachMin :  460.0;

opt.CutOrientation = cutOrient;
opt.ZToRobot       = zToRobot;

HotwireTool.Result res = HotwireTool.Build(
  targets != null ? new List<Plane>(targets) : null, opt);

ToolPlane = res.ToolPlane;
ToolAbc   = res.ToolAbc;
Targets   = res.Targets;
WireLines = res.WireLines;
WireEndA  = res.WireEndA;
WireEndB  = res.WireEndB;
FlangePts = res.FlangePts;
Approach  = res.ApproachUsed;
Status    = res.Status;
Log       = res.Log;

if (Component != null)
{
  foreach (string w in res.Warnings)
    Component.AddRuntimeMessage(GH_RuntimeMessageLevel.Warning, w);
}
# ---------- hotwire: C# additional code ----------
// ---------------------------------------------------------------------------
// HOTWIRE TOOL - TCP frame from KUKA A/B/C, plus plane flipping
// PANE: "Members" / additional code  (Rhino 8 C# Script component, bottom pane)
//
// WHAT THIS IS FOR
//   Two jobs that both come down to "which way round is this frame".
//
//   1. Turn the numbers typed into the KUKA CUSTOM TOOL dialog - X, Y, Z, A, B,
//      C - into the Plane that KUKA|prc's "Custom Tool: Plane" wants. Type the
//      same numbers the pendant has and the simulation matches the cell.
//
//   2. Flip the toolpath target planes with toggles instead of code edits.
//      Which way a frame should face is a question you answer by looking at the
//      simulation, not by reasoning, and it should cost one click to try the
//      other way.
//
// MEASURED, NOT ASSUMED
//   The defaults come from the lab's own Hotwire_2.1.3dm, read directly:
//     flange face at the origin, tool reaching along +Z
//     wire along flange Y at Z 421.35, spanning -207.9 .. +207.9  (415.8 mm)
//   and from the CUSTOM TOOL dialog: Z 422, A -90, B -90, C 0.
//
//   Those two agree. Offsetting along the TCP's own Z by half the span lands
//   0.65 mm from the modelled wire ends, which is what says the frame really
//   does run down the wire rather than merely looking like it does.
//
// A NOTE ON B = -90
//   A -90 / B -90 / C 0 sits exactly on gimbal lock. At B = +/-90 only A + C
//   (or C - A) is determined, so A -90 / B -90 / C 0 and A 0 / B -90 / C -90
//   are the SAME orientation. If the pendant reads back different numbers from
//   the ones you typed, that is why, and nothing is wrong.
// ---------------------------------------------------------------------------

public static class HotwireTool
{
  private const double EPS = 1e-12;

  // =========================================================================
  // 0.  CONTAINERS
  // =========================================================================

  public class Options
  {
    // --- the TCP, straight off the CUSTOM TOOL dialog ---
    public double ToolX = 0.0;
    public double ToolY = 0.0;
    public double ToolZ = 422.0;
    public double ToolA = -90.0;
    public double ToolB = -90.0;
    public double ToolC = 0.0;

    // --- the wire ---
    // 415.8 mm is the span MODELLED in Hotwire_2.1.3dm, bracket face to bracket
    // face. The USABLE cutting span is shorter and has to be measured on the
    // real frame - the end-effector README lists that as an open item.
    public double WireSpan = 415.8;

    // Which axis of the tool frame the wire lies along. 2 = Z, which is what
    // A -90 / B -90 / C 0 gives.
    public int WireAxis = 2;

    // --- flipping the tool frame itself ---
    public bool FlipToolZ = false;    // send the tool axis the other way
    public bool FlipToolSpin = false; // half turn about the tool axis

    // --- HOW THE TARGET FRAMES ARE BUILT --------------------------------
    //
    // 0 KEEP  leave FL-01's frames alone - Z radial, into the material
    // 1 CUT   the cardinal direction drives the ARM, the wire lies across the
    //         travel and tangent to the surface. This is the one that cuts.
    // 2 WIRE  the cardinal direction drives the WIRE - Z is forced to
    //         +/-X or +/-Y literally.
    //
    // WHY THERE ARE TWO, AND WHY 1 IS THE DEFAULT
    //   Two different things want fixing and they are not the same axis.
    //
    //   Reach is governed by the frame's X. The TCP sits 422 mm along the
    //   tool's X, so the FLANGE lands 422 mm back along the target's X. Aim X
    //   away from the robot and the flange is pulled 422 mm closer to it.
    //
    //   Cutting is governed by the frame's Z, because the wire lies on tool Z.
    //   The wire has to be ACROSS the direction of travel and tangent to the
    //   surface. Point it along the approach instead and it goes into the foam
    //   end-on and melts a pocket.
    //
    //   Mode 2 does what "force Z to +X" says literally, and for this tool
    //   that puts the wire end-on. It is kept because it is occasionally what
    //   you want and because being able to see the wrong one is how you trust
    //   the right one. Mode 1 satisfies both constraints at once, which is
    //   possible precisely because they act on different axes.
    public int FrameMode = 1;

    // 0 AUTO  from where the part sits relative to the robot
    // 1..4    +X / -X / +Y / -Y, forced by hand
    public int Cardinal = 0;

    // --- WHAT THE WIRE SHOULD DO ----------------------------------------
    //
    // 0 VERTICAL      wire straight up and down, along world Z
    // 1 ACROSS        wire across the travel and tangent to the surface
    // 2 ALONG_TRAVEL  wire lying along the direction of travel
    // 3 CARDINAL      wire along the cardinal direction
    //
    // VERTICAL is the default because it removes material best on a part that
    // stands up: the wire spans the full height and sweeps round the profile,
    // so every pass cuts along the whole flank instead of nibbling at it.
    //
    // ACROSS is the same thing whenever the slices are horizontal - it just
    // derives the direction from the surface rather than from the world, so it
    // follows a part that is lying down or tilted.
    //
    // 2 and 3 are the two ways to get it wrong, kept because being able to see
    // the wrong one is how you come to trust the right one. The Log names
    // which of the three you are in on every solve.
    public int CutOrientation = 0;

    // Turn the frame's Z back towards the robot.
    //
    // Only meaningful when Z is NOT the wire - see the note on WireAxis. When
    // the wire is on tool Z and standing vertical, Z can only be up or down,
    // and the component says so rather than quietly doing nothing.
    public bool ZToRobot = false;

    public Plane RobotBase = Plane.WorldXY;

    // The envelope is a RING, not a maximum, and the inner wall matters here
    // more than it usually would. The flange sits 422 mm back from the cut, so
    // bringing the part CLOSER pushes the flange towards the robot's own body
    // until the arm would have to fold inside itself.
    //
    // 460 mm is measured, not from a datasheet: swept against KUKA|prc with
    // this tool, the job is clean from about 460 mm of flange radius outwards
    // and fails below it.
    public double ReachMax = 1101.0;   // KR6-10 R1100-2, flange
    public double ReachMin = 460.0;

    // --- flipping the toolpath targets ---
    public bool FlipZ = false;        // approach from the other side
    public bool FlipX = false;        // reverse travel (half turn about approach)
    public double TiltDeg = 0.0;      // rotate about the travel direction
    public double SpinDeg = 0.0;      // free spin about approach
  }

  public class Result
  {
    public Plane ToolPlane = Plane.Unset;
    public string ToolAbc = "";
    public List<Plane> Targets = new List<Plane>();
    public List<Line> WireLines = new List<Line>();
    public List<Plane> WireEndA = new List<Plane>();
    public List<Plane> WireEndB = new List<Plane>();
    public List<Point3d> FlangePts = new List<Point3d>();
    public Vector3d ApproachUsed = Vector3d.Unset;
    public int OutOfReach = 0;
    public double ReachWorst = 0.0;
    public string Status = "";
    public string Log = "";
    public List<string> Warnings = new List<string>();
  }

  // =========================================================================
  // 1.  ENTRY POINT
  // =========================================================================

  public static Result Build(List<Plane> targets, Options o)
  {
    Result r = new Result();
    StringBuilder log = new StringBuilder();

    if (o == null) o = new Options();
    if (o.WireSpan < 0.0) o.WireSpan = 0.0;
    if (o.WireAxis < 0 || o.WireAxis > 2) o.WireAxis = 2;

    // ---- 1. the tool frame -------------------------------------------------
    Plane tool = AbcToPlane(new Point3d(o.ToolX, o.ToolY, o.ToolZ), o.ToolA, o.ToolB, o.ToolC);
    if (o.FlipToolZ)    tool = FlipAboutX(tool);
    if (o.FlipToolSpin) tool = SpinAboutZ(tool, 180.0);
    r.ToolPlane = tool;

    double a, b, c;
    PlaneToAbc(tool, out a, out b, out c);
    r.ToolAbc = "X " + F(o.ToolX) + "   Y " + F(o.ToolY) + "   Z " + F(o.ToolZ) +
                "   A " + F(a) + "   B " + F(b) + "   C " + F(c);

    log.AppendLine("TOOL     " + r.ToolAbc);
    log.AppendLine("         X axis " + V(tool.XAxis) + "   (out of the flange when A/B/C are the defaults)");
    log.AppendLine("         Y axis " + V(tool.YAxis));
    log.AppendLine("         Z axis " + V(tool.ZAxis));

    if (Math.Abs(Math.Abs(o.ToolB) - 90.0) < 1e-6)
      log.AppendLine("         B is +/-90, which is gimbal lock: A and C trade off against each " +
                     "other and the pendant may read back different numbers for the same pose.");

    Vector3d wireDir = AxisOf(tool, o.WireAxis);
    log.AppendLine("WIRE     " + o.WireSpan.ToString("0.#") + " mm along the tool's " +
                   AxisName(o.WireAxis) + " axis " + V(wireDir));
    log.AppendLine("         that is the MODELLED span. The usable cutting span is shorter " +
                   "and has to be measured on the real frame.");

    // ---- 2. the targets ----------------------------------------------------
    List<Plane> sources = new List<Plane>();

    if (targets != null)
    {
      // ---- the cardinal direction ----------------------------------------
      Vector3d card = Vector3d.Unset;
      if (o.FrameMode >= 1)
      {
        card = (o.Cardinal == 0) ? AutoApproach(targets, o.RobotBase)
                                 : CardinalOf(o.Cardinal);
        r.ApproachUsed = card;
        log.AppendLine("CARDINAL " + (o.Cardinal == 0 ? "AUTO -> " : "forced ") + V(card) +
                       "   (" + CardinalName(card) + ")");

        if (o.FrameMode == 1)
        {
          log.AppendLine("MODE     CUT - the cardinal drives the ARM. X points that way, so the");
          log.AppendLine("         flange is pulled " + Math.Abs(o.ToolZ).ToString("0") +
                         " mm back towards the robot.");
          log.AppendLine("WIRE SET " + CutName(o.CutOrientation));
        }
        else
        {
          log.AppendLine("MODE     WIRE - the cardinal drives the WIRE. Z is forced to it literally.");
          log.AppendLine("         For this tool the wire is on tool Z, so it will go into the");
          log.AppendLine("         material end-on. Use mode 1 unless you specifically want this.");
        }
        if (Math.Abs(o.TiltDeg) > EPS)
          log.AppendLine("         tiltDeg is ignored while frameMode is on - the rebuilt frame wins.");

        DeadZone(targets, o, r, log);
      }
      else
      {
        log.AppendLine("MODE     KEEP - using FL-01's own radial Z. It swings right round the loop,");
        log.AppendLine("         so somewhere in every pass it points back at the robot.");
      }

      int flipped = 0;
      foreach (Plane p in targets)
      {
        if (!p.IsValid) continue;
        sources.Add(p);
        Plane q = p;

        if (o.FrameMode >= 1)
        {
          q = Reframe(p, card, o);
        }
        else
        {
          // Tilt is applied about the ORIGINAL travel direction and before the
          // spin, so that "tilt 90" always means the same thing no matter what
          // the other toggles are doing.
          if (Math.Abs(o.TiltDeg) > EPS) q = RotateAbout(q, o.TiltDeg, q.XAxis);
        }

        if (o.FlipZ) { q = FlipAboutX(q); flipped++; }
        if (o.FlipX) q = SpinAboutZ(q, 180.0);
        if (Math.Abs(o.SpinDeg) > EPS) q = SpinAboutZ(q, o.SpinDeg);
        r.Targets.Add(q);

        Vector3d w = AxisOf(q, o.WireAxis);
        Point3d pa = q.Origin - w * (o.WireSpan * 0.5);
        Point3d pb = q.Origin + w * (o.WireSpan * 0.5);
        r.WireLines.Add(new Line(pa, pb));

        Plane fa = q; fa.Origin = pa; r.WireEndA.Add(fa);
        Plane fb = q; fb.Origin = pb; r.WireEndB.Add(fb);
      }

      ZReport(r, o, log);
      Reach(r, o, log);

      bool touched = o.FlipZ || o.FlipX ||
                     Math.Abs(o.TiltDeg) > EPS || Math.Abs(o.SpinDeg) > EPS;
      log.AppendLine("TARGETS  " + r.Targets.Count + " in" +
                     (o.FlipZ ? ", approach flipped" : "") +
                     (o.FlipX ? ", travel reversed" : "") +
                     (Math.Abs(o.TiltDeg) > EPS ? ", tilted " + F(o.TiltDeg) + " deg about travel" : "") +
                     (Math.Abs(o.SpinDeg) > EPS ? ", spun " + F(o.SpinDeg) + " deg" : "") +
                     (touched ? "" : ", unchanged"));

      Diagnose(r, sources, o, log);
    }
    else
    {
      log.AppendLine("TARGETS  none wired - tool frame only");
    }

    r.Status = (r.Warnings.Count == 0 ? "OK: " : "OK WITH WARNINGS: ") +
               r.Targets.Count + " target(s), wire " + o.WireSpan.ToString("0.#") +
               " mm along tool " + AxisName(o.WireAxis) +
               (r.Targets.Count > 0
                  ? ", flange to " + r.ReachWorst.ToString("0") + " mm" +
                    (r.OutOfReach > 0 ? ", " + r.OutOfReach + " OUT OF REACH" : ", all in reach")
                  : "");
    r.Log = log.ToString();
    return r;
  }

  // =========================================================================
  // 2.  IS THE WIRE POINTING A SENSIBLE WAY?
  //
  //     The cutting element is a LINE, not a point, so unlike a router bit it
  //     matters which way the line lies relative to the direction of travel.
  //     Three cases, and only one of them cuts:
  //
  //       wire ACROSS the travel, tangent to the surface   -> slicing. good.
  //       wire ALONG the travel                            -> dragging the wire
  //            lengthwise through its own kerf. It will not cut, it will just
  //            follow the slot it already made.
  //       wire ALONG the approach                          -> stabbing the wire
  //            end-on into the foam. It will melt a pocket.
  //
  //     This is the check that makes the flip toggles useful: flip something,
  //     read this, and you know whether you improved it.
  // =========================================================================

  private static void Diagnose(Result r, List<Plane> sources, Options o, StringBuilder log)
  {
    if (r.Targets.Count == 0 || sources.Count != r.Targets.Count) return;

    double worstTravel = 0.0, worstApproach = 0.0;
    int nTravel = 0, nApproach = 0;

    for (int i = 0; i < r.Targets.Count; i++)
    {
      // The wire direction comes from the FINAL frame - that is where the wire
      // ends up. Travel and approach come from the ORIGINAL frame, because
      // those are properties of the toolpath and do not move when the tool is
      // rotated. Measuring both on the final frame compares the wire against
      // itself and can only ever report "parallel".
      Vector3d w = AxisOf(r.Targets[i], o.WireAxis);
      double alongTravel   = Math.Abs(w * sources[i].XAxis);
      double alongApproach = Math.Abs(w * sources[i].ZAxis);

      if (alongTravel   > worstTravel)   worstTravel = alongTravel;
      if (alongApproach > worstApproach) worstApproach = alongApproach;
      if (alongTravel   > 0.7) nTravel++;
      if (alongApproach > 0.7) nApproach++;
    }

    log.AppendLine("WIRE VS  travel  worst |cos| " + worstTravel.ToString("0.###") +
                   "   approach  worst |cos| " + worstApproach.ToString("0.###") +
                   "     (0 = perpendicular, 1 = parallel)");

    if (nApproach > 0)
    {
      string m = nApproach + " of " + r.Targets.Count + " targets point the WIRE along the " +
                 "approach direction. The wire would go into the material end-on and melt a " +
                 "pocket rather than cut. Set tiltDeg = 90 to lay it across the travel.";
      r.Warnings.Add(m);
      log.AppendLine("  !! " + m);
    }
    if (nTravel > 0)
    {
      string m = nTravel + " of " + r.Targets.Count + " targets lay the WIRE along the " +
                 "direction of travel. The wire then slides down its own kerf and removes " +
                 "nothing. The wire wants to be ACROSS the travel.";
      r.Warnings.Add(m);
      log.AppendLine("  !! " + m);
    }
    if (nApproach == 0 && nTravel == 0)
      log.AppendLine("  OK   the wire lies across the travel and tangent to the surface, " +
                     "which is the slicing case.");
  }

  // =========================================================================
  // 2b. WHICH WAY DOES THE TOOL COME IN
  //
  //     A wire does not have to come at the work radially the way a router bit
  //     does. It is a straight line, and one consistent attitude is easier to
  //     cut with AND easier to reach. So the approach is forced to one
  //     direction, and AUTO picks that direction from where the part actually
  //     is relative to the robot: whichever of +X, -X, +Y, -Y points from the
  //     robot towards the work.
  //
  //     Front of the robot -> +X. Behind -> -X. Left and right -> +/-Y.
  //     That is the whole rule, and it is the one the user asked for.
  // =========================================================================

  private static Vector3d AutoApproach(List<Plane> targets, Plane robotBase)
  {
    Point3d c = Point3d.Origin;
    int n = 0;
    foreach (Plane p in targets) { if (p.IsValid) { c += p.Origin; n++; } }
    if (n == 0) return Vector3d.XAxis;
    c = new Point3d(c.X / n, c.Y / n, c.Z / n);

    // Horizontal only. Coming at a part from straight above or below is a
    // different kind of job and not what this switch is for.
    Vector3d v = new Vector3d(c.X - robotBase.Origin.X, c.Y - robotBase.Origin.Y, 0.0);
    if (!v.Unitize()) return Vector3d.XAxis;

    return Math.Abs(v.X) >= Math.Abs(v.Y)
         ? (v.X >= 0 ? Vector3d.XAxis : -Vector3d.XAxis)
         : (v.Y >= 0 ? Vector3d.YAxis : -Vector3d.YAxis);
  }

  /// The blind spot directly behind the robot.
  ///
  /// Axis 1 cannot wrap the whole way round, so there is a narrow wedge behind
  /// the robot that it simply cannot turn to face. Swept against KUKA|prc with
  /// this cell, everything from 0 to 170 degrees and from 190 to 360 is fine,
  /// and 175 to 185 fails. Ten degrees wide, and easy to sit a part in by
  /// accident because nothing about the geometry looks wrong.
  private static void DeadZone(List<Plane> targets, Options o, Result r, StringBuilder log)
  {
    Point3d c = Point3d.Origin;
    int n = 0;
    foreach (Plane p in targets) { if (p.IsValid) { c += p.Origin; n++; } }
    if (n == 0) return;
    c = new Point3d(c.X / n, c.Y / n, c.Z / n);

    double dx = c.X - o.RobotBase.Origin.X, dy = c.Y - o.RobotBase.Origin.Y;
    if (Math.Abs(dx) < EPS && Math.Abs(dy) < EPS) return;

    double bearing = RhinoMath.ToDegrees(Math.Atan2(dy, dx));   // 0 = in front
    double behind = 180.0 - Math.Abs(bearing);                  // 0 = dead astern

    log.AppendLine("BEARING  part sits " + bearing.ToString("0") +
                   " deg round from the front of the robot");

    if (behind <= 10.0)
    {
      string m = "The part is " + behind.ToString("0") + " deg from DIRECTLY BEHIND the " +
                 "robot. Axis 1 cannot wrap that far, so there is a blind wedge roughly " +
                 "175-185 deg that no orientation reaches. Swing the part 15-20 deg to " +
                 "either side and it comes back.";
      r.Warnings.Add(m);
      log.AppendLine("  !! " + m);
    }
  }

  private static string CutName(int m)
  {
    if (m == 1) return "ACROSS the travel, tangent to the surface - follows a tilted part";
    if (m == 2) return "ALONG the travel - it will slide down its own kerf and cut nothing";
    if (m == 3) return "along the CARDINAL - it will go into the material end-on";
    return "VERTICAL, along world Z - spans the height of an upright part";
  }

  /// Did zToRobot actually manage it?
  ///
  /// Worth reporting rather than assuming, because when the wire is on tool Z
  /// and standing vertical, Z is vertical too and simply cannot point at the
  /// robot. Silently doing nothing there would look like a bug.
  private static void ZReport(Result r, Options o, StringBuilder log)
  {
    if (r.Targets.Count == 0) return;

    // Measured HORIZONTALLY. The robot base sits on the floor and the work is
    // up in the air, so a Z pointing straight down scores well against the raw
    // direction to the base while facing nothing like the robot. Dropping the
    // vertical is the difference between reporting this honestly and flattering
    // it.
    int toward = 0;
    double best = -1.0, vertical = 0.0;

    foreach (Plane q in r.Targets)
    {
      Vector3d flat = o.RobotBase.Origin - q.Origin;
      flat.Z = 0.0;
      if (!flat.Unitize()) continue;

      Vector3d z = q.ZAxis;
      vertical += Math.Abs(z.Z);
      double dot = z * flat;
      if (dot > 0.5) toward++;
      if (dot > best) best = dot;
    }
    vertical /= r.Targets.Count;

    log.AppendLine("FRAME Z  " + toward + " of " + r.Targets.Count +
                   " targets face the robot horizontally   (best " + best.ToString("0.00") +
                   ", 1.00 = straight at it;  Z is " + (100.0 * vertical).ToString("0") +
                   "% vertical)");

    if (o.ZToRobot && toward == 0)
    {
      string m = "zToRobot is on but Z cannot be turned to face the robot - it is " +
                 (100.0 * vertical).ToString("0") + "% vertical. With wireAxis = 2 the wire " +
                 "IS the Z axis, so once the wire stands up Z can only point up or down. " +
                 "Two ways out: set cutOrient to 2 or 3 to lay the wire down (it will " +
                 "stop cutting well), or accept that on this tool the axis running from " +
                 "the cut back to the wrist is the one that faces the robot - it has to " +
                 "be, or the arm could not reach past its own tool.";
      r.Warnings.Add(m);
      log.AppendLine("  !! " + m);
    }
  }

  private static Vector3d CardinalOf(int mode)
  {
    if (mode == 1) return Vector3d.XAxis;
    if (mode == 2) return -Vector3d.XAxis;
    if (mode == 3) return Vector3d.YAxis;
    if (mode == 4) return -Vector3d.YAxis;
    return Vector3d.XAxis;
  }

  private static string CardinalName(Vector3d v)
  {
    if (Math.Abs(v.X) > 0.5) return v.X > 0 ? "+X, out in front of the robot" : "-X, behind the robot";
    if (Math.Abs(v.Y) > 0.5) return v.Y > 0 ? "+Y, to the left" : "-Y, to the right";
    return "off-axis";
  }

  /// Rebuild one target frame, keeping its origin.
  ///
  /// MODE 1, CUT - the one that works:
  ///   X = the cardinal direction. The arm comes from there, and because the
  ///       TCP is 422 mm along tool X the flange is pulled 422 mm back towards
  ///       the robot.
  ///   Z = FL-01's own Y, squared up against X. FL-01 builds Y as Z cross X,
  ///       i.e. tangent to the surface and ACROSS the direction of travel -
  ///       which is exactly where a cutting wire wants to be. On a part
  ///       standing upright with horizontal slices, that comes out vertical,
  ///       so the wire spans the part's height and sweeps round its profile.
  ///
  /// MODE 2, WIRE - literal:
  ///   Z = the cardinal direction, X = whatever is left.
  ///
  /// The two constraints can both be met at once only because they act on
  /// different axes. That is the whole trick.
  private static Plane Reframe(Plane p, Vector3d card, Options o)
  {
    Vector3d c = card;
    if (!c.Unitize()) return p;

    // Mode 2 is the literal one: the cardinal drives the wire, nothing else.
    if (o.FrameMode == 2) return Build(p, c, c, o);

    // ---- where does the wire want to point? ----
    Vector3d wire;
    switch (o.CutOrientation)
    {
      case 1:  wire = p.YAxis; break;                    // across travel, tangent
      case 2:  wire = p.XAxis; break;                    // along travel
      case 3:  wire = c;       break;                    // along the cardinal
      default: wire = Vector3d.ZAxis; break;             // VERTICAL
    }
    return Build(p, wire, c, o);
  }

  /// Assemble a frame that puts the wire on `wire` and the arm along `arm`.
  ///
  /// The wire does not always live on the frame's Z - that depends on how the
  /// tool was taught, which is what WireAxis records - so the frame is built
  /// around whichever axis actually carries it. The arm direction takes the
  /// next axis, squared up against the wire.
  private static Plane Build(Plane p, Vector3d wire, Vector3d arm, Options o)
  {
    Vector3d w = wire;
    if (!w.Unitize()) return p;

    Vector3d a = arm - (arm * w) * w;          // square the arm to the wire
    if (!a.Unitize()) a = AnyPerp(w);

    Vector3d x, y;
    if (o.WireAxis == 2)                       // wire on Z - the taught tool
    {
      x = a;
      y = Vector3d.CrossProduct(w, x);
      if (!y.Unitize()) return p;
    }
    else if (o.WireAxis == 1)                  // wire on Y - Z is then free to
    {                                          // be the approach direction
      y = w;
      x = a;
      Vector3d z = Vector3d.CrossProduct(x, y);
      if (!z.Unitize()) return p;
    }
    else                                       // wire on X
    {
      x = w;
      y = Vector3d.CrossProduct(AnyPerp(w), w);
      if (!y.Unitize()) y = AnyPerp(w);
    }

    Plane q = new Plane(p.Origin, x, y);
    if (!q.IsValid) return p;

    // ---- turn Z back towards the robot, if that is even possible ----
    if (o.ZToRobot)
    {
      Vector3d toRobot = o.RobotBase.Origin - p.Origin;
      if (toRobot.Unitize() && (q.ZAxis * toRobot) < 0.0)
        q = new Plane(q.Origin, q.XAxis, -q.YAxis);   // flip Z, stay right handed
    }
    return q;
  }

  private static Vector3d AnyPerp(Vector3d v)
  {
    Vector3d a = Math.Abs(v.Z) < 0.9 ? Vector3d.ZAxis : Vector3d.XAxis;
    Vector3d p = Vector3d.CrossProduct(v, a);
    p.Unitize();
    return p;
  }

  // =========================================================================
  // 2c. CAN THE ARM ACTUALLY GET THERE
  //
  //     Measuring the distance to the TARGET is the wrong test, and it is the
  //     one everybody does first. The robot's 1101 mm is the reach of its
  //     FLANGE; the target is where the TCP goes, and the TCP is 422 mm away
  //     from the flange. So the flange position has to be worked out properly
  //     before anything is compared to anything.
  //
  //     The TCP offset is expressed in the tool plane's own basis, so this
  //     stays correct if the tool is re-taught with different A/B/C.
  // =========================================================================

  private static void Reach(Result r, Options o, StringBuilder log)
  {
    if (r.Targets.Count == 0) return;

    Plane tool = r.ToolPlane;
    Vector3d off = new Vector3d(tool.Origin);        // flange -> TCP, flange coords
    double a = off * tool.XAxis, b = off * tool.YAxis, c = off * tool.ZAxis;

    double worst = 0.0, best = double.MaxValue;
    int over = 0, under = 0;

    foreach (Plane q in r.Targets)
    {
      Point3d flange = q.Origin - (a * q.XAxis + b * q.YAxis + c * q.ZAxis);
      r.FlangePts.Add(flange);

      double d = flange.DistanceTo(o.RobotBase.Origin);
      if (d > worst) worst = d;
      if (d < best) best = d;
      if (d > o.ReachMax) over++;
      if (d < o.ReachMin) under++;
    }

    r.OutOfReach = over + under;
    r.ReachWorst = worst;

    log.AppendLine("REACH    flange " + best.ToString("0") + " .. " + worst.ToString("0") +
                   " mm from the robot base");
    log.AppendLine("         working ring is " + o.ReachMin.ToString("0") + " .. " +
                   o.ReachMax.ToString("0") + " mm. Note it is a RING - the flange sits " +
                   Math.Abs(o.ToolZ).ToString("0") + " mm back from the cut, so too CLOSE " +
                   "fails as surely as too far.");

    if (over > 0)
    {
      string m = over + " of " + r.Targets.Count + " targets put the FLANGE beyond " +
                 o.ReachMax.ToString("0") + " mm - worst " + worst.ToString("0") +
                 " mm. The arm cannot stretch that far. Move the part TOWARDS the robot.";
      r.Warnings.Add(m);
      log.AppendLine("  !! " + m);
    }
    if (under > 0)
    {
      string m = under + " of " + r.Targets.Count + " targets put the FLANGE inside " +
                 o.ReachMin.ToString("0") + " mm - closest " + best.ToString("0") +
                 " mm. The arm would have to fold into its own body. Move the part " +
                 "AWAY from the robot - counter-intuitive, but the tool reaches 422 mm " +
                 "ahead of the wrist.";
      r.Warnings.Add(m);
      log.AppendLine("  !! " + m);
    }
    if (over == 0 && under == 0)
      log.AppendLine("  OK   every target sits inside the working ring.");
  }

  // =========================================================================
  // 3.  FLIPS
  //
  //     Both are expressed as rebuilding the plane from two of its own axes,
  //     which keeps the frame exactly orthonormal. Negating an axis and
  //     leaving the others alone would make a left-handed frame, and KUKA|prc
  //     reads A/B/C off the frame - a left-handed one gives a silently wrong
  //     orientation rather than an error.
  // =========================================================================

  /// Reverse Z, keep X. Y follows, so the frame stays right handed.
  private static Plane FlipAboutX(Plane p)
  {
    return new Plane(p.Origin, p.XAxis, -p.YAxis);
  }

  /// Rotate about the plane's own Z. 180 degrees reverses X - the travel
  /// direction - without disturbing the approach.
  private static Plane SpinAboutZ(Plane p, double deg)
  {
    return RotateAbout(p, deg, p.ZAxis);
  }

  /// Rotate about any axis through the plane's origin.
  ///
  /// The one that matters is 90 degrees about X, the travel direction: it
  /// swings the tool's Z from pointing INTO the material to lying tangent
  /// across it. With the wire on tool Z, that is the difference between
  /// stabbing the wire in end-on and laying it across the cut.
  private static Plane RotateAbout(Plane p, double deg, Vector3d axis)
  {
    Plane q = p;
    q.Rotate(RhinoMath.ToRadians(deg), axis, p.Origin);
    return q;
  }

  private static Vector3d AxisOf(Plane p, int axis)
  {
    if (axis == 0) return p.XAxis;
    if (axis == 1) return p.YAxis;
    return p.ZAxis;
  }

  private static string AxisName(int axis)
  {
    if (axis == 0) return "X";
    if (axis == 1) return "Y";
    return "Z";
  }

  // =========================================================================
  // 4.  KUKA A/B/C
  //
  //     Z-Y'-X'' intrinsic, so R = Rz(A) . Ry(B) . Rx(C). Same convention and
  //     the same gimbal-lock branch as TF09_helpers.cs and FL01_helpers.cs -
  //     deliberately duplicated rather than shared, because a Grasshopper
  //     script component has to stand on its own in one canvas.
  // =========================================================================

  public static Plane AbcToPlane(Point3d origin, double A, double B, double C)
  {
    double a = RhinoMath.ToRadians(A), b = RhinoMath.ToRadians(B), c = RhinoMath.ToRadians(C);
    double ca = Math.Cos(a), sa = Math.Sin(a);
    double cb = Math.Cos(b), sb = Math.Sin(b);
    double cc = Math.Cos(c), sc = Math.Sin(c);

    Vector3d X = new Vector3d(ca * cb, sa * cb, -sb);
    Vector3d Y = new Vector3d(ca * sb * sc - sa * cc, sa * sb * sc + ca * cc, cb * sc);
    return new Plane(origin, X, Y);
  }

  public static void PlaneToAbc(Plane p, out double A, out double B, out double C)
  {
    Vector3d X = p.XAxis; X.Unitize();
    Vector3d Y = p.YAxis; Y.Unitize();
    Vector3d Z = p.ZAxis; Z.Unitize();

    double r00 = X.X, r10 = X.Y, r20 = X.Z;
    double r01 = Y.X, r11 = Y.Y, r21 = Y.Z;
    double r22 = Z.Z;

    double sB = -r20;
    if (sB > 1.0) sB = 1.0;
    if (sB < -1.0) sB = -1.0;

    if (Math.Abs(sB) > 1.0 - 1e-10)
    {
      B = sB > 0 ? 90.0 : -90.0;
      A = 0.0;
      C = sB > 0 ? RhinoMath.ToDegrees(Math.Atan2(r01, r11))
                 : RhinoMath.ToDegrees(Math.Atan2(-r01, r11));
      return;
    }

    B = RhinoMath.ToDegrees(Math.Asin(sB));
    A = RhinoMath.ToDegrees(Math.Atan2(r10, r00));
    C = RhinoMath.ToDegrees(Math.Atan2(r21, r22));
  }

  // =========================================================================
  // 5.  ODDS AND ENDS
  // =========================================================================

  private static string F(double d)
  { return d.ToString("0.###", CultureInfo.InvariantCulture); }

  private static string V(Vector3d v)
  {
    CultureInfo inv = CultureInfo.InvariantCulture;
    return "(" + v.X.ToString("0.##", inv) + ", " + v.Y.ToString("0.##", inv) +
           ", " + v.Z.ToString("0.##", inv) + ")";
  }
}
# ---------- end hotwire ----------

# ---- group: KUKA|prc (legacy - never PRC Preview)
tool_mesh = Mesh(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)
lin_move = LINearMovementKUKAPrc(TargetAsPlane=hotwire.Targets, extaxenabled=False, interpolation="C_DIS")
tool_id = Slider(4, range=0..16)
custom_tool_pln = CustomToolPlaneKUKAPrc(ToolGeometry=tool_mesh, ToolNumber=tool_id, ToolPlane=hotwire.ToolPlane, frameinput=False)
kr6_10_r1100_2 = AgilusKR610R11002Robot(infiniterot=False)
sim = Slider(0, range=0..1)
kuka_prc = KUKAPrcCORE(
    SimulationSlider=sim,
    KUKAPrcCommands=lin_move,
    Tool=custom_tool_pln,
    Robot=kr6_10_r1100_2,
    PRC_BaseExpose=False,
    PRC_SaveNameExpose=False,
    PRCsettings="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")  # -> RobotGeometry, AnalysisOutput
analysis = AnalysisKUKAPrc(KUKAPrcAnalysisData=kuka_prc.AnalysisOutput)  # -> RobotAxisValues, RobotCollisionCheck, RobotReachabilityCheck, CommandID, TimeValue, Planes, CommandTags, IOState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; disabled

# ----
# note: THE PART - STANDING VERTICAL
# 
# Baked in at the origin and moved here, so dragging part X/Y/Z walks it round the cell and cardinal = AUTO re-picks the approach to match.
# 
# Default 1273 / -20 / 302 - where the part sits in HoitWire_V1.3dm.
# 
# THE REACHABLE ZONE IS A RING, NOT A MAXIMUM. The flange ends up 422 mm back from the cut, so a part that is too CLOSE is just as impossible as one too far - the arm would have to fold inside itself. Measured against prc with this tool:
#    part X below ~900    flange under ~460   FAILS, too close
#    part X 900 .. 1450   flange 460..1050    clean
# This is why moving the part nearer is not automatically the fix.
# 
# Your own part: right-click geo > Clear values, then > Set one Mesh.
# 
# The demo shape is deliberately lopsided - a part symmetric about its own long axis has no unique seam, and FL-01 says so rather than guess.
status = Panel(c_script.Status)
# note: ONE PASS AT A TIME
# 
# Planes comes out as a tree, one branch per slice. The robot cuts one slice per run, so Tree Branch picks the pass and you export one .src per pass - the same index-then-cut workflow as the ruled-wire definition.
count = Panel(c_script.Count)
maxturn = Panel(c_script.MaxTurn)
log = Panel(c_script.Log)
# note: PREVIEW PartFrame FIRST
# 
# Before anything else, look at PartFrame in the Rhino viewport. It is the model's own axes worked out from the shape itself. If the red arrow runs down the long direction of your part, the pipeline has understood it and everything downstream will be right.
# note: THE APPROACH SWITCH
# 
# cardinal   0 AUTO  1 +X  2 -X  3 +Y  4 -Y
# frameMode  0 keep  1 CUT  2 wire-on-cardinal
# 
# FL-01's Z is RADIAL - it swings right round the loop, so somewhere in every pass it points back at the robot and asks the arm to reach through the part. That was the problem.
# 
# cardinal AUTO reads where the part sits: in front is +X, behind is -X, either side is +/-Y. Drag the part X/Y/Z sliders and the approach re-picks itself.
# 
# frameMode says what that direction drives, and the two are NOT the same:
#   1 CUT   drives the ARM. The wire is laid across the travel, tangent to the surface. Both reach and cutting satisfied.  <-- shipped
#   2 WIRE  drives the WIRE, literally. For this tool that points the wire end-on into the foam. Try it and read the warning.
# 
# Both can be right at once because reach acts on X (the flange sits 422 mm back along it) and cutting acts on Z (the wire lies on it).
# 
# cutOrient says what the WIRE does, and it is the one to change per part:
#   0 VERTICAL  up and down - spans the height of an upright part  <-- shipped
#   1 ACROSS    across the travel, tangent - follows a tilted part
#   2 ALONG     along the travel - slides down its own kerf
#   3 CARDINAL  along the approach - goes in end-on
# 2 and 3 are the wrong answers, kept so you can see wrong.
# 
# zToRobot turns frame Z back towards the robot. It will REFUSE while the wire is on tool Z and vertical, because then Z is the wire and can only point up or down. Read the Log - it explains and tells you the tool definition that separates them.
# note: FL-01 - MESH TO KUKA|prc PLANES
# 
# Board item FL-01. A mesh goes in, usable planes come out.
# 
# Usable means four things, and all four are measured: every plane is orthonormal, every origin sits on the mesh, every tool axis points into the material, and the tree structure matches the slices.
# note: THE HOTWIRE
# 
# Tool Z / A / B / C are the four numbers from the pendant's CUSTOM TOOL dialog. Type what the pendant says and the simulation matches the cell. The defaults are the real tool: Z 422, A -90, B -90, C 0.
# 
# wireSpan 415.8 is the span MODELLED in Hotwire_2.1.3dm. The usable cutting span is shorter and still has to be measured.
# 
# flipZ approaches from the other side. flipX reverses travel. spinDeg rolls about the approach. tiltDeg only bites when zMode = 0.
# 
# Preview WireLines to see where the wire is, and FlangePts to see where the WRIST has to be - that is the one the reach check measures.
selftest_2 = Panel(c_script.SelfTest)
toolabc = Panel(hotwire.ToolAbc)
status_2 = Panel(hotwire.Status)
# note: A -90 / B -90 / C 0 IS GIMBAL LOCK
# 
# B = +/-90 is the pose where only A+C is determined, so the pendant may read back A 0 / B -90 / C -90 for the very same orientation. Nothing is wrong when that happens.
# note: KUKA|prc CORE
# 
# Drag SIM from 0 to 1 to play the job.
# 
# If CORE reports unreachable or collided poses, the fix is almost always to move the WORK, not the maths - the virtual robot stands at the world origin, so anything you draw near the origin is underneath it. Use the paper / part position sliders.
# 
# To write the .src: right-click CORE, open its settings, set the output directory and file name, then tick the export.
# note: ANALYSIS IS LOCKED - THIS IS DELIBERATE
# 
# It needs a licensed KUKA|prc. On this machine it raises a licence error, so it is switched off rather than left to sit there red.
# 
# On the lab machine: right-click it > Enable. You then get numeric axis values, reachability and singularity per move.
# 
# You do not need it to check reach. CORE itself goes orange or red and says so - read the balloon on the CORE component.
# note: TOOL[4] = WIRE MIDPOINT
# 
# The TCP comes from the HOTWIRE component, not from a slider here, and the tool mesh is the lab's own Hotwire Rev2.1 in flange coordinates.
log_2 = Panel(hotwire.Log)
