# Grasshopper definition TF09_pen_drawing.gh (Grasshopper 1.0.8)
# plug-ins: KUKA|prc - parametric robot control

curves = Curve([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])
penids = Integer([0, 1, 0, 1, 2, 2, 2, 2])
slots = Integer(4)
into_slot = Vector(Vector(0, 0, -1))
# note: MAGAZINE - PLACEHOLDER COORDINATES
# 
# Four slots in a straight row, flat, so the definition solves and you can see the swap logic work. Not one of these numbers has touched hardware.
# 
# Before the robot moves: delete this little chain, put a Plane param here instead, and set it from planes you have actually taught on the cell. See krl/PENSWAP_README.md.
# 
# Whatever you replace it with, keep the convention: a slot plane's Z runs FROM the tool INTO the slot. Get that backwards and the arm is asked to reach the magazine from below.
# 
# THE MAGAZINE DOES NOT MOVE WITH THE BOARD, and that is correct - a magazine is bolted to the cell. But it does mean that if you swing the board round with the board X/Y sliders, you have to bring these three with it or the swap trips are left reaching across the cell.
# 
# Measured: board to the LEFT at 0 / 900 is unreachable with the slots left here, and solves exactly as well as the front once they are put at the matching 90 deg image - slot X0 420, slot Y 380. Rotate (x, y) to (-y, x) and it comes back.
tool_z = Slider(227.8, range=0..600)
tool_a = Slider(0, range=-180..180)
tool_b = Slider(0, range=-180..180)
tool_c = Slider(0, range=-180..180)
penaxis = Slider(2, range=0..2)
board_x = Slider(900, range=-1600..1600)
board_y = Slider(0, range=-1600..1600)
board_z = Slider(450, range=-400..1400)
pt = ConstructPoint(XCoordinate=board_x, YCoordinate=board_y, ZCoordinate=board_z)
board_w = Slider(280, range=50..900)
board_h = Slider(210, range=50..900)
boardorient = Slider(0, range=0..3)
cardinal = Slider(0, range=0..4)
leandeg = Slider(45, range=0..90)
spindeg = Slider(0, range=-180..180)
flipboardz = BooleanToggle(False)
ztorobot = BooleanToggle(True)
reachmax = Slider(1101, range=200..2000)
reachmin = Slider(460, range=0..1000)
penleandeg = Slider(20, range=-45..45)
pentool = CSharpScript(
    toolZ=tool_z,
    toolA=tool_a,
    toolB=tool_b,
    toolC=tool_c,
    penAxis=penaxis,
    boardOrigin=pt,
    boardW=board_w,
    boardH=board_h,
    boardOrient=boardorient,
    cardinal=cardinal,
    leanDeg=leandeg,
    spinDeg=spindeg,
    flipBoardZ=flipboardz,
    zToRobot=ztorobot,
    reachMax=reachmax,
    reachMin=reachmin,
    penLeanDeg=penleandeg)  # -> out, DrawPlane, ToolPlane, ToolAbc, PenLean, Board, Corners, FlangePts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; inputs toolX: Double, toolY: Double, toolZ: Double, toolA: Double, toolB: Double, toolC: Double, penAxis: Int32, boardOrigin: Point3d, boardW: Double, boardH: Double, boardOrient: Int32, cardinal: Int32, leanDeg: Double, spinDeg: Double, flipBoardZ: Boolean, zToRobot: Boolean, robotBase: Plane, reachMax: Double, reachMin: Double, grid: Int32, penLeanDeg: Double
# ---------- pentool: C# usings ----------
// ---------------------------------------------------------------------------
// PEN TOOL - TCP frame from KUKA A/B/C, plus the drawing board's orientation
// PANE: "Usings"  (Rhino 8 C# Script component, top pane)
// ---------------------------------------------------------------------------
using System.Globalization;
using System.Linq;
using System.Text;




// 8 using directive(s) that the C# component already
// declares itself were removed here to keep the component free of
// CS0105 warnings. They are still in the .cs file this came from,
// which is the copy to paste from if you rebuild this by hand.
# ---------- pentool: C# ----------
// ---------------------------------------------------------------------------
// PEN TOOL - TCP frame from KUKA A/B/C, plus the drawing board's orientation
// PANE: "Script" / the main body  (Rhino 8 C# Script component, middle pane)
//
// COMPONENT INPUTS  (name, type hint, access, optional?)   -- build in this order
//    0  toolX        double    item   optional   TCP offset from the flange, mm
//    1  toolY        double    item   optional
//    2  toolZ        double    item   optional   default 227.8 - the pen's length
//    3  toolA        double    item   REQUIRED   the CUSTOM TOOL dialog's Tool A (0)
//    4  toolB        double    item   REQUIRED   the dialog's Tool B (0)
//    5  toolC        double    item   REQUIRED   the dialog's Tool C (0)
//    6  penAxis      int       item   REQUIRED   0 X / 1 Y / 2 Z.  Pen lies on Z.
//
//   WHY 3, 4, 5 AND 6 ARE NOT OPTIONAL
//   Every other number here treats an unwired input - which Grasshopper reads
//   as 0 - as "use the documented default". That cannot work for the angles or
//   the axis index, because 0 is a perfectly good value for all four: A 0 /
//   B 0 / C 0 is the identity orientation, and it happens to be exactly the
//   right answer for this tool. Defaulting them would hide that rather than
//   state it. So they are required and Grasshopper shows "no data" until they
//   are wired, which is the right prompt.
//
//    7  boardOrigin  Point3d   item   optional   centre of the sheet
//    8  boardW       double    item   optional   across the sheet, mm (280)
//    9  boardH       double    item   optional   up the sheet, mm (210)
//   10  boardOrient  int       item   REQUIRED   0 VERTICAL / 1 FLAT / 2 TILTED / 3 AWAY
//   11  cardinal     int       item   REQUIRED   0 AUTO / 1 +X / 2 -X / 3 +Y / 4 -Y
//   12  leanDeg      double    item   optional   only bites when boardOrient = 2
//   13  spinDeg      double    item   optional   roll the sheet in its own plane
//   14  flipBoardZ   bool      item   optional   turn the sheet round by hand
//   15  zToRobot     bool      item   optional   insist the sheet faces the robot
//   16  robotBase    Plane     item   optional   where the robot stands (world XY)
//   17  reachMax     double    item   optional   flange reach, mm (1101)
//   18  reachMin     double    item   optional   inner limit, mm (460)
//   19  grid         int       item   optional   reach samples per side (5)
//   20  penLeanDeg   double    item   optional   pen lean off the paper (20)
//
//   penLeanDeg IS NOT COSMETIC, AND IT IS THE THING THAT BIT
//   It goes straight through to TF-09's tiltDeg, so this component owns the
//   whole orientation story and can check its own advice.
//
//   A sheet standing square-on to the robot has its normal pointing back down
//   the arm's reach line. A pen held perpendicular to that paper is therefore
//   aimed straight at the shoulder, the wrist has to go flat to manage it,
//   axis 4 lines up with axis 6, and the pose is singular no matter how much
//   room there is around it. Measured against prc, board at 900 / 0 / 450:
//
//       lean  0,  5, 10       UNREACHABLE
//       lean 15, 20, 25, 30   clean
//       lean 40               UNREACHABLE - too far the other way
//       lean -20              clean
//
//   Every one of those targets was inside the reach ring. Nothing about the
//   position was wrong; only the attitude. The component warns rather than
//   silently defaulting, because the band is narrow and not obvious.
//
//   boardOrient IS THE ONE TO REACH FOR PER JOB
//   It says how the WORK is hung, and it is the switch because with a pen the
//   TOOL has only one sensible attitude - straight into the paper.
//
//     0 VERTICAL  the sheet stands up on an easel and faces the robot. Its
//                 own blue Z runs back at the arm; the pen comes in the other
//                 way, so the flange sits between the robot and the work.
//                 This is the one the cell actually uses.
//     1 FLAT      the sheet lies on a table, normal straight up. Works, but
//                 its normal is vertical, so nothing about it faces the robot
//                 and zToRobot will say so.
//     2 TILTED    a drafting table. leanDeg 0 is FLAT and 90 is VERTICAL, so
//                 this is the continuum the other two are the ends of.
//     3 AWAY      the sheet turned to face away from the robot. Kept so you
//                 can see what wrong looks like - the arm has to reach round
//                 the back of its own work and the reach check says so.
//
//   THE FRAME CONVENTION, AND WHY IT MATTERS HERE
//   All four modes name their axes the same way:
//       X  across the sheet, left to right
//       Y  up the sheet
//       Z  out of the sheet, towards the reader
//   so the artwork is authored once in world XY and oriented onto whichever
//   board you pick. The drawing does not know how the board is hung.
//
//   WHY THIS COMPONENT IS UPSTREAM OF TF-09
//   TF-09 needs a draw plane before it can build a single target, so a
//   component that derived the board FROM TF-09's targets would be a cycle,
//   and Grasshopper will not run one. The reach check therefore samples a grid
//   over the sheet rather than the finished toolpath - which is the same set
//   of points, since every drawing target lies on the sheet.
//
//   THE DEFAULTS ARE THE REAL TOOL
//   toolZ defaults to 227.8 mm, measured in the lab's own Pen_Tool Rev 008.3dm:
//   mount plate 15 + body 50 + carriage 69, with the pen protruding to a nib
//   227.8 mm from the mounting face. See PN_README.md for the full table.
//
// COMPONENT OUTPUTS  -- build in this order
//    0  out            (the component's own message stream)
//    1  DrawPlane      Plane         -> TF-09's drawPlane, AND the Orient target
//                                       that stands the artwork up with it
//    2  ToolPlane      Plane         -> KUKA|prc "Custom Tool: Plane", TOOL PLANE
//    3  ToolAbc        string        -> the X/Y/Z/A/B/C read back, for the pendant
//    4  PenLean        double        -> wire into TF-09's tiltDeg
//    5  Board          Curve         -> the sheet outline, preview this
//    6  Corners        list<Point3d>
//    7  FlangePts      list<Point3d> -> where the WRIST has to be. Preview this
//                                       against the robot to see reach at a glance.
//    8  PenLines       list<Line>    -> flange to nib, the tool drawn in place
//    9  Approach       Vector3d      -> the cardinal that was chosen
//   10  Status         string
//   11  Log            string
// ---------------------------------------------------------------------------

PenTool.Options opt = new PenTool.Options();

opt.ToolX = toolX;
opt.ToolY = toolY;

// toolZ can use the usual idiom: an unwired input reads 0, and a TCP 0 mm off
// the flange is not a real ask, so 0 safely means "give me the documented one".
opt.ToolZ = toolZ > 0 ? toolZ : 227.8;

// The angles and the axis index cannot do that - 0 is a real value for all
// four - so they are required inputs and are taken exactly as given.
opt.ToolA   = toolA;
opt.ToolB   = toolB;
opt.ToolC   = toolC;
opt.PenAxis = penAxis;

opt.BoardOrigin = boardOrigin.IsValid ? boardOrigin : new Point3d(900, 0, 450);
opt.BoardW      = boardW > 0 ? boardW : 280.0;
opt.BoardH      = boardH > 0 ? boardH : 210.0;

opt.BoardOrient = boardOrient;
opt.Cardinal    = cardinal;
opt.LeanDeg     = leanDeg;
opt.SpinDeg     = spinDeg;
opt.FlipBoardZ  = flipBoardZ;
opt.ZToRobot    = zToRobot;

opt.RobotBase = robotBase.IsValid ? robotBase : Plane.WorldXY;
opt.ReachMax  = reachMax > 0 ? reachMax : 1101.0;
opt.ReachMin  = reachMin > 0 ? reachMin :  460.0;
opt.Grid      = grid     > 1 ? grid     :  5;

// penLeanDeg is the one number where an unwired 0 is BOTH a real value and the
// dangerous one, so it cannot use the usual "0 means default" idiom. Left
// unwired it reads 0, which is exactly the flat-wrist pose prc refuses - so 0
// is taken literally and the component WARNS about it rather than silently
// substituting 20 and hiding the lesson.
opt.PenLeanDeg = penLeanDeg;

PenTool.Result res = PenTool.Build(opt);

DrawPlane = res.DrawPlane;
ToolPlane = res.ToolPlane;
ToolAbc   = res.ToolAbc;
PenLean   = res.PenLean;
Board     = res.Board;
Corners   = res.Corners;
FlangePts = res.FlangePts;
PenLines  = res.PenLines;
Approach  = res.ApproachUsed;
Status    = res.Status;
Log       = res.Log;

if (Component != null)
{
  foreach (string w in res.Warnings)
    Component.AddRuntimeMessage(GH_RuntimeMessageLevel.Warning, w);
}
# ---------- pentool: C# additional code ----------
// ---------------------------------------------------------------------------
// PEN TOOL - TCP frame from KUKA A/B/C, plus the drawing board's orientation
// PANE: "Members" / additional code  (Rhino 8 C# Script component, bottom pane)
//
// WHAT THIS IS FOR
//   The same two jobs the HOTWIRE component does for FL-01, done for TF-09:
//
//   1. Turn the numbers typed into the KUKA CUSTOM TOOL dialog - X, Y, Z, A, B,
//      C - into the Plane that KUKA|prc's "Custom Tool: Plane" wants.
//
//   2. Decide which way the WORK faces, with a switch rather than a code edit,
//      and prove the arm can reach it before anything moves.
//
//   The difference from the hotwire is which end the switch acts on. A hotwire
//   cuts with a LINE, so the question was how to lay the tool. A pen draws with
//   a POINT, so the tool has only one sensible attitude - straight into the
//   paper - and the interesting question moves to the BOARD. That is why this
//   component is upstream of TF-09 and the hotwire one is downstream of FL-01.
//
//   It also has to be upstream. TF-09 needs a draw plane before it can build a
//   single target, so a component that produced the draw plane FROM TF-09's
//   targets would be a cycle, and Grasshopper will not run a cycle. The reach
//   check therefore measures a grid over the board rather than the finished
//   toolpath - which is the same set of points, since every drawing target
//   lies on the board.
//
// WHY THE BOARD STANDS UP AND FACES THE ROBOT
//   With the pen on tool Z, the flange sits one whole tool length BACK along
//   the target's Z. The target's Z runs into the paper. So the flange is always
//   on the near side of the sheet, between the robot and the work - which is
//   the only arrangement where the arm can reach past its own tool.
//
//   Read the other way round: the BOARD's own normal is what points back at
//   the robot. That is the blue axis you see on the board in Rhino, and
//   boardOrient 0 is what puts it there.
//
// MEASURED, NOT ASSUMED
//   The tool dimensions come from the lab's own
//     End-Effector Development/Drawing/Pen_Tool Rev 008.3dm
//   read directly. See PN_README.md for the measurement table and for the one
//   thing in it that is a DEFINITION rather than a measurement - where the
//   flange face sits, which that file does not record because it is a bench
//   layout rather than a flange-referenced model.
// ---------------------------------------------------------------------------

public static class PenTool
{
  private const double EPS = 1e-12;

  // =========================================================================
  // 0.  CONTAINERS
  // =========================================================================

  public class Options
  {
    // --- the TCP, straight off the CUSTOM TOOL dialog ---
    //
    // 227.8 is the pen tool's own length along its axis, measured in
    // Pen_Tool Rev 008.3dm: mount plate 15 + body 50 + carriage 69, with the
    // pen protruding to a tip 227.8 mm from the mounting face.
    //
    // A/B/C are all zero because the pen runs straight out along the flange
    // axis. Unlike the hotwire - whose wire is a crossbar and needs
    // A -90 / B -90 / C 0 to describe it - a pen has nothing to twist.
    public double ToolX = 0.0;
    public double ToolY = 0.0;
    public double ToolZ = 227.8;
    public double ToolA = 0.0;
    public double ToolB = 0.0;
    public double ToolC = 0.0;

    // Which axis of the tool frame the pen runs along. 2 = Z, which is what
    // A 0 / B 0 / C 0 gives, and what TF-09's own frame convention expects:
    // the target's Z runs down the pen, from the holder into the paper.
    public int PenAxis = 2;

    // --- where the work is ---
    public Point3d BoardOrigin = new Point3d(900, 0, 450);
    public double BoardW = 280.0;   // across the sheet
    public double BoardH = 210.0;   // up the sheet

    // --- HOW THE BOARD IS HUNG ------------------------------------------
    //
    // 0 VERTICAL  standing up, normal horizontal, facing back at the robot.
    //             The sheet is on an easel and the pen draws on it sideways.
    // 1 FLAT      lying on a table, normal straight up. The old behaviour.
    // 2 TILTED    a drafting table: leanDeg from flat towards vertical.
    //             0 is FLAT and 90 is VERTICAL, so this is the continuum the
    //             other two are the ends of.
    // 3 AWAY      normal along the cardinal, i.e. the sheet turned to face
    //             AWAY from the robot. Kept because being able to see the
    //             wrong one is how you come to trust the right one - the arm
    //             has to reach round the back of its own work, and the reach
    //             check says so.
    //
    // VERTICAL is the default because it is what the cell actually does, and
    // because it is the only one of the four where the board's own Z points
    // at the robot.
    public int BoardOrient = 0;

    // 0 AUTO  from where the board sits relative to the robot
    // 1..4    +X / -X / +Y / -Y, forced by hand
    //
    // AUTO reads the board's own position: in front of the robot is +X,
    // behind is -X, either side is +/-Y. Drag the board sliders and the board
    // turns to keep facing the arm.
    public int Cardinal = 0;

    public double LeanDeg = 45.0;   // only bites when BoardOrient = 2
    public double SpinDeg = 0.0;    // roll the sheet in its own plane
    public bool FlipBoardZ = false; // turn the sheet round

    // --- HOW FAR THE PEN LEANS OFF THE PAPER --------------------------
    //
    // Wired straight through to TF-09's tiltDeg, so one component owns the
    // whole orientation story and can check its own advice.
    //
    // 20 degrees, and it is NOT cosmetic. A sheet that stands up facing the
    // robot is square-on to the arm, so a pen held perpendicular to it points
    // straight back down the arm's own reach line - the wrist goes flat and
    // axis 4 lines up with axis 6. Measured against KUKA|prc, board at
    // 900 / 0 / 450:
    //
    //     lean  0  5  10        UNREACHABLE
    //     lean 15 20 25 30      clean
    //     lean 40               UNREACHABLE  (too far the other way)
    //     lean -20              clean
    //
    // A ten-degree lean is not enough and forty is too much; the band is
    // roughly 15 to 30 either side of square, and 20 sits in the middle of it.
    //
    // It is also what a hand does. Nobody draws with the pen dead
    // perpendicular to the paper.
    public double PenLeanDeg = 20.0;

    // Insist the board's normal faces the robot, and SAY SO when it cannot.
    //
    // On boardOrient 0 it is already true and this changes nothing. On 1 FLAT
    // the normal is vertical and there is no horizontal component to turn, so
    // it refuses and explains. On 3 AWAY it flips the sheet back, and reports
    // that it overrode you.
    public bool ZToRobot = true;

    public Plane RobotBase = Plane.WorldXY;

    // The envelope is a RING, not a maximum.
    //
    // 1101 mm is the KR6-10 R1100-2's flange reach. The inner wall is a
    // property of the ROBOT, not of the tool - the arm cannot fold the flange
    // into its own body - so the 460 mm measured for the hotwire cell applies
    // here too, and is the default.
    //
    // What the tool changes is how far the WORK can be for a given flange
    // position. The pen reaches 227.8 mm ahead of the wrist against the
    // hotwire's 422, so the whole usable band for the WORK sits about 194 mm
    // closer in. That is the number to remember when swapping tools.
    public double ReachMax = 1101.0;
    public double ReachMin = 460.0;

    // How finely the board is sampled for the reach check. 5 x 5 is enough:
    // the flange positions are a rigid copy of the board, so the extremes are
    // at the corners and the grid is only there to catch the inner wall.
    public int Grid = 5;
  }

  public class Result
  {
    public Plane DrawPlane = Plane.Unset;
    public Plane ToolPlane = Plane.Unset;
    public string ToolAbc = "";
    public double PenLean = 0.0;
    public Curve Board = null;
    public List<Point3d> Corners = new List<Point3d>();
    public List<Point3d> FlangePts = new List<Point3d>();
    public List<Line> PenLines = new List<Line>();
    public Vector3d ApproachUsed = Vector3d.Unset;
    public int OutOfReach = 0;
    public double ReachNear = 0.0, ReachFar = 0.0;
    public string Status = "";
    public string Log = "";
    public List<string> Warnings = new List<string>();
  }

  // =========================================================================
  // 1.  ENTRY POINT
  // =========================================================================

  public static Result Build(Options o)
  {
    Result r = new Result();
    StringBuilder log = new StringBuilder();

    if (o == null) o = new Options();
    if (o.PenAxis < 0 || o.PenAxis > 2) o.PenAxis = 2;
    if (o.BoardW <= 0.0) o.BoardW = 280.0;
    if (o.BoardH <= 0.0) o.BoardH = 210.0;
    if (o.Grid < 2) o.Grid = 2;

    // ---- 1. the tool frame -------------------------------------------------
    Plane tool = AbcToPlane(new Point3d(o.ToolX, o.ToolY, o.ToolZ), o.ToolA, o.ToolB, o.ToolC);
    r.ToolPlane = tool;
    r.PenLean = o.PenLeanDeg;

    double a, b, c;
    PlaneToAbc(tool, out a, out b, out c);
    r.ToolAbc = "X " + F(o.ToolX) + "   Y " + F(o.ToolY) + "   Z " + F(o.ToolZ) +
                "   A " + F(a) + "   B " + F(b) + "   C " + F(c);

    log.AppendLine("TOOL     " + r.ToolAbc);
    log.AppendLine("         pen runs along the tool's " + AxisName(o.PenAxis) +
                   " axis " + V(AxisOf(tool, o.PenAxis)));
    log.AppendLine("         TCP is the NIB. " + F(o.ToolZ) + " mm from the flange face, so the");
    log.AppendLine("         flange always sits that far BACK along the target's Z - between");
    log.AppendLine("         the robot and the paper, which is the only way it reaches.");

    // ---- 2. which way does the board face ---------------------------------
    Vector3d card = (o.Cardinal == 0) ? AutoCardinal(o.BoardOrigin, o.RobotBase)
                                      : CardinalOf(o.Cardinal);
    r.ApproachUsed = card;
    log.AppendLine("CARDINAL " + (o.Cardinal == 0 ? "AUTO -> " : "forced ") + V(card) +
                   "   (" + CardinalName(card) + ")");
    log.AppendLine("BOARD    " + BoardName(o.BoardOrient) +
                   (o.BoardOrient == 2 ? "   lean " + F(o.LeanDeg) + " deg" : ""));

    Plane board = BuildBoard(o, card, r, log);
    r.DrawPlane = board;

    log.AppendLine("         origin " + P(board.Origin));
    log.AppendLine("         X " + V(board.XAxis) + "   across the sheet");
    log.AppendLine("         Y " + V(board.YAxis) + "   up the sheet");
    log.AppendLine("         Z " + V(board.ZAxis) + "   OUT of the sheet - this is the one");
    log.AppendLine("           that should point at the robot. The pen goes the other way.");

    // ---- 3. the sheet itself ----------------------------------------------
    Rectangle3d rect = new Rectangle3d(board,
      new Interval(-o.BoardW * 0.5, o.BoardW * 0.5),
      new Interval(-o.BoardH * 0.5, o.BoardH * 0.5));
    r.Board = rect.ToNurbsCurve();
    for (int i = 0; i < 4; i++) r.Corners.Add(rect.Corner(i));

    ZReport(r, o, log);
    WristCheck(r, o, board, log);
    DeadZone(o, r, log);
    Reach(r, o, board, log);

    r.Status = (r.Warnings.Count == 0 ? "OK: " : "OK WITH WARNINGS: ") +
               BoardName(o.BoardOrient) + ", " + F(o.BoardW) + " x " + F(o.BoardH) +
               " mm, pen " + F(o.ToolZ) + " mm off the flange, flange " +
               r.ReachNear.ToString("0") + " .. " + r.ReachFar.ToString("0") + " mm" +
               (r.OutOfReach > 0 ? ", " + r.OutOfReach + " SAMPLE(S) OUT OF REACH"
                                 : ", the whole sheet is in reach");
    r.Log = log.ToString();
    return r;
  }

  // =========================================================================
  // 2.  BUILDING THE BOARD
  //
  //     All four modes name their axes the same way, which is what lets the
  //     artwork be authored once in world XY and oriented onto whichever one
  //     you pick:
  //
  //       X  across the sheet, left to right
  //       Y  up the sheet
  //       Z  out of the sheet, towards the reader - and, in mode 0, towards
  //          the robot
  //
  //     Keep that and a drawing does not know or care how the board is hung.
  // =========================================================================

  private static Plane BuildBoard(Options o, Vector3d card, Result r, StringBuilder log)
  {
    Vector3d c = card;
    if (!c.Unitize()) c = Vector3d.XAxis;

    Vector3d z, x;

    switch (o.BoardOrient)
    {
      case 1:                                   // FLAT on a table
        z = Vector3d.ZAxis;
        // Travel runs away from the robot, so the drawing reads the right way
        // up when you stand where the arm stands.
        x = Vector3d.CrossProduct(Vector3d.ZAxis, c);
        if (!x.Unitize()) x = Vector3d.XAxis;
        break;

      case 2:                                   // TILTED - a drafting table
      {
        // Start flat and tip the top edge back towards the robot. The hinge is
        // the horizontal edge, which is the axis across the cardinal.
        Vector3d hinge = Vector3d.CrossProduct(Vector3d.ZAxis, c);
        if (!hinge.Unitize()) hinge = Vector3d.YAxis;
        Plane flat = new Plane(o.BoardOrigin, hinge, Vector3d.CrossProduct(Vector3d.ZAxis, hinge));
        flat.Rotate(RhinoMath.ToRadians(-o.LeanDeg), hinge, o.BoardOrigin);
        z = flat.ZAxis;
        x = flat.XAxis;
        break;
      }

      case 3:                                   // AWAY - the wrong one
        z = c;
        x = Vector3d.CrossProduct(Vector3d.ZAxis, c);
        if (!x.Unitize()) x = Vector3d.XAxis;
        break;

      default:                                  // 0 VERTICAL, facing the robot
        // The sheet stands up, so "up the sheet" is world up and the normal is
        // horizontal, pointing back down the cardinal at the arm.
        z = -c;
        x = Vector3d.CrossProduct(Vector3d.ZAxis, z);
        if (!x.Unitize()) x = Vector3d.XAxis;
        break;
    }

    Vector3d y = Vector3d.CrossProduct(z, x);
    if (!y.Unitize()) y = AnyPerp(z);

    Plane p = new Plane(o.BoardOrigin, x, y);
    if (!p.IsValid) p = new Plane(o.BoardOrigin, Vector3d.XAxis, Vector3d.YAxis);

    if (o.FlipBoardZ) p = new Plane(p.Origin, p.XAxis, -p.YAxis);
    if (Math.Abs(o.SpinDeg) > EPS) p.Rotate(RhinoMath.ToRadians(o.SpinDeg), p.ZAxis, p.Origin);

    // ---- turn the sheet to face the robot, if that is even possible ----
    if (o.ZToRobot)
    {
      Vector3d flat = o.RobotBase.Origin - p.Origin;
      flat.Z = 0.0;
      if (flat.Unitize() && (p.ZAxis * flat) < 0.0)
      {
        p = new Plane(p.Origin, p.XAxis, -p.YAxis);
        log.AppendLine("zToRobot TURNED THE SHEET ROUND - its normal was facing away.");
      }
    }
    return p;
  }

  // =========================================================================
  // 2b. DID zToRobot ACTUALLY MANAGE IT
  //
  //     Worth measuring rather than assuming. A board lying FLAT has a
  //     vertical normal and no horizontal component at all, so there is
  //     nothing to turn - and reporting success there would be the same bug
  //     the hotwire component had, where a Z pointing at the floor scored well
  //     against a robot base that is also on the floor.
  //
  //     Measured horizontally, for exactly that reason.
  // =========================================================================

  private static void ZReport(Result r, Options o, StringBuilder log)
  {
    Plane p = r.DrawPlane;
    Vector3d flat = o.RobotBase.Origin - p.Origin;
    flat.Z = 0.0;

    double vertical = Math.Abs(p.ZAxis.Z);
    double dot = flat.Unitize() ? (p.ZAxis * flat) : 0.0;

    log.AppendLine("BOARD Z  faces the robot " + dot.ToString("0.00") +
                   "   (1.00 = straight at it, 0 = side on, -1 = away;  the normal is " +
                   (100.0 * vertical).ToString("0") + "% vertical)");

    if (!o.ZToRobot) return;

    if (dot > 0.9)
    {
      log.AppendLine("  OK   the sheet's blue Z runs back at the arm. The pen comes in " +
                     "along the other way, which is what puts the flange between the " +
                     "robot and the work.");
    }
    else if (dot > 0.1)
    {
      log.AppendLine("  OK   the sheet is angled towards the robot rather than square on.");
    }
    else
    {
      string m = "zToRobot is on but the sheet's normal cannot be turned to face the " +
                 "robot - it is " + (100.0 * vertical).ToString("0") + "% vertical. A board " +
                 "lying FLAT has no horizontal component to turn. Set boardOrient to 0 for " +
                 "a sheet that stands up and faces the arm, or 2 with a lean to meet it " +
                 "part way.";
      r.Warnings.Add(m);
      log.AppendLine("  !! " + m);
    }
  }

  // =========================================================================
  // 2bb. IS THE WRIST GOING TO GO FLAT
  //
  //      The failure this catches is invisible in the geometry and cost a
  //      full afternoon to find, so it is worth stating plainly.
  //
  //      Every target in the job sat comfortably inside the reach ring -
  //      flange 681 to 832 mm against a 460 to 1101 ring - and KUKA|prc still
  //      refused the whole thing. Moving the board nearer, further, higher,
  //      sideways and swinging the magazine round the cell changed nothing.
  //      The same job with the board lying FLAT solved instantly.
  //
  //      The difference is not where the tool is, it is which way it points.
  //      A sheet standing square-on to the robot has its normal pointing back
  //      down the arm's own reach line, so a pen held perpendicular to the
  //      paper is aimed straight back at the shoulder. The wrist has to go
  //      flat to do that, axis 4 lines up with axis 6, and the pose is
  //      singular however much room there is around it.
  //
  //      Lean the pen and the wrist has something to bend around. Measured
  //      against prc, board at 900 / 0 / 450:
  //
  //          lean  0,  5, 10       UNREACHABLE
  //          lean 15, 20, 25, 30   clean
  //          lean 40               UNREACHABLE - too far the other way
  //          lean -20              clean
  //
  //      Hence the warning below rather than a silent default: the number
  //      matters, it has a band, and the band is not obvious.
  // =========================================================================

  private static void WristCheck(Result r, Options o, Plane board, StringBuilder log)
  {
    // How square-on is the sheet to the arm? The pen axis is the board's
    // normal reversed, and the reach line is the direction from the robot to
    // the work. Parallel means the pen is aimed back down the arm.
    Vector3d pen = -board.ZAxis;
    Vector3d reach = board.Origin - o.RobotBase.Origin;
    if (!reach.Unitize()) return;

    double cos = pen * reach;
    if (cos > 1.0) cos = 1.0;
    if (cos < -1.0) cos = -1.0;
    double offAxis = RhinoMath.ToDegrees(Math.Acos(Math.Abs(cos)));

    double lean = Math.Abs(o.PenLeanDeg);

    log.AppendLine("WRIST    the sheet is " + offAxis.ToString("0") +
                   " deg off square to the arm's reach line, pen leaning " +
                   F(o.PenLeanDeg) + " deg");

    // Square-on and no lean is the singular case. 25 deg of slack on the
    // squareness because the strokes wander over a 280 x 210 sheet and the
    // reach line is measured to its centre.
    bool squareOn = offAxis < 25.0;

    if (squareOn && lean < 12.0)
    {
      string m = "The sheet is nearly square-on to the robot and the pen is only leaning " +
                 F(o.PenLeanDeg) + " deg, so the tool points back down the arm's own reach " +
                 "line and the wrist has to go flat - axis 4 lines up with axis 6 and the " +
                 "pose is singular. KUKA|prc will refuse the job even though every target " +
                 "is well inside the reach ring. Measured band on this cell: 15 to 30 deg " +
                 "of lean solves, 0 to 10 does not, and 40 is too far the other way. " +
                 "20 is the shipped value.";
      r.Warnings.Add(m);
      log.AppendLine("  !! " + m);
    }
    else if (squareOn && lean > 35.0)
    {
      string m = "The pen is leaning " + F(o.PenLeanDeg) + " deg. Measured on this cell, " +
                 "40 deg puts the wrist out the other side and prc refuses again. Stay " +
                 "between 15 and 30.";
      r.Warnings.Add(m);
      log.AppendLine("  !! " + m);
    }
    else if (squareOn)
    {
      log.AppendLine("  OK   the pen leans far enough off the reach line for the wrist to " +
                     "have something to bend around.");
    }
    else
    {
      log.AppendLine("  OK   the sheet is angled to the arm, so the wrist is not being asked " +
                     "to go flat in the first place.");
    }
  }

  // =========================================================================
  // 2c. WHICH WAY IS THE WORK FROM THE ROBOT
  //
  //     Same rule as the hotwire component, and deliberately the same code
  //     shape: whichever of +X, -X, +Y, -Y points from the robot towards the
  //     work, taken horizontally. Coming at a board from straight above is a
  //     different kind of job and not what this switch is for.
  // =========================================================================

  private static Vector3d AutoCardinal(Point3d work, Plane robotBase)
  {
    Vector3d v = new Vector3d(work.X - robotBase.Origin.X, work.Y - robotBase.Origin.Y, 0.0);
    if (!v.Unitize()) return Vector3d.XAxis;

    return Math.Abs(v.X) >= Math.Abs(v.Y)
         ? (v.X >= 0 ? Vector3d.XAxis : -Vector3d.XAxis)
         : (v.Y >= 0 ? Vector3d.YAxis : -Vector3d.YAxis);
  }

  /// The blind spot directly behind the robot. Axis 1 cannot wrap the whole
  /// way round, so a wedge roughly 175-185 deg astern is unreachable at any
  /// orientation - swept against KUKA|prc in this cell. Ten degrees wide, and
  /// easy to sit work in by accident because nothing about it looks wrong.
  private static void DeadZone(Options o, Result r, StringBuilder log)
  {
    double dx = o.BoardOrigin.X - o.RobotBase.Origin.X;
    double dy = o.BoardOrigin.Y - o.RobotBase.Origin.Y;
    if (Math.Abs(dx) < EPS && Math.Abs(dy) < EPS) return;

    double bearing = RhinoMath.ToDegrees(Math.Atan2(dy, dx));
    double behind = 180.0 - Math.Abs(bearing);

    log.AppendLine("BEARING  board sits " + bearing.ToString("0") +
                   " deg round from the front of the robot");

    if (behind <= 10.0)
    {
      string m = "The board is " + behind.ToString("0") + " deg from DIRECTLY BEHIND the " +
                 "robot. Axis 1 cannot wrap that far, so there is a blind wedge roughly " +
                 "175-185 deg that no orientation reaches. Swing the board 15-20 deg to " +
                 "either side and it comes back.";
      r.Warnings.Add(m);
      log.AppendLine("  !! " + m);
    }
  }

  // =========================================================================
  // 3.  CAN THE ARM REACH THE WHOLE SHEET
  //
  //     Measuring the distance to the PAPER is the wrong test, and it is the
  //     one everybody does first. The robot's 1101 mm is the reach of its
  //     FLANGE, and the flange is a whole tool length away from the nib.
  //
  //     The TCP offset is read out of the tool plane's own basis, so this stays
  //     correct if the tool is re-taught with different A/B/C.
  // =========================================================================

  private static void Reach(Result r, Options o, Plane board, StringBuilder log)
  {
    Plane tool = r.ToolPlane;
    Vector3d off = new Vector3d(tool.Origin);
    double a = off * tool.XAxis, b = off * tool.YAxis, c = off * tool.ZAxis;

    double far = 0.0, near = double.MaxValue;
    int over = 0, under = 0, n = 0;

    for (int i = 0; i < o.Grid; i++)
      for (int j = 0; j < o.Grid; j++)
      {
        double u = -o.BoardW * 0.5 + o.BoardW * i / (o.Grid - 1);
        double v = -o.BoardH * 0.5 + o.BoardH * j / (o.Grid - 1);
        Point3d pt = board.PointAt(u, v);

        // The target frame TF-09 will build here: Z runs down the pen, INTO
        // the paper, so it is the board's normal reversed. X is the travel
        // direction and does not affect reach with a TCP that is purely along
        // the tool's own axis - but it is built properly anyway, so the sum
        // below stays right if someone teaches a tool with X or Y offsets.
        Plane t = new Plane(pt, board.XAxis, -board.YAxis);   // Z = -board Z

        Point3d flange = t.Origin - (a * t.XAxis + b * t.YAxis + c * t.ZAxis);
        r.FlangePts.Add(flange);
        r.PenLines.Add(new Line(flange, pt));

        double d = flange.DistanceTo(o.RobotBase.Origin);
        if (d > far) far = d;
        if (d < near) near = d;
        if (d > o.ReachMax) over++;
        if (d < o.ReachMin) under++;
        n++;
      }

    r.OutOfReach = over + under;
    r.ReachNear = near;
    r.ReachFar = far;

    log.AppendLine("REACH    flange " + near.ToString("0") + " .. " + far.ToString("0") +
                   " mm from the robot base, over " + n + " samples on the sheet");
    log.AppendLine("         working ring is " + o.ReachMin.ToString("0") + " .. " +
                   o.ReachMax.ToString("0") + " mm. It is a RING - the flange sits " +
                   F(o.ToolZ) + " mm back from the nib, so a sheet that is too CLOSE " +
                   "fails as surely as one too far.");

    if (over > 0)
    {
      string m = over + " of " + n + " samples put the FLANGE beyond " +
                 o.ReachMax.ToString("0") + " mm - worst " + far.ToString("0") +
                 " mm. The arm cannot stretch that far. Move the board TOWARDS the robot.";
      r.Warnings.Add(m);
      log.AppendLine("  !! " + m);
    }
    if (under > 0)
    {
      string m = under + " of " + n + " samples put the FLANGE inside " +
                 o.ReachMin.ToString("0") + " mm - closest " + near.ToString("0") +
                 " mm. The arm would have to fold into its own body. Move the board " +
                 "AWAY from the robot - counter-intuitive, but the pen reaches " +
                 F(o.ToolZ) + " mm ahead of the wrist.";
      r.Warnings.Add(m);
      log.AppendLine("  !! " + m);
    }
    if (over == 0 && under == 0)
      log.AppendLine("  OK   every point on the sheet sits inside the working ring.");
  }

  // =========================================================================
  // 4.  NAMES
  // =========================================================================

  private static Vector3d CardinalOf(int mode)
  {
    if (mode == 1) return Vector3d.XAxis;
    if (mode == 2) return -Vector3d.XAxis;
    if (mode == 3) return Vector3d.YAxis;
    if (mode == 4) return -Vector3d.YAxis;
    return Vector3d.XAxis;
  }

  private static string CardinalName(Vector3d v)
  {
    if (Math.Abs(v.X) > 0.5) return v.X > 0 ? "+X, out in front of the robot" : "-X, behind the robot";
    if (Math.Abs(v.Y) > 0.5) return v.Y > 0 ? "+Y, to the left" : "-Y, to the right";
    return "off-axis";
  }

  private static string BoardName(int m)
  {
    if (m == 1) return "FLAT - lying on a table, normal straight up";
    if (m == 2) return "TILTED - a drafting table leaning back towards the robot";
    if (m == 3) return "AWAY - turned to face away from the robot, which is the wrong one";
    return "VERTICAL - standing up, facing the robot";
  }

  private static Vector3d AnyPerp(Vector3d v)
  {
    Vector3d a = Math.Abs(v.Z) < 0.9 ? Vector3d.ZAxis : Vector3d.XAxis;
    Vector3d p = Vector3d.CrossProduct(v, a);
    p.Unitize();
    return p;
  }

  private static Vector3d AxisOf(Plane p, int axis)
  {
    if (axis == 0) return p.XAxis;
    if (axis == 1) return p.YAxis;
    return p.ZAxis;
  }

  private static string AxisName(int axis)
  {
    if (axis == 0) return "X";
    if (axis == 1) return "Y";
    return "Z";
  }

  // =========================================================================
  // 5.  KUKA A/B/C
  //
  //     Z-Y'-X'' intrinsic, so R = Rz(A) . Ry(B) . Rx(C). Same convention and
  //     the same gimbal-lock branch as TF09_helpers.cs, FL01_helpers.cs and
  //     HW_helpers.cs - deliberately duplicated rather than shared, because a
  //     Grasshopper script component has to stand on its own in one canvas.
  // =========================================================================

  public static Plane AbcToPlane(Point3d origin, double A, double B, double C)
  {
    double a = RhinoMath.ToRadians(A), b = RhinoMath.ToRadians(B), c = RhinoMath.ToRadians(C);
    double ca = Math.Cos(a), sa = Math.Sin(a);
    double cb = Math.Cos(b), sb = Math.Sin(b);
    double cc = Math.Cos(c), sc = Math.Sin(c);

    Vector3d X = new Vector3d(ca * cb, sa * cb, -sb);
    Vector3d Y = new Vector3d(ca * sb * sc - sa * cc, sa * sb * sc + ca * cc, cb * sc);
    return new Plane(origin, X, Y);
  }

  public static void PlaneToAbc(Plane p, out double A, out double B, out double C)
  {
    Vector3d X = p.XAxis; X.Unitize();
    Vector3d Y = p.YAxis; Y.Unitize();
    Vector3d Z = p.ZAxis; Z.Unitize();

    double r00 = X.X, r10 = X.Y, r20 = X.Z;
    double r01 = Y.X, r11 = Y.Y, r21 = Y.Z;
    double r22 = Z.Z;

    double sB = -r20;
    if (sB > 1.0) sB = 1.0;
    if (sB < -1.0) sB = -1.0;

    if (Math.Abs(sB) > 1.0 - 1e-10)
    {
      B = sB > 0 ? 90.0 : -90.0;
      A = 0.0;
      C = sB > 0 ? RhinoMath.ToDegrees(Math.Atan2(r01, r11))
                 : RhinoMath.ToDegrees(Math.Atan2(-r01, r11));
      return;
    }

    B = RhinoMath.ToDegrees(Math.Asin(sB));
    A = RhinoMath.ToDegrees(Math.Atan2(r10, r00));
    C = RhinoMath.ToDegrees(Math.Atan2(r21, r22));
  }

  // =========================================================================
  // 6.  ODDS AND ENDS
  // =========================================================================

  private static string F(double d)
  { return d.ToString("0.###", CultureInfo.InvariantCulture); }

  private static string V(Vector3d v)
  {
    CultureInfo inv = CultureInfo.InvariantCulture;
    return "(" + v.X.ToString("0.##", inv) + ", " + v.Y.ToString("0.##", inv) +
           ", " + v.Z.ToString("0.##", inv) + ")";
  }

  private static string P(Point3d p)
  {
    CultureInfo inv = CultureInfo.InvariantCulture;
    return "(" + p.X.ToString("0.#", inv) + ", " + p.Y.ToString("0.#", inv) +
           ", " + p.Z.ToString("0.#", inv) + ")";
  }
}
# ---------- end pentool ----------
xy = XYPlane(Origin=Point(0, 0, 0))
orient = Orient(Geometry=curves, Source=xy, Target=pentool.DrawPlane)  # -> Geometry, Transform
slot_x0 = Slider(380, range=-1000..1000)
slot_pitch = Slider(80, range=20..200)
slot_y = Slider(-420, range=-1000..1000)
series = Series(Start=slot_x0, Step=slot_pitch, Count=slots)
slot_z = Slider(150, range=-500..1000)
pt_2 = ConstructPoint(XCoordinate=series, YCoordinate=slot_y, ZCoordinate=slot_z)
pl = PlaneNormal(Origin=pt_2, ZAxis=into_slot)
leadin = Slider(5, range=0..50)
leadout = Slider(5, range=0..50)
hover = Slider(30, range=5..100)
resolution = Slider(0.5, range=0.1..5)
optimize = BooleanToggle(True)
groupbypen = BooleanToggle(True)
startindex = Slider(0, range=0..200)
liverun = BooleanToggle(False)
feeddraw = Slider(100, range=5..200)
feedrapid = Slider(500, range=50..800)
swapseconds = Slider(25, range=5..90)
selftest = BooleanToggle(False)
pressdepth = Slider(3, range=0..10)
baseindex = Slider(1, range=1..4)
magbaseindex = Slider(1, range=1..4)
# note: liveRun is OFF, so this is a DRY RUN: the pen is held one lift height clear of the paper the whole way. Turn it on only when the paper, the pen and the base are all real and taught.
# note: THE DEFAULTS ARE THE END-EFFECTOR SPEC
# 
# draw 100 mm/s  ·  air 500 mm/s  ·  lift 30 mm  ·  press 3 mm
# BASE[1] worktable centre  ·  BASE[2] large-format shift
# 
# Straight out of the Key parameters table in end-effectors/01-drawing/README.md. Unwire any slider and you get the documented number back.
# note: THE PEN TOOL
# 
# Tool Z / A / B / C are the four numbers from the pendant's CUSTOM TOOL dialog. Type what the pendant says and the simulation matches the cell.
# 
# The defaults are the real tool, measured in the lab's own Pen_Tool Rev 008.3dm: nib 227.8 mm off the flange face, and A / B / C all ZERO because a pen runs straight out along the flange axis and has nothing to twist. That is the whole difference from the hotwire, whose crossbar needs A -90 / B -90 / C 0 to describe it.
# 
# Rev 008 is a bench layout rather than a flange-referenced model, so the tool is REBUILT from its dimensions instead of lifted whole. Which face is the flange face is a definition, not a measurement - see 07_pen_tool/PN_README.md.
jobname = Panel("DRAW_JOB")
c_script = CSharpScript(
    curves=orient.Geometry,
    penIds=penids,
    drawPlane=pentool.DrawPlane,
    slotPlanes=pl,
    leadIn=leadin,
    leadOut=leadout,
    hover=hover,
    tiltDeg=pentool.PenLean,
    resolution=resolution,
    optimize=optimize,
    groupByPen=groupbypen,
    startIndex=startindex,
    liveRun=liverun,
    feedDraw=feeddraw,
    feedRapid=feedrapid,
    swapSeconds=swapseconds,
    jobName=jobname,
    selfTest=selftest,
    pressDepth=pressdepth,
    baseIndex=baseindex,
    magBaseIndex=magbaseindex)  # -> out, Targets, MoveTypes, Flat, FlatMoves, PenSequence, StrokeOrder, OrderedCurves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; "TF-09"; inputs curves: list of Curve, penIds: list of Int32, drawPlane: Plane, drawGeo: GeometryBase, slotPlanes: list of Plane, slotTools: list of Int32, homePlane: Plane, leadIn: Double, leadOut: Double, hover: Double, tiltDeg: Double, resolution: Double, optimize: Boolean, groupByPen: Boolean, startIndex: Int32, liveRun: Boolean, feedDraw: Double, feedRapid: Double, swapSeconds: Double, jobName: String, selfTest: Boolean, pressDepth: Double, baseIndex: Int32, magBaseIndex: Int32
# ---------- c_script: C# usings ----------
// ---------------------------------------------------------------------------
// TF-09  Pen-switching loop - Grasshopper front end
// PANE: "Usings"  (Rhino 8 C# Script component, top pane)
// ---------------------------------------------------------------------------
using System.Globalization;
using System.Linq;
using System.Text;




// 8 using directive(s) that the C# component already
// declares itself were removed here to keep the component free of
// CS0105 warnings. They are still in the .cs file this came from,
// which is the copy to paste from if you rebuild this by hand.
# ---------- c_script: C# ----------
// ---------------------------------------------------------------------------
// TF-09  Pen-switching loop - Grasshopper front end
// PANE: "Script" / the main body  (Rhino 8 C# Script component, middle pane)
//
// COMPONENT INPUTS  (name, type hint, access, optional?)   -- build in this order
//    0  curves       Curve         list   REQUIRED   the strokes to draw
//    1  penIds       int           list   optional   one pen number per curve
//    2  drawPlane    Plane         item   REQUIRED   the plane of the paper
//    3  drawGeo      Geometry Base item   optional   curved sheet to follow instead
//    4  slotPlanes   Plane         list   REQUIRED   one plane per magazine slot
//    5  slotTools    int           list   optional   KUKA TOOL number per slot
//    6  homePlane    Plane         item   optional   where the arm starts and ends
//    7  leadIn       double        item   optional   pen-down approach, mm
//    8  leadOut      double        item   optional   pen-up retract, mm
//    9  hover        double        item   optional   travel clearance, mm
//   10  tiltDeg      double        item   optional   pen lean
//   11  resolution   double        item   optional   curve -> polyline chord tol, mm
//   12  optimize     bool          item   REQUIRED   reorder + flip for least travel
//   13  groupByPen   bool          item   REQUIRED   finish a pen before changing it
//   14  startIndex   int           item   optional   resume from this stroke
//   15  liveRun      bool          item   optional   OFF = dry run. See the note below.
//   16  feedDraw     double        item   optional   mm/s on the paper
//   17  feedRapid    double        item   optional   mm/s in the air
//   18  swapSeconds  double        item   optional   measured cost of one swap
//   19  jobName      string        item   optional   name of the generated .src
//   20  selfTest     bool          item   optional   run the orientation proof
//   21  pressDepth   double        item   optional   Z press offset, mm (default 3)
//   22  baseIndex    int           item   optional   KUKA BASE[] of the paper (default 1)
//   23  magBaseIndex int           item   optional   KUKA BASE[] of the magazine (default 1)
//
//   21-23 are appended rather than inserted so that a canvas built against the
//   earlier input list keeps working - the existing numbering does not move.
//
//   DEFAULTS come from the "Key parameters" table in
//   end-effectors/01-drawing/README.md: draw 100 mm/s, air 500 mm/s,
//   Z press offset 3 mm, Z lift between strokes 30 mm. Leave a slider unwired
//   and you get the documented value.
//
//   WHY liveRun AND NOT dryRun
//   An unwired boolean in Grasshopper is false. If the input were called
//   dryRun, forgetting to wire it would silently produce a program that puts a
//   real pen on real paper. Named this way round, forgetting it gives you a dry
//   run. The unsafe option has to be asked for.
//
// COMPONENT OUTPUTS  -- build in this order
//    0  out            (the component's own message stream)
//    1  Targets        tree of Plane   -> branch per stroke, feed KUKA|prc
//    2  MoveTypes      tree of int     -> 0 air, 1 drawing, 2 trip to the magazine
//    3  Flat           list of Plane   -> the whole program in order, for the simulator
//    4  FlatMoves      list of int
//    5  PenSequence    list of int     -> which pen each ordered stroke uses
//    6  StrokeOrder    list of int     -> original curve index, in the new order
//    7  OrderedCurves  list of Curve   -> preview, already flipped
//    8  TravelMoves    list of Line    -> the air moves, preview
//    9  SwapLog        list of string  -> human readable swap list
//   10  SwapCount      int
//   11  TravelDist     double          -> mm in the air
//   12  DrawDist       double          -> mm on the paper
//   13  CycleTime      double          -> seconds, including swaps
//   14  KRL            string          -> the generated .src, panel this and save it
//   15  Status         string
//   16  Log            string
//   17  SelfTest       string
// ---------------------------------------------------------------------------

PenJob.Options opt = new PenJob.Options();

opt.DrawPlane   = drawPlane;
opt.DrawGeo     = drawGeo;
opt.SlotPlanes  = slotPlanes != null ? new List<Plane>(slotPlanes) : new List<Plane>();
opt.SlotTools   = slotTools  != null ? new List<int>(slotTools)    : new List<int>();
opt.HomePlane   = homePlane;

opt.LeadIn      = leadIn      > 0 ? leadIn      : 5.0;
opt.LeadOut     = leadOut     > 0 ? leadOut     : 5.0;
opt.Hover       = hover       > 0 ? hover       : 30.0;   // README: Z lift 30 mm
opt.TiltDeg     = tiltDeg;
opt.Resolution  = resolution  > 0 ? resolution  : 0.5;

// README: Z press offset 3 mm. Same idiom as every other number here - an
// unwired input is 0 and gets the documented default, because a spring-loaded
// holder always wants some press and "exactly zero" is not a real ask.
opt.PressDepth  = pressDepth  > 0 ? pressDepth  : 3.0;

opt.BaseIndex    = baseIndex    > 0 ? baseIndex    : 1;
opt.MagBaseIndex = magBaseIndex > 0 ? magBaseIndex : 1;

opt.Optimize    = optimize;
opt.GroupByPen  = groupByPen;
opt.StartIndex  = startIndex;
opt.DryRun      = !liveRun;

opt.FeedDraw    = feedDraw    > 0 ? feedDraw    : 100.0;  // README: draw 100 mm/s
opt.FeedRapid   = feedRapid   > 0 ? feedRapid   : 500.0;  // README: air  500 mm/s
opt.SwapSeconds = swapSeconds > 0 ? swapSeconds : 25.0;

opt.JobName     = string.IsNullOrEmpty(jobName) ? "DRAW_JOB" : jobName;
opt.SelfTest    = selfTest;

PenJob.Result res = PenJob.Build(curves != null ? new List<Curve>(curves) : null,
                                 penIds != null ? new List<int>(penIds)   : null,
                                 opt);

Targets       = res.Targets;
MoveTypes     = res.MoveTypes;
Flat          = res.Flat;
FlatMoves     = res.FlatMoves;
PenSequence   = res.PenSequence;
StrokeOrder   = res.StrokeOrder;
OrderedCurves = res.OrderedCurves;
TravelMoves   = res.TravelMoves;
SwapLog       = res.SwapLog;
SwapCount     = res.SwapCount;
TravelDist    = res.TravelDist;
DrawDist      = res.DrawDist;
CycleTime     = res.CycleTime;
KRL           = res.Krl;
Status        = res.Status;
Log           = res.Log;
SelfTest      = res.SelfTest;

if (Component != null)
{
  if (!string.IsNullOrEmpty(res.Status) && res.Status.StartsWith("FAIL"))
    Component.AddRuntimeMessage(GH_RuntimeMessageLevel.Error, res.Status);

  foreach (string w in res.Warnings)
    Component.AddRuntimeMessage(GH_RuntimeMessageLevel.Warning, w);

  if (liveRun)
    Component.AddRuntimeMessage(GH_RuntimeMessageLevel.Warning,
      "LIVE RUN. This KRL will fire the clamp and put the pen on the paper. " +
      "Do not load it until the dry run has passed in T1.");

  if (selfTest && !string.IsNullOrEmpty(res.SelfTest) && !PenJob.SelfTestPassed(res.SelfTest))
    Component.AddRuntimeMessage(GH_RuntimeMessageLevel.Warning,
      "Orientation self-test did not pass. Read the SelfTest output.");
}
# ---------- c_script: C# additional code ----------
// ---------------------------------------------------------------------------
// TF-09  Pen-switching loop - Grasshopper front end
// PANE: "Members" / "Additional code"  (Rhino 8 C# Script component, bottom pane)
//
// ASU Robotics Lab - D1 Drawing / Tooling + Fixtures.  Author: Tirth.
// Written from scratch for the SU26 board item TF-09.
//
// WHAT THIS DOES
//   Curves in, a complete drawing job out. It decides what order to draw the
//   strokes in, which way round to draw each one, where the pen has to be
//   swapped, and it writes the KRL that does it. The robot side (PENSWAP.src)
//   owns the actual park/release/acquire motion; this file decides WHEN.
//
// THE DEFINITION OF DONE, LINE BY LINE
//   "park -> release -> acquire -> set TOOL"   PEN_ENSURE in PENSWAP.src, called
//                                              from the job this file writes.
//   "resume at the right curve index"          StartIndex. The job re-acquires
//                                              the pen that stroke needs before
//                                              it moves, instead of assuming.
//   "safe-abort never strands a pen"           PEN_PHASE, written to the DAT
//                                              around every irreversible step.
//   "T1 dry run passes"                        DryRun. Same motion, no clamp
//                                              output, pen kept off the paper.
//
// ORIENTATION INDEPENDENCE
//   There is no world Z in this file. "Up off the paper" is the draw surface's
//   own normal, and the magazine slots are full planes, not heights. Tape the
//   paper to a wall, tilt the table 30 degrees, hang it upside down - the job
//   is the same job. SelfTest() rotates the entire scene and proves it.
// ---------------------------------------------------------------------------

public static class PenJob
{
  public const double EPS = 1e-12;

  // =========================================================================
  // 0.  CONTAINERS
  // =========================================================================

  public class Options
  {
    public Plane DrawPlane = Plane.Unset;      // the paper
    public GeometryBase DrawGeo = null;        // optional curved surface to follow
    public List<Plane> SlotPlanes = new List<Plane>();   // magazine, index = pen id
    public List<int> SlotTools = new List<int>();        // KUKA TOOL number per slot
    public Plane HomePlane = Plane.Unset;

    // Defaults below are the "Key parameters" table in
    // end-effectors/01-drawing/README.md. Change them there and here together.
    public double LeadIn = 5.0;      // approach distance along the tool axis
    public double LeadOut = 5.0;     // retract distance
    public double Hover = 30.0;      // Z lift between strokes, mm
    public double PressDepth = 3.0;  // Z press offset, mm - how far PAST the paper
                                     // the tip is commanded. The spring in the
                                     // holder takes up the overtravel; without it
                                     // any calibration error shows as a skipped
                                     // line rather than a lighter one.
    public double TiltDeg = 0.0;     // pen lean
    public double Resolution = 0.5;  // curve -> polyline chord tolerance

    public bool Optimize = true;     // reorder + flip strokes for least travel
    public bool GroupByPen = true;   // finish a pen before changing it
    public int StartIndex = 0;       // resume here, in the OPTIMISED order
    public bool DryRun = true;

    public double FeedDraw = 100.0;  // mm/s on the paper
    public double FeedRapid = 500.0; // mm/s in the air
    public double SwapSeconds = 25.0;// measured cost of one pen change

    // KUKA frames. The drawing README defines BASE[1] = worktable centre and
    // BASE[2] = the large-format shift; paper sizes that share a base need no
    // recalibration between them. The magazine is taught in its own base and is
    // bolted to the cell, so it does NOT move when the paper base changes.
    public int BaseIndex = 1;        // BASE[] the paper is taught in
    public int MagBaseIndex = 1;     // BASE[] the magazine is taught in

    public string JobName = "DRAW_JOB";
    public bool SelfTest = false;
    public int SelfTestCount = 8;
  }

  public class Stroke
  {
    public Curve Crv;
    public int Pen;
    public int SourceIndex;     // where it sat on the input list, before sorting
    public bool Reversed;
    public Point3d Start { get { return Crv.PointAtStart; } }
    public Point3d End { get { return Crv.PointAtEnd; } }
  }

  public class Swap
  {
    public int AtStroke;        // position in the final order
    public int FromPen;         // -1 = gripper was empty
    public int ToPen;
    public override string ToString()
    {
      return "stroke " + AtStroke.ToString().PadLeft(4) + " : " +
             (FromPen < 0 ? "(empty)" : "pen " + FromPen) + " -> pen " + ToPen;
    }
  }

  public class Result
  {
    public DataTree<Plane> Targets = new DataTree<Plane>();
    public DataTree<int> MoveTypes = new DataTree<int>();
    public List<Plane> Flat = new List<Plane>();
    public List<int> FlatMoves = new List<int>();   // 0 air, 1 drawing, 2 pen swap marker
    public List<int> PenSequence = new List<int>();
    public List<int> StrokeOrder = new List<int>();
    public List<string> SwapLog = new List<string>();
    public List<Curve> OrderedCurves = new List<Curve>();
    public List<Line> TravelMoves = new List<Line>();
    public int SwapCount = 0;
    public double TravelDist = 0.0;
    public double DrawDist = 0.0;
    public double CycleTime = 0.0;
    public string Krl = "";
    public string Status = "";
    public string Log = "";
    public string SelfTest = "";
    public List<string> Warnings = new List<string>();
  }

  // =========================================================================
  // 1.  ENTRY POINT
  // =========================================================================

  public static Result Build(List<Curve> curves, List<int> penIds, Options o)
  {
    Result r = new Result();
    StringBuilder log = new StringBuilder();
    if (o == null) o = new Options();

    if (curves == null || curves.Count == 0)
    {
      r.Status = "FAIL: no curves on the input.";
      r.Log = r.Status;
      return r;
    }
    if (!o.DrawPlane.IsValid)
    {
      r.Status = "FAIL: drawPlane is not set. Supply the plane of the paper.";
      r.Log = r.Status;
      return r;
    }
    if (o.SlotPlanes == null || o.SlotPlanes.Count == 0)
    {
      r.Status = "FAIL: no slotPlanes. Supply one plane per pen slot in the magazine.";
      r.Log = r.Status;
      return r;
    }

    Core(curves, penIds, o, r, log);

    if (o.SelfTest)
      r.SelfTest = RunSelfTest(curves, penIds, o, r);

    r.Log = log.ToString() + (string.IsNullOrEmpty(r.SelfTest) ? "" : "\n" + r.SelfTest);
    return r;
  }

  private static void Core(List<Curve> curves, List<int> penIds, Options o,
                           Result r, StringBuilder log)
  {
    double tol = DocTol();

    // --- 1. clean and label ------------------------------------------------
    List<Stroke> strokes = new List<Stroke>();
    int dropped = 0;
    for (int i = 0; i < curves.Count; i++)
    {
      if (curves[i] == null || !curves[i].IsValid) { dropped++; continue; }
      if (curves[i].GetLength() < tol * 10.0) { dropped++; continue; }

      Stroke s = new Stroke();
      s.Crv = curves[i].DuplicateCurve();
      s.Pen = PenFor(penIds, i, o.SlotPlanes.Count);
      s.SourceIndex = i;
      strokes.Add(s);
    }
    if (dropped > 0)
      r.Warnings.Add(dropped + " curve(s) were empty or shorter than tolerance and were skipped.");
    if (strokes.Count == 0)
    {
      r.Status = "FAIL: every curve was degenerate.";
      log.AppendLine(r.Status);
      return;
    }
    log.AppendLine("STROKES  " + strokes.Count + " usable of " + curves.Count + " supplied");

    int pensUsed = strokes.Select(s => s.Pen).Distinct().Count();
    log.AppendLine("PENS     " + pensUsed + " distinct, magazine has " + o.SlotPlanes.Count + " slot(s)");

    // --- 2. order and flip  (this is board item D1-01) ----------------------
    Point3d startFrom = o.HomePlane.IsValid ? o.HomePlane.Origin : strokes[0].Start;
    List<Stroke> ordered = o.Optimize
      ? OrderStrokes(strokes, startFrom, o.GroupByPen, log)
      : strokes;

    for (int i = 0; i < ordered.Count; i++)
    {
      r.StrokeOrder.Add(ordered[i].SourceIndex);
      r.PenSequence.Add(ordered[i].Pen);
      r.OrderedCurves.Add(ordered[i].Crv);
    }

    // --- 3. where the pen has to change --------------------------------------
    int held = -1;
    for (int i = 0; i < ordered.Count; i++)
    {
      if (ordered[i].Pen != held)
      {
        Swap sw = new Swap();
        sw.AtStroke = i; sw.FromPen = held; sw.ToPen = ordered[i].Pen;
        r.SwapLog.Add(sw.ToString());
        r.SwapCount++;
        held = ordered[i].Pen;
      }
    }
    log.AppendLine("SWAPS    " + r.SwapCount + " pen change(s) (the floor is " +
                   Math.Max(0, pensUsed) + " for " + pensUsed + " pens)");
    if (o.GroupByPen && r.SwapCount > pensUsed)
      r.Warnings.Add("More swaps than pens even with grouping on. Check that penIds line up " +
                     "with the curve list.");

    // --- 4. resume ------------------------------------------------------------
    int from = o.StartIndex;
    if (from < 0) from = 0;
    if (from >= ordered.Count)
    {
      r.Warnings.Add("startIndex " + o.StartIndex + " is past the last stroke (" +
                     (ordered.Count - 1) + "). Nothing to do.");
      from = ordered.Count;
    }
    if (from > 0)
      log.AppendLine("RESUME   starting at stroke " + from + " of " + ordered.Count +
                     ", which needs pen " + (from < ordered.Count ? ordered[from].Pen.ToString() : "-"));

    // --- 5. build the frames ---------------------------------------------------
    Point3d cursor = startFrom;
    int heldNow = -1;
    double maxPull = 0.0;

    // The wrist roll runs through the whole job, not per stroke. Seeded from
    // the home plane when there is one, because that is where the arm starts.
    Plane lastFrame = o.HomePlane.IsValid ? o.HomePlane : Plane.Unset;

    for (int i = from; i < ordered.Count; i++)
    {
      Stroke s = ordered[i];
      List<Point3d> pts = SampleStroke(s.Crv, o, tol, ref maxPull);
      if (pts.Count < 2) continue;

      // A magazine trip lands BETWEEN the last stroke and this one, so when
      // there is one it - not the previous stroke - is what the wrist rolls on
      // from. Slot planes are taught poses and are never re-rolled themselves.
      bool swapping = (s.Pen != heldNow);
      Plane slot = swapping ? SlotOf(o, s.Pen) : Plane.Unset;

      // Roll on a copy, so a stroke that produces nothing commits nothing.
      Plane carried = swapping ? slot : lastFrame;

      List<Plane> frames = new List<Plane>();
      List<int> moves = new List<int>();
      BuildStroke(pts, o, frames, moves, ref carried);
      if (frames.Count == 0) continue;
      lastFrame = carried;

      GH_Path path = new GH_Path(i);
      if (swapping)
      {
        // A marker frame at the slot, so the preview and the simulator both
        // show the trip to the magazine instead of teleporting.
        r.Targets.Add(slot, path);
        r.MoveTypes.Add(2, path);
        r.Flat.Add(slot);
        r.FlatMoves.Add(2);
        r.TravelMoves.Add(new Line(cursor, slot.Origin));
        r.TravelDist += cursor.DistanceTo(slot.Origin);
        cursor = slot.Origin;
        heldNow = s.Pen;
      }

      for (int k = 0; k < frames.Count; k++)
      {
        r.Targets.Add(frames[k], path);
        r.MoveTypes.Add(moves[k], path);
        r.Flat.Add(frames[k]);
        r.FlatMoves.Add(moves[k]);

        double d = cursor.DistanceTo(frames[k].Origin);
        if (moves[k] == 1) r.DrawDist += d; else r.TravelDist += d;
        if (moves[k] == 0 && k == 0) r.TravelMoves.Add(new Line(cursor, frames[k].Origin));
        cursor = frames[k].Origin;
      }
    }

    // --- 6. numbers --------------------------------------------------------------
    if (o.DrawGeo != null)
    {
      log.AppendLine("PROJECT  strokes dropped onto drawGeo, largest pull " +
                     maxPull.ToString("0.###") + " mm");
      if (maxPull > 0.5 * o.Hover)
        r.Warnings.Add("Projecting onto drawGeo moved a point by " + maxPull.ToString("0.#") +
                       " mm, which is over half the " + o.Hover.ToString("0.#") +
                       " mm lift. Check that drawGeo really is the sheet these curves belong to, " +
                       "and that the lift still clears it.");
    }

    r.CycleTime = (o.FeedDraw > EPS ? r.DrawDist / o.FeedDraw : 0.0)
                + (o.FeedRapid > EPS ? r.TravelDist / o.FeedRapid : 0.0)
                + r.SwapCount * o.SwapSeconds;

    log.AppendLine("DRAW     " + (r.DrawDist / 1000.0).ToString("0.###") + " m on the paper");
    log.AppendLine("TRAVEL   " + (r.TravelDist / 1000.0).ToString("0.###") + " m in the air");
    log.AppendLine("TIME     " + FormatTime(r.CycleTime) + " estimated, including " +
                   r.SwapCount + " swap(s) at " + o.SwapSeconds.ToString("0.#") + " s");

    // --- 7. the program ----------------------------------------------------------
    r.Krl = WriteKrl(ordered, from, o, r);

    if (o.DryRun)
      r.Warnings.Add("DRY RUN is on. The generated KRL sets PEN_DRYRUN = TRUE: the clamp output " +
                     "never fires and the pen stays " + o.Hover.ToString("0.#") +
                     " mm off the paper. Turn it off only after the T1 pass is clean.");

    r.Status = r.Warnings.Count > 0
      ? "OK WITH WARNINGS: " + r.Flat.Count + " targets, " + r.SwapCount + " swap(s), " +
        FormatTime(r.CycleTime)
      : "OK: " + r.Flat.Count + " targets, " + (ordered.Count - from) + " stroke(s), " +
        r.SwapCount + " swap(s), " + FormatTime(r.CycleTime);
    log.AppendLine("STATUS " + r.Status);
  }

  // =========================================================================
  // 2.  DRAW ORDER
  //
  //     Two costs, and they are not the same size. A pen change is tens of
  //     seconds. A hop between two strokes is tenths of a second. So the
  //     ordering is hierarchical: never trade a swap for travel. Inside one
  //     pen's group, go nearest-neighbour and flip each curve so it starts at
  //     whichever end is closer to where the last one finished, then run 2-opt
  //     to undo the corner greedy always paints itself into.
  // =========================================================================

  private static List<Stroke> OrderStrokes(List<Stroke> strokes, Point3d start,
                                           bool groupByPen, StringBuilder log)
  {
    double before = ChainLength(strokes, start);

    List<Stroke> result = new List<Stroke>();
    Point3d cursor = start;

    if (groupByPen)
    {
      // Visit the pen groups themselves nearest-first, so the order of the
      // groups is not simply pen 0, 1, 2 by accident of numbering.
      List<int> pens = strokes.Select(s => s.Pen).Distinct().ToList();
      List<int> remaining = new List<int>(pens);

      while (remaining.Count > 0)
      {
        int bestPen = remaining[0];
        double bestD = double.MaxValue;
        foreach (int p in remaining)
        {
          foreach (Stroke s in strokes.Where(x => x.Pen == p))
          {
            double d = Math.Min(cursor.DistanceTo(s.Start), cursor.DistanceTo(s.End));
            if (d < bestD) { bestD = d; bestPen = p; }
          }
        }
        List<Stroke> group = strokes.Where(x => x.Pen == bestPen).ToList();
        List<Stroke> seq = GreedyChain(group, cursor);
        seq = TwoOpt(seq, cursor);
        ReflowFlips(seq, cursor);
        result.AddRange(seq);
        cursor = seq[seq.Count - 1].End;
        remaining.Remove(bestPen);
      }
    }
    else
    {
      List<Stroke> seq = GreedyChain(new List<Stroke>(strokes), cursor);
      seq = TwoOpt(seq, cursor);
      ReflowFlips(seq, cursor);
      result.AddRange(seq);
    }

    double after = ChainLength(result, start);
    log.AppendLine("ORDER    air travel " + (before / 1000.0).ToString("0.###") + " m -> " +
                   (after / 1000.0).ToString("0.###") + " m" +
                   (before > EPS ? "  (" + (100.0 * (1.0 - after / before)).ToString("0.#") +
                    "% saved)" : ""));
    return result;
  }

  // Greedy nearest neighbour, considering BOTH ends of every candidate. This
  // is the flip half of D1-01: if the far end is nearer, the curve is reversed.
  private static List<Stroke> GreedyChain(List<Stroke> pool, Point3d start)
  {
    List<Stroke> open = new List<Stroke>(pool);
    List<Stroke> seq = new List<Stroke>();
    Point3d cursor = start;

    while (open.Count > 0)
    {
      int best = 0; bool flip = false; double bestD = double.MaxValue;
      for (int i = 0; i < open.Count; i++)
      {
        double ds = cursor.DistanceToSquared(open[i].Start);
        double de = cursor.DistanceToSquared(open[i].End);
        if (ds < bestD) { bestD = ds; best = i; flip = false; }
        if (de < bestD) { bestD = de; best = i; flip = true; }
      }
      Stroke s = open[best];
      if (flip) { s.Crv.Reverse(); s.Reversed = !s.Reversed; }
      seq.Add(s);
      cursor = s.End;
      open.RemoveAt(best);
    }
    return seq;
  }

  // Standard 2-opt on the visiting order. Reversing a run of strokes also
  // reverses each stroke inside it, which is exactly what a physical pen does.
  private static List<Stroke> TwoOpt(List<Stroke> seq, Point3d start)
  {
    if (seq.Count < 4) return seq;
    List<Stroke> best = new List<Stroke>(seq);
    double bestLen = ChainLength(best, start);

    int budget = Math.Min(40, 4000 / Math.Max(1, seq.Count));
    for (int pass = 0; pass < Math.Max(1, budget); pass++)
    {
      bool improved = false;
      for (int i = 0; i < best.Count - 1 && !improved; i++)
      {
        for (int j = i + 1; j < best.Count; j++)
        {
          List<Stroke> trial = new List<Stroke>(best);
          trial.Reverse(i, j - i + 1);
          for (int k = i; k <= j; k++)
          {
            Stroke t = trial[k];
            Stroke copy = new Stroke();
            copy.Crv = t.Crv.DuplicateCurve(); copy.Crv.Reverse();
            copy.Pen = t.Pen; copy.SourceIndex = t.SourceIndex; copy.Reversed = !t.Reversed;
            trial[k] = copy;
          }
          double len = ChainLength(trial, start);
          if (len < bestLen - 1e-9)
          {
            best = trial; bestLen = len; improved = true; break;
          }
        }
      }
      if (!improved) break;
    }
    return best;
  }

  // After reordering, re-check each curve's direction one final time. Cheap,
  // and it catches the flips 2-opt left in a worse state than it found them.
  private static void ReflowFlips(List<Stroke> seq, Point3d start)
  {
    Point3d cursor = start;
    for (int i = 0; i < seq.Count; i++)
    {
      if (cursor.DistanceToSquared(seq[i].End) < cursor.DistanceToSquared(seq[i].Start))
      {
        seq[i].Crv.Reverse();
        seq[i].Reversed = !seq[i].Reversed;
      }
      cursor = seq[i].End;
    }
  }

  private static double ChainLength(List<Stroke> seq, Point3d start)
  {
    double total = 0.0;
    Point3d cursor = start;
    for (int i = 0; i < seq.Count; i++)
    {
      total += cursor.DistanceTo(seq[i].Start);
      cursor = seq[i].End;
    }
    return total;
  }

  // =========================================================================
  // 3.  FRAMES FOR ONE STROKE   (this is board item D1-03)
  //
  //     Every stroke is: come down to the paper, draw, lift off. The lead-in
  //     and lead-out travel along the pen's own axis, so the pen arrives and
  //     leaves square to the paper and never scrubs a witness mark.
  //
  //     FRAME CONVENTION - matches FL-01 and what KUKA|prc's LIN expects
  //       origin : the point on the paper
  //       X      : direction of travel
  //       Z      : down the pen, from holder into paper
  //       Y      : Z cross X
  // =========================================================================

  //     ROLL CONTINUITY ACROSS STROKES
  //     lastFrame carries the wrist roll in from the previous stroke, and the
  //     final frame back out. Without it every stroke restarted its roll from
  //     its own travel direction, and two strokes drawn in opposite directions
  //     asked axis 6 for an instant 180 deg flip between them - measured at
  //     1170 deg of total roll change over an eight-stroke job, which
  //     KUKA|prc rejected as unreachable. Carrying it through makes the same
  //     job 0 deg. Pass Plane.Unset to start a fresh chain.
  private static void BuildStroke(List<Point3d> pts, Options o,
                                  List<Plane> frames, List<int> moves,
                                  ref Plane lastFrame)
  {
    double tol = DocTol();
    List<Plane> body = new List<Plane>();

    for (int i = 0; i < pts.Count; i++)
    {
      Vector3d travel;
      if (i == 0) travel = pts[1] - pts[0];
      else if (i == pts.Count - 1) travel = pts[i] - pts[i - 1];
      else travel = pts[i + 1] - pts[i - 1];
      if (!travel.Unitize()) continue;

      Vector3d up = SurfaceUp(pts[i], o);          // out of the paper, towards the robot
      Vector3d down = -up;                          // the pen axis

      down = down - (down * travel) * travel;
      if (!down.Unitize()) continue;

      Vector3d y = Vector3d.CrossProduct(down, travel);
      if (!y.Unitize()) continue;

      Plane f = new Plane(pts[i], travel, y);
      if (Math.Abs(o.TiltDeg) > 1e-9)
        f.Rotate(RhinoMath.ToRadians(o.TiltDeg), f.XAxis, f.Origin);

      // A pen is round about its own axis, so the roll is free. Spend it on
      // keeping axis 6 still: aim each frame's X as close as possible to the
      // last one instead of letting it chase every wiggle in the curve.
      //
      // The reference is the previous frame in this stroke, or - for the very
      // first frame - whatever the last stroke finished on. Only a genuinely
      // fresh chain falls through to the travel direction.
      Plane prev = body.Count > 0 ? body[body.Count - 1] : lastFrame;
      if (prev.IsValid)
      {
        Vector3d z = f.ZAxis;
        Vector3d x = prev.XAxis - (prev.XAxis * z) * z;
        if (x.Unitize())
        {
          Vector3d yy = Vector3d.CrossProduct(z, x);
          if (yy.Unitize()) f = new Plane(f.Origin, x, yy);
        }
      }
      body.Add(f);
    }
    if (body.Count == 0) return;

    // How far along the pen axis the drawing frames sit relative to the paper.
    //   live : +PressDepth, i.e. PAST the surface. The spring-loaded holder
    //          absorbs it, and the line is drawn even if the plane is a
    //          fraction of a millimetre out.
    //   dry  : -Hover, i.e. the whole stroke is lifted clear. Same shape, same
    //          rhythm, never touches the paper.
    // One signed number covers both, so there is only one path to get wrong.
    double press = o.DryRun ? -o.Hover : o.PressDepth;

    if (Math.Abs(press) > EPS)
      for (int i = 0; i < body.Count; i++)
      {
        Plane f = body[i];
        f.Origin = f.Origin + f.ZAxis * press;
        body[i] = f;
      }

    // Lead-in: hover above the first point, straight down the pen's own axis.
    // Measured from the PAPER, not from the pressed point, so the clearance is
    // the Hover number in the README whether or not press is applied.
    Plane first = body[0];
    Plane approach = first;
    approach.Origin = first.Origin - first.ZAxis * (o.LeadIn + o.Hover + press);
    frames.Add(approach); moves.Add(0);

    // Pen-down happens on the move from the hover point to body[0]. Nothing is
    // inserted between them, so there is no sideways creep at the touch point -
    // which is what leaves a witness mark.
    for (int i = 0; i < body.Count; i++) { frames.Add(body[i]); moves.Add(1); }

    Plane last = frames[frames.Count - 1];
    Plane lift = last;
    lift.Origin = last.Origin - last.ZAxis * (o.LeadOut + o.Hover + press);
    frames.Add(lift); moves.Add(0);

    // Hand the roll on, so the next stroke starts where this one left the wrist.
    lastFrame = lift;
  }

  // "Up off the paper" without ever naming world Z. On a flat sheet it is the
  // draw plane's normal. On a curved surface it is the real normal there.
  private static Vector3d SurfaceUp(Point3d p, Options o)
  {
    if (o.DrawGeo != null)
    {
      Mesh m = o.DrawGeo as Mesh;
      if (m != null)
      {
        Point3d cp; Vector3d n;
        if (m.ClosestPoint(p, out cp, out n, 0.0) >= 0 && n.Unitize())
          return AlignTo(n, o.DrawPlane.ZAxis);
      }
      Brep b = o.DrawGeo as Brep;
      if (b != null)
      {
        Point3d cp; ComponentIndex ci; double s, t; Vector3d n;
        if (b.ClosestPoint(p, out cp, out ci, out s, out t, 0.0, out n) && n.Unitize())
          return AlignTo(n, o.DrawPlane.ZAxis);
      }
      Surface srf = o.DrawGeo as Surface;
      if (srf != null)
      {
        double u, v;
        if (srf.ClosestPoint(p, out u, out v))
        {
          Vector3d n = srf.NormalAt(u, v);
          if (n.Unitize()) return AlignTo(n, o.DrawPlane.ZAxis);
        }
      }
    }
    return o.DrawPlane.ZAxis;
  }

  // A surface normal can point either way. The draw plane says which way the
  // robot is, so use it as the referee - not world Z.
  private static Vector3d AlignTo(Vector3d n, Vector3d reference)
  {
    return (n * reference) < 0 ? -n : n;
  }

  // Sample a stroke and, when a curved sheet is supplied, drop every sample
  // onto it. This is the "curved-surface drawing via scan-projected paths"
  // capability in the drawing README: you draw the artwork flat, hand the
  // component the scanned sheet, and the strokes land on the real surface.
  //
  // It is a no-op when the curves already lie on the sheet, so it is safe to
  // leave on. The projection is closest-point, which commutes with rotation,
  // so it does not cost the orientation guarantee - the self-test transforms
  // DrawGeo along with everything else and still passes.
  private static List<Point3d> SampleStroke(Curve c, Options o, double tol, ref double maxPull)
  {
    List<Point3d> pts = SampleCurve(c, o.Resolution, tol);
    if (o.DrawGeo == null) return pts;

    for (int i = 0; i < pts.Count; i++)
    {
      Point3d onGeo;
      if (!ClosestOn(o.DrawGeo, pts[i], out onGeo)) continue;
      double d = pts[i].DistanceTo(onGeo);
      if (d > maxPull) maxPull = d;
      pts[i] = onGeo;
    }
    return pts;
  }

  private static bool ClosestOn(GeometryBase g, Point3d p, out Point3d onGeo)
  {
    onGeo = p;

    Mesh m = g as Mesh;
    if (m != null)
    {
      Point3d cp = m.ClosestPoint(p);
      if (cp.IsValid) { onGeo = cp; return true; }
      return false;
    }

    Brep b = g as Brep;
    if (b != null)
    {
      Point3d cp = b.ClosestPoint(p);
      if (cp.IsValid) { onGeo = cp; return true; }
      return false;
    }

    Surface srf = g as Surface;
    if (srf != null)
    {
      double u, v;
      if (srf.ClosestPoint(p, out u, out v)) { onGeo = srf.PointAt(u, v); return true; }
      return false;
    }

    return false;
  }

  private static List<Point3d> SampleCurve(Curve c, double resolution, double tol)
  {
    List<Point3d> pts = new List<Point3d>();
    double res = Math.Max(resolution, tol);

    PolylineCurve pc = c.ToPolyline(0, 0, 0.02, 0, 0, res, 0, 0, true);
    if (pc != null && pc.PointCount >= 2)
    {
      for (int i = 0; i < pc.PointCount; i++) pts.Add(pc.Point(i));
      return pts;
    }

    // Fallback for anything ToPolyline refuses: even arc-length division.
    double len = c.GetLength();
    int n = Math.Max(2, (int) Math.Ceiling(len / Math.Max(res, tol)));
    n = Math.Min(n, 20000);
    for (int i = 0; i <= n; i++)
    {
      double t;
      if (c.LengthParameter(len * i / n, out t)) pts.Add(c.PointAt(t));
    }
    return pts;
  }

  private static int PenFor(List<int> penIds, int i, int slotCount)
  {
    int p = 0;
    if (penIds != null && penIds.Count > 0)
      p = penIds[Math.Min(i, penIds.Count - 1)];
    if (p < 0) p = 0;
    if (slotCount > 0 && p >= slotCount) p = slotCount - 1;
    return p;
  }

  private static Plane SlotOf(Options o, int pen)
  {
    if (o.SlotPlanes.Count == 0) return Plane.WorldXY;
    int i = Math.Max(0, Math.Min(pen, o.SlotPlanes.Count - 1));
    return o.SlotPlanes[i];
  }

  private static int ToolOf(Options o, int pen)
  {
    if (o.SlotTools != null && o.SlotTools.Count > 0)
      return o.SlotTools[Math.Max(0, Math.Min(pen, o.SlotTools.Count - 1))];
    return pen + 1;   // sensible default: slot 0 is TOOL[1]
  }

  // =========================================================================
  // 4.  KRL OUTPUT
  //
  //     The job never calls park or acquire directly. It says "I need pen 2"
  //     and PEN_ENSURE works out whether that means doing nothing, picking one
  //     up, or putting one back first. That single choke point is what makes
  //     the abort case tractable: there is exactly one routine that can ever
  //     have a pen half-way out of a slot.
  // =========================================================================

  private static string WriteKrl(List<Stroke> ordered, int from, Options o, Result r)
  {
    StringBuilder k = new StringBuilder();
    string name = SanitiseName(o.JobName);
    CultureInfo inv = CultureInfo.InvariantCulture;

    k.AppendLine("&ACCESS RVP");
    k.AppendLine("&REL 1");
    k.AppendLine("&COMMENT Generated by TF-09 Grasshopper front end - ASU Robotics Lab");
    k.AppendLine("DEF " + name + "( )");
    k.AppendLine(";");
    k.AppendLine("; ============================================================");
    k.AppendLine("; " + name);
    k.AppendLine("; generated " + DateTime.Now.ToString("yyyy-MM-dd HH:mm", inv));
    k.AppendLine("; strokes " + (ordered.Count - from) + " of " + ordered.Count +
                 " (resuming at index " + from + ")");
    k.AppendLine("; pen changes " + r.SwapCount);
    k.AppendLine("; estimated cycle " + FormatTime(r.CycleTime));
    k.AppendLine("; DRY RUN " + (o.DryRun ? "ON  - the clamp will not fire and the pen stays " +
                                 o.Hover.ToString("0.#", inv) + " mm clear"
                               : "OFF - the pen WILL touch the paper and the clamp WILL fire"));
    k.AppendLine("; paper base BASE[" + o.BaseIndex + "]   magazine base BASE[" + o.MagBaseIndex + "]");
    k.AppendLine("; draw " + o.FeedDraw.ToString("0.#", inv) + " mm/s   air " +
                 o.FeedRapid.ToString("0.#", inv) + " mm/s   lift " +
                 o.Hover.ToString("0.#", inv) + " mm   press " +
                 (o.DryRun ? "suppressed" : o.PressDepth.ToString("0.###", inv) + " mm"));
    k.AppendLine("; ------------------------------------------------------------");
    k.AppendLine("; REQUIRES PENSWAP.SRC and PENSWAP.DAT on the controller.");
    k.AppendLine("; RUN IN T1 FIRST. Read PENSWAP_README.md before you touch OV.");
    k.AppendLine("; ============================================================");
    k.AppendLine(";");
    k.AppendLine("  ; ---- standard header ----------------------------------");
    k.AppendLine("  BAS(#INITMOV, 0)");
    k.AppendLine("  BAS(#VEL_PTP, 20)");
    k.AppendLine("  $APO.CDIS = 1.0");
    k.AppendLine("  $ADVANCE = 3");
    k.AppendLine(";");
    k.AppendLine("  ; ---- frames -------------------------------------------");
    k.AppendLine("  ; PEN_BASENO is the base the LIN targets below are expressed in - the");
    k.AppendLine("  ; paper. PEN_MAGBASE is the base the magazine was taught in. The two are");
    k.AppendLine("  ; separate so that moving to BASE[2] for a large sheet does not drag the");
    k.AppendLine("  ; magazine with it. PENSWAP switches to PEN_MAGBASE for a swap and puts");
    k.AppendLine("  ; PEN_BASENO back before the job draws again.");
    k.AppendLine("  PEN_BASENO  = " + o.BaseIndex);
    k.AppendLine("  PEN_MAGBASE = " + o.MagBaseIndex);
    k.AppendLine(";");
    k.AppendLine("  ; ---- pen magazine -------------------------------------");
    k.AppendLine("  PEN_DRYRUN = " + (o.DryRun ? "TRUE" : "FALSE"));
    k.AppendLine("  PEN_CONFIG()");
    k.AppendLine("  PEN_INIT()      ; completes any swap that a previous abort left half done");
    k.AppendLine(";");
    k.AppendLine("  PTP XHOME");
    k.AppendLine(";");
    k.AppendLine("  WAIT SEC 0      ; advance-run stop, so the base change below is not");
    k.AppendLine("                  ; applied to a move that is already planned");
    k.AppendLine("  $BASE = BASE_DATA[" + o.BaseIndex + "]   ; the paper");
    k.AppendLine(";");

    int held = -1;
    int emitted = 0;
    double pull = 0.0;

    // Same roll chain as Core builds, seeded the same way, so the program that
    // is emitted is the program that was previewed and simulated.
    Plane lastFrame = o.HomePlane.IsValid ? o.HomePlane : Plane.Unset;
    for (int i = from; i < ordered.Count; i++)
    {
      Stroke s = ordered[i];
      List<Point3d> pts = SampleStroke(s.Crv, o, DocTol(), ref pull);
      if (pts.Count < 2) continue;

      bool swapping = (s.Pen != held);
      Plane carried = swapping ? SlotOf(o, s.Pen) : lastFrame;

      List<Plane> frames = new List<Plane>();
      List<int> moves = new List<int>();
      BuildStroke(pts, o, frames, moves, ref carried);
      if (frames.Count == 0) continue;
      lastFrame = carried;

      k.AppendLine("  ; ---- stroke " + i + "  (source curve " + s.SourceIndex +
                   ", pen " + s.Pen + ", TOOL[" + ToolOf(o, s.Pen) + "]" +
                   (s.Reversed ? ", reversed for travel" : "") + ") ----");
      k.AppendLine("  PEN_INDEX = " + i + "     ; resume point if this job is aborted");

      if (swapping)
      {
        // KRL arrays are 1-based, Grasshopper counts pens from 0. The +1 lives
        // here and nowhere else.
        k.AppendLine("  PEN_ENSURE(" + (s.Pen + 1) + ")   ; park what is held, take pen " +
                     s.Pen + ", set $TOOL");
        held = s.Pen;
      }

      k.AppendLine("  $VEL.CP = " + (o.FeedRapid / 1000.0).ToString("0.####", inv));
      for (int m = 0; m < frames.Count; m++)
      {
        if (moves[m] == 1 && (m == 0 || moves[m - 1] != 1))
          k.AppendLine("  $VEL.CP = " + (o.FeedDraw / 1000.0).ToString("0.####", inv));
        if (moves[m] != 1 && m > 0 && moves[m - 1] == 1)
          k.AppendLine("  $VEL.CP = " + (o.FeedRapid / 1000.0).ToString("0.####", inv));

        k.AppendLine("  LIN " + FrameLiteral(frames[m]) + (moves[m] == 1 ? "" : " C_DIS"));
      }
      k.AppendLine(";");
      emitted++;
    }

    k.AppendLine("  ; ---- finish -------------------------------------------");
    k.AppendLine("  PEN_INDEX = " + ordered.Count + "     ; job complete");
    k.AppendLine("  PEN_ENSURE(-1)  ; park whatever is held; the gripper ends empty");
    k.AppendLine("  PTP XHOME");
    k.AppendLine("END");
    k.AppendLine();
    k.AppendLine("; strokes written: " + emitted);
    return k.ToString();
  }

  // A KRL FRAME literal. X/Y/Z in millimetres, A/B/C in degrees.
  private static string FrameLiteral(Plane p)
  {
    double a, b, c;
    PlaneToAbc(p, out a, out b, out c);
    CultureInfo inv = CultureInfo.InvariantCulture;
    return "{X " + p.OriginX.ToString("0.###", inv) +
           ", Y " + p.OriginY.ToString("0.###", inv) +
           ", Z " + p.OriginZ.ToString("0.###", inv) +
           ", A " + a.ToString("0.###", inv) +
           ", B " + b.ToString("0.###", inv) +
           ", C " + c.ToString("0.###", inv) + "}";
  }

  // KUKA orientation is Z-Y'-X'' intrinsic Euler in degrees:
  //     R = Rz(A) * Ry(B) * Rx(C)
  // and the rotation matrix columns are the plane's own axes.
  public static void PlaneToAbc(Plane p, out double A, out double B, out double C)
  {
    Vector3d X = p.XAxis; X.Unitize();
    Vector3d Y = p.YAxis; Y.Unitize();
    Vector3d Z = p.ZAxis; Z.Unitize();

    double r00 = X.X, r10 = X.Y, r20 = X.Z;
    double r01 = Y.X, r11 = Y.Y, r21 = Y.Z;
    double r22 = Z.Z;

    double sB = -r20;
    if (sB > 1.0) sB = 1.0;
    if (sB < -1.0) sB = -1.0;

    if (Math.Abs(sB) > 1.0 - 1e-10)
    {
      // Gimbal lock: B is +/-90, and only A+C or C-A is determined. Pinning
      // A = 0 is the usual convention and keeps the value continuous.
      B = sB > 0 ? 90.0 : -90.0;
      A = 0.0;
      C = sB > 0 ? RhinoMath.ToDegrees(Math.Atan2(r01, r11))
                 : RhinoMath.ToDegrees(Math.Atan2(-r01, r11));
      return;
    }

    B = RhinoMath.ToDegrees(Math.Asin(sB));
    A = RhinoMath.ToDegrees(Math.Atan2(r10, r00));
    C = RhinoMath.ToDegrees(Math.Atan2(r21, r22));
  }

  // Round trip, used by the self-test: rebuild the plane from A/B/C and see
  // whether it lands back on itself.
  public static Plane AbcToPlane(Point3d origin, double A, double B, double C)
  {
    double a = RhinoMath.ToRadians(A), b = RhinoMath.ToRadians(B), c = RhinoMath.ToRadians(C);
    double ca = Math.Cos(a), sa = Math.Sin(a);
    double cb = Math.Cos(b), sb = Math.Sin(b);
    double cc = Math.Cos(c), sc = Math.Sin(c);

    Vector3d X = new Vector3d(ca * cb, sa * cb, -sb);
    Vector3d Y = new Vector3d(ca * sb * sc - sa * cc, sa * sb * sc + ca * cc, cb * sc);
    return new Plane(origin, X, Y);
  }

  private static string SanitiseName(string s)
  {
    if (string.IsNullOrEmpty(s)) return "DRAW_JOB";
    StringBuilder sb = new StringBuilder();
    foreach (char ch in s.ToUpperInvariant())
    {
      if (char.IsLetterOrDigit(ch) || ch == '_') sb.Append(ch);
      else sb.Append('_');
    }
    string outName = sb.ToString();
    if (!char.IsLetter(outName[0])) outName = "J" + outName;
    if (outName.Length > 24) outName = outName.Substring(0, 24);
    return outName;
  }

  // =========================================================================
  // 5.  THE ORIENTATION PROOF
  //
  //     Rotate the whole scene - curves, paper, magazine, home - by an awkward
  //     rotation. Re-run. The stroke order must come out identical (it is a
  //     property of the geometry, not of the world axes) and every target must
  //     land on the rotated copy of the original target.
  //     A second check runs each plane through the KUKA A/B/C conversion and
  //     back, because that is the one place a world axis genuinely appears.
  // =========================================================================

  private static string RunSelfTest(List<Curve> curves, List<int> penIds, Options o, Result baseline)
  {
    StringBuilder sb = new StringBuilder();
    sb.AppendLine();
    sb.AppendLine("=== ORIENTATION SELF-TEST ===");

    if (baseline.Flat.Count == 0) return "SELF-TEST SKIPPED: the baseline run produced nothing.";

    BoundingBox bb = BoundingBox.Empty;
    foreach (Curve c in curves) if (c != null) bb.Union(c.GetBoundingBox(true));
    double diag = bb.IsValid ? bb.Diagonal.Length : 1.0;
    if (diag < EPS) diag = 1.0;

    int trials = Math.Max(1, Math.Min(o.SelfTestCount, 64));
    double worstPos = 0.0, worstAng = 0.0;
    int orderMismatch = 0, countMismatch = 0;
    Random rnd = new Random(20260803);

    for (int k = 0; k < trials; k++)
    {
      Vector3d axis = new Vector3d(rnd.NextDouble() * 2 - 1, rnd.NextDouble() * 2 - 1,
                                   rnd.NextDouble() * 2 - 1);
      if (!axis.Unitize()) axis = Vector3d.ZAxis;
      Transform R = Transform.Rotation(rnd.NextDouble() * 2.0 * Math.PI, axis, Point3d.Origin);
      Transform T = Transform.Translation(new Vector3d((rnd.NextDouble() - 0.5) * diag,
                                                       (rnd.NextDouble() - 0.5) * diag,
                                                       (rnd.NextDouble() - 0.5) * diag));
      Transform F = T * R;
      Transform Finv;
      if (!F.TryGetInverse(out Finv)) continue;

      List<Curve> movedCurves = new List<Curve>();
      foreach (Curve c in curves)
      {
        if (c == null) { movedCurves.Add(null); continue; }
        Curve d = c.DuplicateCurve(); d.Transform(F); movedCurves.Add(d);
      }

      Options ok = CloneOptions(o);
      ok.SelfTest = false;
      ok.DrawPlane = Xform(o.DrawPlane, F);
      ok.HomePlane = o.HomePlane.IsValid ? Xform(o.HomePlane, F) : Plane.Unset;
      ok.SlotPlanes = o.SlotPlanes.Select(p => Xform(p, F)).ToList();
      if (o.DrawGeo != null) { GeometryBase g = o.DrawGeo.Duplicate(); g.Transform(F); ok.DrawGeo = g; }

      Result rk = new Result();
      Core(movedCurves, penIds, ok, rk, new StringBuilder());

      if (rk.Flat.Count != baseline.Flat.Count) { countMismatch++; continue; }
      if (!rk.StrokeOrder.SequenceEqual(baseline.StrokeOrder)) orderMismatch++;

      for (int i = 0; i < rk.Flat.Count; i++)
      {
        Plane back = rk.Flat[i];
        back.Transform(Finv);
        double dp = back.Origin.DistanceTo(baseline.Flat[i].Origin);
        double da = TurnDegrees(baseline.Flat[i], back);
        if (dp > worstPos) worstPos = dp;
        if (da > worstAng) worstAng = da;
      }
    }

    // The A/B/C round trip. This is the only maths in the file that names a
    // world axis, so it gets its own check on the real output planes.
    double worstAbc = 0.0;
    foreach (Plane p in baseline.Flat)
    {
      double A, B, C;
      PlaneToAbc(p, out A, out B, out C);
      Plane back = AbcToPlane(p.Origin, A, B, C);
      double d = TurnDegrees(p, back);
      if (d > worstAbc) worstAbc = d;
    }

    double posLimit = Math.Max(1e-6 * diag, 1e-7);
    double angLimit = 1e-3;

    sb.AppendLine("trials                    " + trials + " random rotations of the whole cell");
    sb.AppendLine("targets compared          " + baseline.Flat.Count + " per trial");
    sb.AppendLine("stroke-order mismatches   " + orderMismatch + " of " + trials);
    sb.AppendLine("target-count mismatches   " + countMismatch + " of " + trials);
    sb.AppendLine("worst origin drift        " + worstPos.ToString("0.000000000") + " mm" +
                  "   (allowed " + posLimit.ToString("0.000000000") + ")");
    sb.AppendLine("worst rotation drift      " + worstAng.ToString("0.000000000") + " deg" +
                  "   (allowed " + angLimit.ToString("0.000000000") + ")");
    sb.AppendLine("worst KUKA A/B/C roundtrip " + worstAbc.ToString("0.000000000") + " deg" +
                  "   (allowed " + angLimit.ToString("0.000000000") + ")");

    bool pass = worstPos <= posLimit && worstAng <= angLimit && worstAbc <= angLimit
                && orderMismatch == 0 && countMismatch == 0;
    sb.AppendLine(pass
      ? "RESULT: PASS - the same job comes out whichever way the paper and magazine are turned."
      : "RESULT: FAIL - read the numbers above and the component warnings.");
    return sb.ToString();
  }

  public static bool SelfTestPassed(string report)
  {
    return !string.IsNullOrEmpty(report) && report.Contains("RESULT: PASS");
  }

  private static Options CloneOptions(Options o)
  {
    Options c = new Options();
    c.DrawPlane = o.DrawPlane; c.DrawGeo = o.DrawGeo;
    c.SlotPlanes = new List<Plane>(o.SlotPlanes);
    c.SlotTools = new List<int>(o.SlotTools);
    c.HomePlane = o.HomePlane;
    c.LeadIn = o.LeadIn; c.LeadOut = o.LeadOut; c.Hover = o.Hover;
    c.PressDepth = o.PressDepth;
    c.TiltDeg = o.TiltDeg; c.Resolution = o.Resolution;
    c.Optimize = o.Optimize; c.GroupByPen = o.GroupByPen;
    c.StartIndex = o.StartIndex; c.DryRun = o.DryRun;
    c.FeedDraw = o.FeedDraw; c.FeedRapid = o.FeedRapid; c.SwapSeconds = o.SwapSeconds;
    c.BaseIndex = o.BaseIndex; c.MagBaseIndex = o.MagBaseIndex;
    c.JobName = o.JobName;
    return c;
  }

  private static Plane Xform(Plane p, Transform t)
  {
    Plane q = p; q.Transform(t); return q;
  }

  private static double TurnDegrees(Plane a, Plane b)
  {
    Quaternion q = Quaternion.Rotation(a, b);
    double angle; Vector3d axis;
    if (!q.GetRotation(out angle, out axis)) return 0.0;
    angle = Math.Abs(angle);
    if (angle > Math.PI) angle = 2.0 * Math.PI - angle;
    return RhinoMath.ToDegrees(angle);
  }

  public static double DocTol()
  {
    RhinoDoc doc = RhinoDoc.ActiveDoc;
    if (doc != null && doc.ModelAbsoluteTolerance > 0) return doc.ModelAbsoluteTolerance;
    return 0.001;
  }

  private static string FormatTime(double seconds)
  {
    if (seconds < 60) return seconds.ToString("0.#") + " s";
    int m = (int) (seconds / 60);
    double s = seconds - m * 60;
    return m + " min " + s.ToString("0") + " s";
  }
}
# ---------- end c_script ----------
# ---- group: KUKA|prc (legacy - never PRC Preview)
tool_mesh = Mesh(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)
lin_move = LINearMovementKUKAPrc(TargetAsPlane=c_script.Flat, extaxenabled=False, interpolation="C_DIS")
tool_id = Slider(1, range=0..16)
custom_tool_pln = CustomToolPlaneKUKAPrc(ToolGeometry=tool_mesh, ToolNumber=tool_id, ToolPlane=pentool.ToolPlane, frameinput=False)
kr6_10_r1100_2 = AgilusKR610R11002Robot(infiniterot=False)
sim = Slider(0, range=0..1)
kuka_prc = KUKAPrcCORE(
    SimulationSlider=sim,
    KUKAPrcCommands=lin_move,
    Tool=custom_tool_pln,
    Robot=kr6_10_r1100_2,
    PRC_BaseExpose=False,
    PRC_SaveNameExpose=False,
    PRCsettings="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")  # -> RobotGeometry, AnalysisOutput
analysis = AnalysisKUKAPrc(KUKAPrcAnalysisData=kuka_prc.AnalysisOutput)  # -> RobotAxisValues, RobotCollisionCheck, RobotReachabilityCheck, CommandID, TimeValue, Planes, CommandTags, IOState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; disabled

# ----
# note: THE PEN LEAN COMES FROM PENTOOL
# 
# tiltDeg is wired from the PENTOOL component's penLeanDeg, not from a slider here, so the component that decides how the board is hung is also the one that decides how far the pen leans - and can warn when the two do not go together.
# 
# They do not go together at 0. A sheet standing square-on to the robot aims the pen straight back down the arm's own reach line, the wrist goes flat, and prc refuses the job even though every target is well inside the reach ring. 20 deg of lean is the shipped answer.
# note: THE BOARD SWITCH  -  Z FACES THE ROBOT
# 
# boardOrient  0 VERTICAL  1 FLAT  2 TILTED  3 AWAY
# cardinal     0 AUTO  1 +X  2 -X  3 +Y  4 -Y
# 
# With a hotwire the switch acted on the TOOL, because a wire is a line and how you lay it decides whether it cuts. A pen draws with a POINT, so the tool has only one sensible attitude - straight into the paper - and the interesting question moves to the WORK.
# 
#   0 VERTICAL  the sheet stands on an easel and faces the arm. Its own blue Z runs back at the robot.  <-- shipped
#   1 FLAT      lying on a table. Its normal points at the ceiling, so nothing about it faces the robot and zToRobot says so.
#   2 TILTED    a drafting table. leanDeg 0 is FLAT, 90 is VERTICAL - the continuum the other two are the ends of.
#   3 AWAY      the sheet turned round. Kept so you can see wrong.
# 
# MEASURED at the shipped pen lean of 20 deg: only 0 and 3 solve. 1 and 2 want a different lean, because the lean and the board attitude are one question and not two - which is exactly why they live on the same component. Change boardOrient and expect to re-tune penLeanDeg.
# 
# cardinal AUTO reads where the board sits: in front is +X, behind is -X, either side is +/-Y. Drag board X/Y/Z and the sheet turns to keep facing the arm.
# 
# WHICH Z IS WHICH, because this is the thing that confuses everyone:
#   the BOARD's Z points OUT of the sheet, back at the robot
#   the TARGET's Z points INTO the sheet, down the pen
# They are opposite by definition, and they have to be - the pen reaches 227.8 mm ahead of the wrist, so the flange has to sit between the robot and the paper or the arm cannot reach past its own tool. Preview FlangePts to see exactly that.
# 
# AND THE ONE THAT ACTUALLY BIT: penLeanDeg.
# Standing the sheet up square-on aims the pen back down the arm's reach line, so the wrist goes flat and the pose is singular - prc refuses the whole job with every target well inside the ring. Measured here:
#    lean 0, 5, 10        UNREACHABLE
#    lean 15, 20, 25, 30  clean
#    lean 40              UNREACHABLE, too far the other way
# Drag penLeanDeg to 0 and watch prc go red. That is the switch proving the point rather than the note asking you to take it on trust.
toolabc = Panel(pentool.ToolAbc)
status = Panel(pentool.Status)
# note: TF-09 - PEN-SWITCHING LOOP
# 
# Board item TF-09. Also closes D1-01 (draw order) and D1-03 (lead-in / lead-out), which are the same code path.
# 
# Everything on this canvas is orientation-independent: rotate the paper plane anywhere and the job rotates with it. Flip selfTest on to have the component prove that to you.
log = Panel(pentool.Log)
status_2 = Panel(c_script.Status)
# note: WHERE THE ARTWORK IS
# 
# The demo is authored FLAT around the origin, the way you would draw it on paper, and Orient carries it onto whatever board the PENTOOL component builds. The same plane feeds drawPlane, so the strokes and the sheet cannot drift apart - move the board and the drawing goes with it, standing up included.
# 
# It has to be placed at all because the virtual robot stands at the world origin. Artwork left there is underneath the arm and every target comes back unreachable, which reads like a broken toolpath and is not one.
# 
# Using your own curves? Wire them into Orient in place of the demo param, authored flat about the origin. If they are already positioned in the cell, skip Orient and wire them straight into curves - but then drawPlane has to match them by hand.
swaplog = Panel(c_script.SwapLog)
# note: KUKA|prc CORE
# 
# Drag SIM from 0 to 1 to play the job.
# 
# If CORE reports unreachable or collided poses, the fix is almost always to move the WORK, not the maths - the virtual robot stands at the world origin, so anything you draw near the origin is underneath it. Use the paper / part position sliders.
# 
# To write the .src: right-click CORE, open its settings, set the output directory and file name, then tick the export.
# note: ANALYSIS IS LOCKED - THIS IS DELIBERATE
# 
# It needs a licensed KUKA|prc. On this machine it raises a licence error, so it is switched off rather than left to sit there red.
# 
# On the lab machine: right-click it > Enable. You then get numeric axis values, reachability and singularity per move.
# 
# You do not need it to check reach. CORE itself goes orange or red and says so - read the balloon on the CORE component.
swapcount = Panel(c_script.SwapCount)
cycletime = Panel(c_script.CycleTime)
# note: THIS PANEL IS THE ROBOT PROGRAM
# 
# Right-click the KRL panel > Stream Contents, and save it as DRAW_JOB.src next to PENSWAP.src and PENSWAP.dat.
# 
# It is NOT the same file KUKA|prc writes. prc does not know the pen magazine exists, so it cannot emit the swap calls. prc is here to answer 'can the arm reach this' - this panel is what actually runs.
# note: TOOL[1] = THE PEN NIB
# 
# The TCP comes from the PENTOOL component, not from a slider here, and the tool mesh is the lab's Pen_Tool Rev 008 rebuilt in flange coordinates. Nib 227.8 mm off the flange face.
krl = Panel(c_script.KRL)
log_2 = Panel(c_script.Log)
selftest_2 = Panel(c_script.SelfTest)
